# Dynamo graph 00_Asignar Partition.dyn (Dynamo 4.0.2.3852)
# PASO 1 de 6 (va primero) - Recorre las barras, identifica la tipologia de cada una (canastillo inferior/superior, cerco lateral, longitudinal de pedestal, estribo, refuerzo RFZ) y le ESCRIBE el parametro Partition, que los pasos de vistas (2) y cotas (5) necesitan para sus filtros. Las que logra identificar quedan pintadas con su color en la vista 3D indicada; las que no, quedan sin color y aisladas en una vista aparte llamada ARM - BARRAS SIN PARTITION para revisarlas a mano. Solo rellena barras con Partition vacio, nunca pisa lo ya cargado.

procesar_todos_los_assemblies = BoolSelector(false)  # graph input
filtro_por_nombre_si_todos_false = StringInput("")  # graph input
separacion_cota_general_mm_por = IntegerSlider(8, range=0..100 step 1)  # "Separacion cota general (mm) - por FUERA de la cadena"; graph input
filtro_material_cortes_vacio = StringInput("javier.ochoa")  # "Filtro material cortes (vacio = todos)"; graph input
sep_tags_corte_al_borde_mm = IntegerSlider(60, range=0..100 step 1)  # graph input
sep_entre_tags_corte_mm = IntegerSlider(30, range=0..90 step 1)  # graph input
py_clasificar_y_asignar = Python(IN[0]=procesar_todos_los_assemblies, IN[1]=filtro_por_nombre_si_todos_false, IN[2]=separacion_cota_general_mm_por, IN[3]=filtro_material_cortes_vacio, IN[4]=sep_tags_corte_al_borde_mm, IN[5]=sep_entre_tags_corte_mm)  # "PY | Clasificar y asignar Partition"; PythonNet3
# ---------- py_clasificar_y_asignar.python (1192 lines) ----------
# 05_Asignar Partition - OPCIONAL. Clasifica automaticamente cada barra por su tipologia y
# le escribe el parametro de instancia `Partition`. Pensado para modelos que vienen SIN ese
# dato cargado (el 00 y el 03 lo necesitan para sus filtros de visibilidad y tagueo).
#
# Tipologias y reglas (definidas con Javier, 2026-07-21, validadas contra el modelo de
# referencia que SI tiene los Partition correctos):
#
#   SEC-EST  estribos / amarras del pedestal
#            -> RebarShape.RebarStyle == StirrupTie  (mismo criterio que ya usa el 03)
#   RFZ-RFZ  refuerzo con forma y tipo dedicados (magenta) - pedido de Javier 2026-07-24
#            -> Shape (RebarShape) == "TIPO-3" o "TIPO-1 RFZ" Y tipo == "o 10 mm / Traccion"
#               o "o 10 mm / Amarre" (mismas barras, distinto sufijo de tipo)
#   PPL-PPL  barras longitudinales del pedestal
#            -> el tramo principal corre VERTICAL (confirmado: bbox Z 24->1112mm con
#               ancho igual al diametro)
#   SEC-RFZ  refuerzo suelto que se agrega entre el array y el borde de la zapata
#            -> cruza como las de malla pero NO es Number with Spacing (barra suelta).
#               Se evalua ANTES que SEC-LAT: ambas quedan cerca del canto, y el layout
#               rule es el dato inequivoco que las separa.
#   SEC-LAT  barras laterales (pegadas a las caras VERTICALES del costado del elemento)
#            -> se detecta por GEOMETRIA: altura media en la seccion de muro/viga/zapata
#               (ver bloques de esos hosts mas abajo). El viejo criterio por marcador
#               "(LATERAL)" en Schedule Mark quedo DESACTIVADO el 2026-07-24 (enmascaraba
#               la geometria); si se necesita, esta comentado dentro de clasificar().
#
#   BARRAS DE MURO (host = categoria Walls; 2026-07-24, Javier): se clasifican SOLO por
#   orientacion y ANTES que el resto del arbol -> VERTICAL = PPL-PPL, HORIZONTAL = SEC-LAT.
#   Va antes de RFZ-RFZ porque las barras de muro tienen Shape TIPO-3/TIPO-1 RFZ + tipo o10
#   y si no se atajan aca caen en RFZ-RFZ (magenta), que es solo para fundacion/zapata.
#
#   BARRAS DE VIGA (host = Structural Framing; 2026-07-29, Javier): TODAS PPL-PPL, sin
#   excepcion salvo los estribos (SEC-EST, que se evaluan primero). Ya NO pasan por
#   clasificar_viga(): en viga no se distingue cara superior / inferior / costado.
#
#   BARRAS DE ZAPATA (host = Floors o Structural
#   Foundation) usan clasificar_viga() (2026-07-24, Javier — 2a version, por
#   PROXIMIDAD GEOMETRICA a las caras reales del host, ver caras_planas_host()): mas cerca
#   de una cara VERTICAL (costado) -> SEC-LAT; mas cerca de una cara HORIZONTAL (superior o
#   inferior) -> PPL-SUP/PPL-INF segun este sobre o bajo el medio del host. Reemplaza a la
#   1a version (tercios de altura del bbox, FRAC_CARA_VIGA): esa fallaba con barras SEC-LAT
#   modeladas "Parallel to Work Plane" desde la cara superior/inferior, cuyo centroide caia
#   en el tercio sup/inf del bbox aunque estuvieran pegadas a un costado. Va DESPUES del
#   check de verticalidad (para que los
#   pedestales verticales de familias combinadas salgan PPL-PPL primero) — reemplaza a la
#   malla para zapatas (la malla queda de fallback para otros hosts). Estribos -> SEC-EST
#   (se evalua primero, sin cambios).
#   PPL-INF  canastillo inferior   -> malla, tramo principal por DEBAJO del medio
#   PPL-SUP  canastillo superior   -> malla, tramo principal por ENCIMA del medio
#
# El orden de evaluacion importa: es un arbol de decision, la primera regla que matchea gana.
#
# EL SCRIPT SE ABSTIENE cuando no esta seguro (pedido de Javier, 2026-07-21): antes, toda
# barra horizontal terminaba forzada a PPL-INF/PPL-SUP segun su altura, aunque no hubiera
# ninguna evidencia de que fuera una barra de malla. Ahora, si no se cumplen las condiciones
# de confianza (ver el bloque de malla al final de clasificar), devuelve None: la barra
# queda SIN Partition, SIN color, y aislada en la vista de pendientes para asignarla a mano.
# Es preferible no responder a inventar una respuesta que despues hay que ir a cazar.
#
# MODO AUDITORIA (IN[0] = True, por defecto): NO escribe nada. Recorre las barras, las
# clasifica y COMPARA contra el Partition que ya tengan, reportando aciertos y fallos. Sirve
# para validar las reglas sobre un modelo ya resuelto ANTES de soltarlo en uno sin datos.
#
# Al aplicar, solo RELLENA barras con Partition vacio (no pisa lo ya cargado).
#
# Revit 2027 / Dynamo 4 / CPython3
# IN[0] = Solo auditar (True = no escribe nada, solo reporta)
# IN[1] = filtro por nombre de assembly (parcial, comas; vacio = TODAS las barras del modelo)
# IN[2] = tolerancia de borde para SEC-LAT (% de la dimension de la zapata)
# IN[3] = nombre de la vista donde aplicar los colores (vacio = no aplicar colores)
# IN[4] = umbral "el set abarca la zapata" (% de la dimension)
# IN[5] = tolerancia vertical para PPL-PPL (grados respecto a la vertical)
#
# Ademas del Partition, el script normaliza el SCHEDULE MARK de TODAS las barras que caen
# en la regla -sets multibarra Y barras SUELTAS (2026-07-30, Javier)- con la nota semantica
# que sale impresa en la etiqueta Multi-Rebar Annotation del 04
# ((SUP.-INF.) / (LATERAL) / (INT.-EXT.)) - ver el bloque SCHEDULE MARK SEMANTICO mas
# abajo. Respeta el modo Solo AUDITAR igual que el Partition.

import clr
import math
import re
clr.AddReference('RevitAPI')
clr.AddReference('RevitServices')
from Autodesk.Revit.DB import (FilteredElementCollector, BuiltInCategory, BuiltInParameter,
                               ElementId, View, AssemblyInstance, FamilyInstance,
                               ParameterFilterElement, ElementParameterFilter,
                               ParameterFilterRuleFactory, OverrideGraphicSettings, Color,
                               Element, FillPatternElement, ViewDuplicateOption,
                               TemporaryViewMode, Options, ViewDetailLevel, Solid,
                               GeometryInstance, PlanarFace)
# OJO: MultiplanarOption vive en el namespace .Structure, NO en Autodesk.Revit.DB
# (importarlo desde DB tira "cannot import name" y voltea todo el script).
from Autodesk.Revit.DB.Structure import Rebar, RebarStyle, MultiplanarOption
from RevitServices.Persistence import DocumentManager
from RevitServices.Transactions import TransactionManager
from System.Collections.Generic import List

doc = DocumentManager.Instance.CurrentDBDocument

solo_auditar = bool(IN[0])
filtro_txt = (IN[1] or '').strip()
tol_borde = float(IN[2]) / 100.0
vista_colores = (IN[3] or '').strip()
umbral_abarca = float(IN[4]) / 100.0
tol_vertical_grados = float(IN[5])

COS_VERTICAL = math.cos(math.radians(max(1.0, min(89.0, tol_vertical_grados))))

# colores por tipologia (los de la lamina de referencia de Javier)
COLORES = {
    'PPL-INF': (255, 255, 0),    # amarillo (2026-07-24; antes azul, brevemente oliva)
    'PPL-SUP': (255, 0, 0),      # rojo
    'SEC-LAT': (0, 176, 80),     # verde
    'PPL-PPL': (255, 128, 0),    # naranjo
    'SEC-EST': (0, 176, 240),    # celeste
    'SEC-RFZ': (255, 0, 255),    # magenta (asignacion MANUAL, ver notas abajo)
    'RFZ-RFZ': (255, 0, 255),    # magenta - refuerzo Shape TIPO-3/TIPO-1 RFZ tipo o10 Traccion
}
PREFIJO_FILTRO = 'ARM_PARTITION_'
# marcador que los modeladores escriben en Schedule Mark para el cerco lateral
TEXTO_LATERAL = 'LATERAL'
# Umbrales de CONFIANZA para afirmar que una barra es de malla (PPL-INF / PPL-SUP). Si no
# se cumplen, el script se abstiene y manda la barra a la vista de pendientes.
# - FACTOR_DESBORDE: cuanto puede medir el tramo respecto a la dimension del host antes de
#   considerar que ese host no es el elemento que la contiene (medido: las mallas legitimas
#   dan 86-96%, y los casos problematicos 137% y hasta 480%).
# - MARGEN_ALTURA: que tan lejos del medio del host debe caer el tramo para decidir si es
#   canastillo superior o inferior (medido: las mallas reales estan al 43-47% de la altura).
FACTOR_DESBORDE = 1.2
MARGEN_ALTURA = 0.15
# Vigas/zapatas: 2026-07-24 se REEMPLAZO el criterio de tercios de altura (FRAC_CARA_VIGA)
# por proximidad geometrica a las caras reales del host (ver caras_planas_host() y
# clasificar_viga() mas abajo) - el criterio de tercios fallaba con barras SEC-LAT
# modeladas "Parallel to Work Plane" desde la cara superior/inferior: su centroide caia
# en el tercio sup/inf del bbox aunque geometricamente estuvieran pegadas a un costado.
# TOL_LAT_MM: tolerancia (mm) para desempatar cara lateral vs cara sup/inf cuando las
# distancias son casi iguales; dentro de esa banda se prioriza SEC-LAT (fallback
# conservador, para no perder una barra lateral real).
TOL_LAT_MM = 5.0

# --- SCHEDULE MARK SEMANTICO EN LOS SETS MULTIBARRA (2026-07-29, pedido de Javier) ---
# Schedule Mark es un parametro de instancia de TEXTO LIBRE de Rebar que Revit AUTONUMERA
# al crear la barra (de ahi los valores como "18"); ademas no es unico: medido por MCP
# contra el modelo real, 8 barras distintas comparten el "18". Su proposito original es
# identificar la barra en la tabla de despiece, pero en este proyecto los modeladores lo
# pisan a mano con una nota semantica entre parentesis, y ESA nota es la que sale impresa
# en la etiqueta Multi-Rebar Annotation que crea el 04.
#
# Problema que resuelve: la nota se escribia a mano y de forma despareja, asi que muchas
# etiquetas salian con el numero automatico en vez de la nota. Medido por MCP sobre el
# modelo real (619 barras): de las 33 barras PPL-INF multibarra -las unicas, junto con las
# SEC-LAT, que reciben Multi-Rebar Annotation en la planta (PARTITIONS_TAGEABLES del 04)-
# solo 6 tenian la nota. El "(SUP.-INF.)" estaba escrito sobre las PPL-SUP (45 de 68), que
# son la malla que NO se etiqueta. Habia ademas dos erratas: "(UP.-INF.)" y "(EXT.-INT.)".
#
# La nota se DERIVA del Partition (decision de Javier sobre la alternativa de "todo set
# multibarra al mismo texto", que habria pisado los 25 (INT.-EXT.) de muro y los 25
# (LATERAL) de cerco, que estan correctas).
#
# ALCANCE: sets multibarra Y BARRAS SUELTAS (2026-07-30, Javier). La 1a version (2026-07-29)
# solo tocaba los sets multibarra, con el argumento de que en una barra suelta un recuento
# que vale para dos caras no significa nada. En la practica es al reves: hay barras PPL-SUP /
# PPL-INF (y SEC-LAT) modeladas SUELTAS, y el 04 las etiqueta igual - de hecho es el Layout
# "Single" el que recibe el tipo de tag RecuentoDoble_Corto (TIPO_TAG_POR_LAYOUT del 04), o
# sea justo el de RECUENTO DOBLE -, asi que esas barras salian impresas en la lamina con el
# numero autonumerado de Revit. La regla pasa a depender SOLO del host y del Partition, no de
# la cantidad de barras del set. es_set_multibarra() se conserva, pero ya solo para desglosar
# el log (cuantas de las tocadas eran sueltas).
#
#   host = muro          -> (INT.-EXT.)  las dos mallas del muro, cara interior/exterior.
#                           Va ANTES del mapa por Partition porque las barras de muro
#                           salen PPL-PPL (verticales) o SEC-LAT (horizontales), y por
#                           Partition las horizontales caerian -mal- en (LATERAL).
#                           Confirmado por MCP: los 25 (INT.-EXT.) del modelo son 10
#                           PPL-PPL + 15 SEC-LAT, o sea exactamente el reparto que hace la
#                           regla de muros de este script.
#   PPL-INF / PPL-SUP    -> (SUP.-INF.)  un solo recuento sirve para las dos mallas.
#   SEC-LAT              -> (LATERAL)    cerco lateral.
#   el resto (SEC-EST, PPL-PPL de pedestal, RFZ-RFZ, SEC-RFZ) NO se toca: los estribos
#   usan el tipo de etiqueta RecuentoSimple del 04, no el de recuento doble.
#
# Se PISA lo que haya escrito (decision de Javier): es lo que normaliza las erratas. El
# Partition de referencia es el EFECTIVO del modelo -el que la barra ya traia, o el que
# este script acaba de escribir-, no el calculado, para no desincronizarse del modelo.
TEXTO_SM_SUP_INF = '(SUP.-INF.)'
TEXTO_SM_LATERAL = '(LATERAL)'
TEXTO_SM_INT_EXT = '(INT.-EXT.)'
SM_POR_PARTITION = {
    'PPL-INF': TEXTO_SM_SUP_INF,
    'PPL-SUP': TEXTO_SM_SUP_INF,
    'SEC-LAT': TEXTO_SM_LATERAL,
}
# Partitions de barra de MURO que llevan (INT.-EXT.): las dos unicas que produce la regla de
# muros del arbol (vertical -> PPL-PPL, horizontal -> SEC-LAT). Sin este filtro, la rama de
# muro le ponia la nota a CUALQUIER barra hospedada en un muro, incluidos los estribos, que
# salen SEC-EST en la primera regla del arbol y que segun la regla de arriba NO se tocan.
# Quedaba invisible mientras la nota solo alcanzaba a los sets multibarra; al entrar las
# barras sueltas (2026-07-30) si aparece, asi que se acota aca.
PARTITIONS_SM_MURO = ('PPL-PPL', 'SEC-LAT')

# Nombre FIJO de la vista derivada con las barras pendientes. Es fijo y sin llaves a
# proposito: las vistas 3D de Revit se llaman "{3D - usuario}" y Revit NO acepta llaves en
# un nombre de vista puesto por el usuario/API, asi que derivar el nombre de la vista base
# hacia fallar SIEMPRE el renombrado y dejaba la duplicada como "... Copy 1" (bug real
# 2026-07-21). Ademas, al no contener el nombre de la vista base, no compite con ella en la
# busqueda por coincidencia parcial.
NOMBRE_VISTA_PENDIENTES = 'ARM - BARRAS SIN PARTITION'

log = []


def elem_name(e):
    try:
        return e.Name
    except Exception:
        return Element.Name.__get__(e)


def leer_partition(r):
    try:
        p = r.LookupParameter('Partition')
    except Exception:
        p = None
    if p is None:
        return None
    try:
        v = p.AsString()
    except Exception:
        v = None
    return v.strip() if v else ''


def leer_schedule_mark(r):
    # texto libre que escriben los modeladores; lleva marcadores semanticos como
    # "(LATERAL)" o "(SUP.-INF.)".
    p = None
    try:
        p = r.LookupParameter('Schedule Mark')
        if p is None:
            for q in r.Parameters:
                try:
                    if 'schedule mark' in q.Definition.Name.strip().lower():
                        p = q
                        break
                except Exception:
                    continue
    except Exception:
        return ''
    if p is None:
        return ''
    try:
        v = p.AsString()
    except Exception:
        return ''
    return v.strip() if v else ''


def param_partition(r):
    # devuelve el Parameter 'Partition' (built-in de Rebar, no compartido) buscando por
    # nombre: asi no hace falta acertarle al nombre exacto del BuiltInParameter.
    try:
        for p in r.Parameters:
            try:
                if p.Definition.Name.strip().lower() == 'partition':
                    return p
            except Exception:
                continue
    except Exception:
        pass
    return None


def es_estribo(r):
    # mismo criterio que es_estribo_stirrup_tie del 03: el ESTILO vive en la RebarShape,
    # no en la barra. RebarShape.RebarStyle == StirrupTie identifica estribos/amarras.
    try:
        shape = doc.GetElement(r.GetShapeId())
        if shape is None:
            return False
        return shape.RebarStyle == RebarStyle.StirrupTie
    except Exception:
        return False


# --- RFZ-RFZ: refuerzo identificado por su Shape y su tipo (pedido de Javier 2026-07-24) ---
# No es geometrico como el resto del arbol: son barras concretas que el modelador arma con
# una forma (RebarShape) y un tipo (RebarBarType) dedicados. Criterio dado por Javier:
#   Shape (propiedad, el RebarShape) == "TIPO-3" o "TIPO-1 RFZ", Y
#   tipo (RebarBarType) == "o 10 mm / Traccion"  (diametro 10, no el O16 del cerco SEC-LAT,
#   que comparte la forma TIPO-3 - por eso hace falta ademas el filtro por tipo/diametro).
SHAPES_RFZ = ('TIPO-3', 'TIPO-1 RFZ')

def nombre_shape(r):
    try:
        return elem_name(doc.GetElement(r.GetShapeId())).strip().upper()
    except Exception:
        return ''

def es_shape_rfz(r):
    return nombre_shape(r) in SHAPES_RFZ

def es_tipo_rfz_10(r):
    # tipo "o 10 mm / Traccion" O "o 10 mm / Amarre": son las mismas barras RFZ, solo
    # cambia el sufijo del tipo (2026-07-24, Javier). Se evita depender del simbolo o-slash
    # (encoding) y se aisla el "10" con un lookbehind para no confundir 110/210 mm.
    try:
        nm = elem_name(doc.GetElement(r.GetTypeId())).strip().lower()
    except Exception:
        return ''
    return (('tracc' in nm) or ('amarre' in nm)) and (re.search(r'(?<!\d)10\s*mm', nm) is not None)


def es_number_with_spacing(r):
    # El RebarShapeDrivenAccessor NO tiene getter para el Layout Rule (es de solo
    # escritura, ver leer_layout_rule del 03): hay que leerlo del parametro de instancia,
    # buscando por coincidencia PARCIAL del nombre ('layout') y con AsValueString(),
    # porque es un enum. Mismo patron ya probado en el 03.
    try:
        for p in r.Parameters:
            try:
                nombre = p.Definition.Name
            except Exception:
                continue
            if 'layout' in nombre.lower():
                txt = p.AsValueString()
                if txt:
                    return txt.strip().lower() == 'number with spacing'
    except Exception:
        pass
    return False


def cantidad_barras(r):
    # nro de barras del set (Rebar.Quantity). Se usa para exigir que un SEC-RFZ sea de
    # verdad una barra suelta y no un array modelado con otro layout rule.
    try:
        return int(r.Quantity)
    except Exception:
        try:
            p = r.LookupParameter('Quantity')
            return int(p.AsInteger()) if p is not None else 1
        except Exception:
            return 1


def tramo_principal(r):
    # (p0, p1, largo) de la curva MAS LARGA de la barra = su tramo principal (el "B" del
    # despiece). Se usa para la direccion y para la altura, en vez del bounding box, que
    # incluye los ganchos y hace que INF y SUP se solapen en Z (verificado: INF 12-208mm,
    # SUP 92-300mm - el bbox no los separa, el tramo principal si).
    # Firma correcta (la misma que ya usa el 03): 3 bool + el ENUM MultiplanarOption + el
    # indice de barra. En la 1a corrida se paso un int crudo (0) en vez del enum y sin
    # importarlo: la llamada fallaba y dejaba SIN CLASIFICAR a todas las barras que no eran
    # estribo (334 de 425) - los estribos se salvaban porque se resuelven antes, sin
    # geometria.
    try:
        curvas = r.GetCenterlineCurves(False, True, True, MultiplanarOption.IncludeOnlyPlanarCurves, 0)
    except Exception:
        return None
    mejor = None
    mejor_l = 0.0
    lo = [None, None, None]
    hi = [None, None, None]
    for c in curvas:
        try:
            l = c.Length
            p0 = c.GetEndPoint(0)
            p1 = c.GetEndPoint(1)
        except Exception:
            continue
        for p in (p0, p1):
            for i, val in enumerate((p.X, p.Y, p.Z)):
                if lo[i] is None or val < lo[i]:
                    lo[i] = val
                if hi[i] is None or val > hi[i]:
                    hi[i] = val
        if l > mejor_l:
            mejor_l = l
            mejor = (p0, p1, l)
    if mejor is None or lo[0] is None:
        return None
    p0, p1, l = mejor
    # extensiones de ESTA barra sacadas de sus propias curvas. NO se usa
    # Element.get_BoundingBox(None): para Rebar devuelve None y por eso el fix de
    # verticalidad de la 2a auditoria no se ejecuto nunca (PPL-PPL quedo clavado en 148).
    return (p0, p1, l, hi[0] - lo[0], hi[1] - lo[1], hi[2] - lo[2])


def bbox_host(r):
    # extents del hormigon que aloja la barra = la "zapata" de referencia para los tests
    # de altura y de borde.
    try:
        hid = r.GetHostId()
    except Exception:
        return None
    if hid is None or hid == ElementId.InvalidElementId:
        return None
    el = doc.GetElement(hid)
    if el is None:
        return None
    try:
        return el.get_BoundingBox(None)
    except Exception:
        return None


def es_host_muro(r):
    # True si el HOST de la barra es un muro (categoria Walls / OST_Walls). Los muros de
    # este modelo son muros de sistema (tipos PR-2001/PR-1002/PR-2003...), categoria Walls,
    # asi que basta con la categoria del host (no depende del nombre de familia).
    try:
        hid = r.GetHostId()
    except Exception:
        return False
    if hid is None or hid == ElementId.InvalidElementId:
        return False
    el = doc.GetElement(hid)
    if el is None:
        return False
    try:
        cat = el.Category
        return cat is not None and cat.Id == ElementId(BuiltInCategory.OST_Walls)
    except Exception:
        return False


def es_vertical(r):
    # True si el tramo principal de la barra es vertical-dominante (mismo criterio que el
    # arbol usa para PPL-PPL). None si no tiene curvas de eje utilizables. Se usa para
    # clasificar las barras de muro por orientacion.
    tp = tramo_principal(r)
    if tp is None:
        return None
    p0, p1, largo, ext_x, ext_y, ext_z = tp
    v = p1.Subtract(p0)
    if v.GetLength() < 1e-9:
        return None
    d = v.Normalize()
    return (abs(d.Z) >= COS_VERTICAL) or (ext_z >= max(ext_x, ext_y))


def es_host_viga(r):
    # True si el HOST de la barra es una viga (Structural Framing / OST_StructuralFraming).
    try:
        hid = r.GetHostId()
    except Exception:
        return False
    if hid is None or hid == ElementId.InvalidElementId:
        return False
    el = doc.GetElement(hid)
    if el is None:
        return False
    try:
        cat = el.Category
        return cat is not None and cat.Id == ElementId(BuiltInCategory.OST_StructuralFraming)
    except Exception:
        return False


def caras_planas_host(el):
    # Caras PLANAS del host, en coordenadas de MUNDO: recorre solidos reales (Volume > 0)
    # de la geometria del elemento, recursivo sobre GeometryInstance (familias cargables
    # con geometria anidada, ej. C-VigaHormigon) - GetInstanceGeometry() ya devuelve la
    # geometria transformada a mundo, no hace falta aplicar el Transform a mano.
    caras = []
    try:
        opt = Options()
        opt.ComputeReferences = False
        opt.DetailLevel = ViewDetailLevel.Fine
        geo = el.get_Geometry(opt)
    except Exception:
        return caras
    if geo is None:
        return caras

    def procesar(objetos):
        for g in objetos:
            try:
                if isinstance(g, Solid):
                    if g.Volume > 1e-9:
                        for f in g.Faces:
                            if isinstance(f, PlanarFace):
                                caras.append(f)
                elif isinstance(g, GeometryInstance):
                    ig = g.GetInstanceGeometry()
                    if ig is not None:
                        procesar(ig)
            except Exception:
                continue

    procesar(geo)
    return caras


def clasificar_viga(r):
    # Clasifica una barra HORIZONTAL hospedada en una ZAPATA por PROXIMIDAD
    # GEOMETRICA a las caras reales del host (2026-07-24, Javier — reemplaza el criterio de
    # tercios de altura del bbox, que fallaba con barras SEC-LAT modeladas "Parallel to Work
    # Plane" desde la cara superior/inferior: su centroide caia en el tercio sup/inf del
    # bbox aunque estuvieran geometricamente pegadas a un costado). Mide la distancia
    # perpendicular del centro del tramo principal de la barra al plano de cada cara PLANA
    # del host: si esta mas cerca de una cara VERTICAL (normal horizontal, |Z|<0.1, cara de
    # costado) -> SEC-LAT; si esta mas cerca de una cara HORIZONTAL (normal vertical,
    # |Z|>0.9, cara superior o inferior) -> PPL-SUP/PPL-INF segun si el centro de la barra
    # esta sobre o bajo el medio del host. Empate dentro de TOL_LAT_MM (o si falta un lado)
    # -> SEC-LAT (fallback conservador, para no perder una barra lateral real).
    tp = tramo_principal(r)
    if tp is None:
        return None, 'barra de viga/zapata sin curvas de eje utilizables'
    p0, p1 = tp[0], tp[1]
    cx = (p0.X + p1.X) / 2.0
    cy = (p0.Y + p1.Y) / 2.0
    cz = (p0.Z + p1.Z) / 2.0

    try:
        hid = r.GetHostId()
    except Exception:
        hid = None
    el = doc.GetElement(hid) if (hid is not None and hid != ElementId.InvalidElementId) else None
    if el is None:
        return None, 'sin host para medir caras'

    caras = caras_planas_host(el)
    horizontales = []  # (distancia, Z de la cara) - normal vertical -> cara sup/inf
    verticales = []    # distancia - normal horizontal -> cara de costado (lateral)
    for f in caras:
        try:
            n = f.FaceNormal
            o = f.Origin
        except Exception:
            continue
        if n is None or o is None:
            continue
        dist = abs((cx - o.X) * n.X + (cy - o.Y) * n.Y + (cz - o.Z) * n.Z)
        nz = abs(n.Z)
        if nz > 0.9:
            horizontales.append((dist, o.Z))
        elif nz < 0.1:
            verticales.append(dist)
        # caras inclinadas (0.1 <= |Z| <= 0.9): se ignoran, no deberian existir en estos hosts

    if not horizontales and not verticales:
        log.append('AVISO: host sin caras planas para clasificar por proximidad: {} -> barra {} sin clasificar geometrica.'.format(
            elem_name(el), r.Id.Value))
        return None, 'host sin caras planas utilizables para proximidad'

    d_lat = min(verticales) if verticales else None
    d_supinf = min(horizontales, key=lambda t: t[0])[0] if horizontales else None
    tol = TOL_LAT_MM / 304.8

    if d_lat is not None and (d_supinf is None or d_lat < d_supinf - tol):
        return 'SEC-LAT', 'mas cerca de cara lateral (d_lat={:.1f}mm, d_sup_inf={})'.format(
            d_lat * 304.8, 'n/d' if d_supinf is None else '{:.1f}mm'.format(d_supinf * 304.8))

    if d_supinf is not None and (d_lat is None or d_supinf < d_lat - tol):
        bb = bbox_host(r)
        z_medio = (bb.Min.Z + bb.Max.Z) / 2.0 if bb is not None else (
            sum(z for _, z in horizontales) / len(horizontales))
        if cz >= z_medio:
            return 'PPL-SUP', 'mas cerca de cara horizontal, sobre el medio (d_sup_inf={:.1f}mm)'.format(d_supinf * 304.8)
        return 'PPL-INF', 'mas cerca de cara horizontal, bajo el medio (d_sup_inf={:.1f}mm)'.format(d_supinf * 304.8)

    # empate dentro de tolerancia: fallback conservador, no perder una barra lateral real
    return 'SEC-LAT', 'distancias empatadas cara lateral / sup-inf (fallback conservador, d_lat={} d_sup_inf={})'.format(
        'n/d' if d_lat is None else '{:.1f}mm'.format(d_lat * 304.8),
        'n/d' if d_supinf is None else '{:.1f}mm'.format(d_supinf * 304.8))


def es_host_zapata(r):
    # True si el HOST es una zapata: Floor (OST_Floors) o Structural Foundation
    # (OST_StructuralFoundation). Se usa para que las barras horizontales de altura MEDIA
    # (las laterales, pegadas a las caras verticales) salgan SEC-LAT en vez de abstenerse.
    try:
        hid = r.GetHostId()
    except Exception:
        return False
    if hid is None or hid == ElementId.InvalidElementId:
        return False
    el = doc.GetElement(hid)
    if el is None:
        return False
    try:
        cat = el.Category
        if cat is None:
            return False
        return (cat.Id == ElementId(BuiltInCategory.OST_Floors)
                or cat.Id == ElementId(BuiltInCategory.OST_StructuralFoundation))
    except Exception:
        return False


def param_schedule_mark(r):
    # Parameter 'Schedule Mark' de la barra, buscado por NOMBRE (mismo patron que
    # param_partition / leer_schedule_mark): exacto primero, coincidencia parcial despues,
    # para no depender de acertarle al BuiltInParameter. Verificado por MCP contra el
    # modelo real: storageType String, isReadOnly False -> se puede escribir.
    try:
        p = r.LookupParameter('Schedule Mark')
        if p is not None:
            return p
        for q in r.Parameters:
            try:
                if 'schedule mark' in q.Definition.Name.strip().lower():
                    return q
            except Exception:
                continue
    except Exception:
        pass
    return None


def es_set_multibarra(r):
    # 'multirebar' = set con MAS de una barra. Se decide por Quantity (cantidad_barras) y
    # NO por CanApplyPresentationMode, que es el criterio equivalente del 01: ese necesita
    # una vista como argumento y aca no hay ninguna. Un Layout Rule 'Single' da Quantity 1.
    # YA NO decide si la barra lleva nota (2026-07-30: las barras sueltas tambien la llevan,
    # ver el bloque SCHEDULE MARK SEMANTICO); solo se usa para desglosar el log.
    return cantidad_barras(r) > 1


def schedule_mark_objetivo(r, partition):
    # Nota semantica que le corresponde a la barra, o None si queda fuera de la regla
    # (Partition sin nota asignada). Vale igual para sets multibarra y barras SUELTAS
    # (2026-07-30). Ver el bloque SCHEDULE MARK SEMANTICO mas arriba para el porque de cada
    # rama y del orden.
    p = (partition or '').strip().upper()
    if es_host_muro(r):
        # las dos mallas del muro, cara interior/exterior. Va ANTES del mapa por Partition
        # porque las horizontales de muro son SEC-LAT y ahi caerian -mal- en (LATERAL).
        return TEXTO_SM_INT_EXT if p in PARTITIONS_SM_MURO else None
    return SM_POR_PARTITION.get(p)


def clasificar(r):
    # Arbol de decision: la PRIMERA regla que matchea gana. Devuelve (partition, motivo)
    # o (None, motivo) si no se pudo clasificar.
    if es_estribo(r):
        return 'SEC-EST', 'RebarStyle = StirrupTie'

    # BARRAS DE MURO (2026-07-24, Javier): si el HOST es un muro (Walls), la tipologia se
    # decide SOLO por orientacion y ANTES que cualquier otra regla â€” vertical -> PPL-PPL,
    # horizontal -> SEC-LAT. Va antes de RFZ-RFZ a proposito: las barras de muro tienen
    # Shape TIPO-3/TIPO-1 RFZ + tipo o10, asi que si no se atajan aca caerian en RFZ-RFZ
    # (magenta) â€” y la regla RFZ-RFZ es SOLO para el refuerzo de fundacion/zapata, no muros.
    if es_host_muro(r):
        vert = es_vertical(r)
        if vert is None:
            return None, 'barra de muro sin curvas de eje utilizables'
        if vert:
            return 'PPL-PPL', 'barra vertical en muro'
        return 'SEC-LAT', 'barra horizontal en muro'

    # BARRAS DE VIGA (host = Structural Framing; 2026-07-29, Javier): TODAS las barras
    # alojadas en una viga son PPL-PPL. La UNICA excepcion son los estribos, que ya salieron
    # como SEC-EST en la primera regla del arbol. Reemplaza a clasificar_viga() (proximidad
    # geometrica a las caras del host, que repartia entre SEC-LAT / PPL-SUP / PPL-INF): en
    # las vigas de este modelo ese reparto no aportaba y metia ruido; el criterio de Javier
    # es que todo el armado longitudinal de viga se trata como principal. clasificar_viga()
    # SIGUE EN USO para las ZAPATAS (mas abajo, despues del check de verticalidad).
    # Va antes de RFZ-RFZ por la misma razon que los muros: las barras de viga pueden
    # compartir Shape/tipo con el refuerzo de zapata y caerian en RFZ-RFZ (magenta).
    if es_host_viga(r):
        return 'PPL-PPL', 'barra en viga (Structural Framing), no estribo'

    # RFZ-RFZ: refuerzo por Shape + tipo (no geometrico; ver helpers arriba). Se evalua
    # temprano porque es un dato explicito del modelador (forma + tipo dedicados), mas fuerte
    # que cualquier heuristica geometrica. No pisa a los estribos (van antes) y no choca con
    # SEC-LAT: ese es o16 y este es o10, aunque compartan la forma TIPO-3.
    if es_shape_rfz(r) and es_tipo_rfz_10(r):
        return 'RFZ-RFZ', 'Shape {} + tipo o10 (Traccion/Amarre)'.format(nombre_shape(r))

    # SEC-LAT por MARCADOR SEMANTICO "(LATERAL)" en Schedule Mark: DESACTIVADO (2026-07-24,
    # pedido de Javier). Este marcador manual atrapaba las barras laterales ANTES de la
    # logica geometrica de muro/viga/zapata (que ahora detecta el lateral por su altura
    # MEDIA en la seccion), enmascarando ese criterio nuevo -> "funcionaba igual que
    # siempre". Se quita para que la GEOMETRIA sea la unica fuente de verdad del SEC-LAT.
    # (Contexto historico: se agrego el 2026-07-21 porque los intentos geometricos de esa
    # fecha -spread del set, cercania al borde- no separaban el cerco de la malla; el
    # criterio nuevo por ALTURA MEDIA si los separa. Si hiciera falta, descomentar.)
    # if TEXTO_LATERAL in leer_schedule_mark(r).upper():
    #     return 'SEC-LAT', 'Schedule Mark contiene ({})'.format(TEXTO_LATERAL)

    tp = tramo_principal(r)
    if tp is None:
        return None, 'sin curvas de eje utilizables'
    p0, p1, largo, ext_x, ext_y, ext_z = tp
    v = p1.Subtract(p0)
    if v.GetLength() < 1e-9:
        return None, 'tramo principal degenerado'
    d = v.Normalize()

    # Verticalidad: NO basta con que el tramo mas largo sea vertical. Hay barras de
    # pedestal en L cuyo tramo de anclaje HORIZONTAL dentro de la zapata es mas largo que
    # el tramo vertical (26 fallos reales en la auditoria del 2026-07-21: PPL-PPL
    # clasificadas como malla). Se acepta tambien la barra "mas alta que ancha": su
    # desarrollo vertical total supera al horizontal, que es justo lo que distingue a una
    # barra que sube por el pedestal de una que se acuesta en la zapata.
    mas_alta_que_ancha = ext_z >= max(ext_x, ext_y)
    if abs(d.Z) >= COS_VERTICAL or mas_alta_que_ancha:
        return 'PPL-PPL', 'desarrollo vertical dominante (z={:.0f} x={:.0f} y={:.0f} mm)'.format(
            ext_z * 304.8, ext_x * 304.8, ext_y * 304.8)

    # ZAPATAS (host = Floors o Structural Foundation): clasificacion GEOMETRICA â€” por
    # POSICION en la seccion (altura Z respecto al bbox del host): cara superior PPL-SUP,
    # cara inferior PPL-INF, altura media (barras laterales pegadas a las caras verticales
    # del costado) SEC-LAT. Va DESPUES del check de verticalidad para que los pedestales
    # verticales de familias combinadas fundacion+pedestal (categoria Structural Foundation)
    # ya hayan salido PPL-PPL. (2026-07-24, Javier: "pasemos zapatas a la logica de vigas".)
    if es_host_zapata(r):
        return clasificar_viga(r)

    bb = bbox_host(r)
    if bb is None:
        return None, 'sin host de hormigon para ubicarla'

    dx = bb.Max.X - bb.Min.X
    dy = bb.Max.Y - bb.Min.Y
    if dx <= 1e-9 or dy <= 1e-9:
        return None, 'host sin extension en planta'

    # Geometria del TRAMO PRINCIPAL respecto a la zapata: cuanto la cruza y que tan cerca
    # de un borde corre. Se mide sobre la BARRA (su tramo), no sobre el spread del SET:
    # medir el set fue el error de la 1a auditoria (una malla chica dentro de una zapata
    # grande daba "18% de la zapata" y se colaba como cerco).
    cx = (p0.X + p1.X) / 2.0
    cy = (p0.Y + p1.Y) / 2.0
    if abs(d.X) >= abs(d.Y):
        dim_dir = dx                                        # el tramo corre en X
        dist_borde = min(cy - bb.Min.Y, bb.Max.Y - cy) / dy  # ...borde perpendicular en Y
    else:
        dim_dir = dy
        dist_borde = min(cx - bb.Min.X, bb.Max.X - cx) / dx
    # cuanto se DISTRIBUYE el set a lo ancho de la zapata (perpendicular al tramo): una
    # malla se reparte por toda la zapata; el cerco perimetral queda acotado a un canto.
    abarca = None
    try:
        bbs = r.get_BoundingBox(None)
    except Exception:
        bbs = None
    if bbs is not None:
        if abs(d.X) >= abs(d.Y):
            abarca = (bbs.Max.Y - bbs.Min.Y) / dy
        else:
            abarca = (bbs.Max.X - bbs.Min.X) / dx

    # diagnostico: los numeros que llevaron a la decision, para poder calibrar la regla
    # con datos en vez de suposiciones (se imprimen en los fallos de la auditoria).
    diag = ' [largo={:.0f} zapata={:.0f} borde={:.0f}% abarca={} z={:.0f} medio={:.0f} extz={:.0f}]'.format(
        largo * 304.8, dim_dir * 304.8, dist_borde * 100.0,
        ('{:.0f}%'.format(abarca * 100.0) if abarca is not None else 'n/d'),
        ((p0.Z + p1.Z) / 2.0) * 304.8, ((bb.Min.Z + bb.Max.Z) / 2.0) * 304.8, ext_z * 304.8)

    # --- SEC-LAT: DESACTIVADO a proposito ---
    # No hay ninguna combinacion de los datos disponibles que separe el cerco de la malla.
    # Medido en la 4a auditoria (2026-07-21): los cercos REALES dan abarca=61% y borde=7%,
    # mientras que las barras de malla que la regla capturaba por error dan abarca=0-18% y
    # borde=1-3%. O sea, el cerco esta MENOS pegado al borde y abarca MAS que las mallas
    # que se colaban: cualquier umbral sobre esas dos variables ordena los casos al reves.
    # Se probaron tres versiones (spread del set; "no cruza la zapata"; borde+spread) y la
    # mejor de todas empeoraba el total: ganaba ~12 cercos a costa de arruinar ~42 barras
    # de malla (81.1% contra 87.0% sin la regla). Con la regla apagada, las barras de cerco
    # caen como PPL-INF/PPL-SUP y se corrigen a mano - son 14 en todo el modelo, y Javier
    # las identifica a simple vista con los colores. NO reactivar sin un dato nuevo que de
    # verdad las distinga (una forma propia, un diametro dedicado, o un shape distinto).

    # --- SEC-RFZ: DESACTIVADO a proposito ---
    # El modelo de referencia no tiene NINGUNA barra SEC-RFZ (338 comparables = PPL-PPL 174
    # + SEC-EST 88 + PPL-SUP 32 + PPL-INF 30 + SEC-LAT 14), asi que la regla no se puede
    # validar contra nada. Las dos versiones probadas se comieron mallas legitimas: "solo
    # no Number with Spacing" dio 72 falsos positivos, y agregarle "barra unica + junto al
    # borde" dio 60. Como ademas su ubicacion la decide el maestro en obra, SEC-RFZ queda
    # para asignacion MANUAL. Los helpers es_number_with_spacing/cantidad_barras se dejan
    # listos por si mas adelante aparece un modelo con SEC-RFZ real para calibrarla.

    # --- malla: canastillo inferior vs superior, por la altura del TRAMO PRINCIPAL ---
    # Solo se afirma si hay CONFIANZA. Si alguna condicion no se cumple, el script SE
    # ABSTIENE (devuelve None): la barra queda sin Partition, sin color, y aislada en la
    # vista de pendientes para asignarla a mano. Pedido de Javier (2026-07-21): es
    # preferible no responder a inventar una respuesta que despues hay que cazar.
    z_tramo = (p0.Z + p1.Z) / 2.0
    z_medio = (bb.Min.Z + bb.Max.Z) / 2.0
    alto_host = bb.Max.Z - bb.Min.Z

    # (a) tiene que CRUZAR el elemento: una barra de malla va de lado a lado. Si es corta
    # y localizada puede ser un cerco o un refuerzo suelto -> no se arriesga.
    if dim_dir > 1e-9 and largo < umbral_abarca * dim_dir:
        return None, 'no cruza el elemento, puede ser cerco o refuerzo' + diag

    # (b) el tramo NO puede exceder por mucho la dimension del host: si lo hace, el host
    # que devuelve GetHostId no es el elemento que la contiene y toda la referencia de
    # altura deja de ser confiable. Es el caso de las mallas horizontales largas a media
    # altura (largo 2549 y 6984 mm contra hosts de 1455-2265 mm, o sea 137% y hasta 480%),
    # que el modelo de referencia etiqueta PPL-PPL y la regla de altura leia como malla.
    if dim_dir > 1e-9 and largo > FACTOR_DESBORDE * dim_dir:
        return None, 'el tramo excede la dimension del host ({:.0f}%), host poco confiable'.format(
            100.0 * largo / dim_dir) + diag

    # (c) la altura tiene que ser INEQUIVOCA: si el tramo cae cerca del medio del host no
    # hay forma de saber si es canastillo superior o inferior. (Las zapatas ya no llegan
    # aca: se atajan mas arriba con clasificar_viga; esta malla es fallback de otros hosts.)
    if alto_host > 1e-9 and abs(z_tramo - z_medio) < MARGEN_ALTURA * alto_host:
        return None, 'altura ambigua respecto al medio del host' + diag

    if z_tramo < z_medio:
        return 'PPL-INF', 'malla bajo el medio' + diag
    return 'PPL-SUP', 'malla sobre el medio' + diag


# --- barras objetivo ---
def barras_objetivo():
    todas = list(FilteredElementCollector(doc).OfCategory(BuiltInCategory.OST_Rebar)
                 .WhereElementIsNotElementType().ToElements())
    if not filtro_txt:
        return todas
    tokens = [t.strip().lower() for t in filtro_txt.split(',') if t.strip()]
    if not tokens:
        return todas
    # ids de los miembros (recursivo) de los assemblies que matchean el filtro
    permitidos = set()
    for ai in FilteredElementCollector(doc).OfClass(AssemblyInstance):
        try:
            nombre = ai.AssemblyTypeName
        except Exception:
            continue
        if not any(tok in nombre.lower() for tok in tokens):
            continue
        stack = list(ai.GetMemberIds())
        vistos = set()
        while stack:
            eid = stack.pop()
            if eid.Value in vistos:
                continue
            vistos.add(eid.Value)
            permitidos.add(eid.Value)
            el = doc.GetElement(eid)
            if isinstance(el, FamilyInstance):
                try:
                    for s in el.GetSubComponentIds():
                        stack.append(s)
                except Exception:
                    pass
    res = []
    for r in todas:
        if r.Id.Value in permitidos:
            res.append(r)
            continue
        try:
            hid = r.GetHostId()
        except Exception:
            hid = None
        if hid is not None and hid.Value in permitidos:
            res.append(r)
    return res


def buscar_vista(nombre_vista):
    # Busqueda TOLERANTE del nombre: las vistas 3D de Revit se llaman
    # "{3D - usuario.apellidoXXXXX}" (con llaves y el usuario), imposible de tipear de
    # memoria - con match exacto no encontraba nada y no pintaba en silencio. Primero
    # exacto; si no, coincidencia parcial siempre que sea UNA sola.
    objetivo = nombre_vista.strip().lower()
    candidatas = [v for v in FilteredElementCollector(doc).OfClass(View) if not v.IsTemplate]
    vista = next((v for v in candidatas if elem_name(v).strip().lower() == objetivo), None)
    if vista is not None:
        return vista
    parciales = [v for v in candidatas if objetivo in elem_name(v).strip().lower()]
    # Descartar las vistas derivadas que genera este mismo script: si no, despues de la
    # primera corrida hay dos vistas que contienen el texto buscado y el match parcial se
    # bloqueaba, dejando de pintar (bug real 2026-07-21).
    propias = [v for v in parciales
               if not elem_name(v).lower().startswith(NOMBRE_VISTA_PENDIENTES.lower())]
    if propias:
        parciales = propias
    if len(parciales) == 1:
        log.append('Vista "{}" resuelta por coincidencia parcial -> "{}".'.format(
            nombre_vista, elem_name(parciales[0])))
        return parciales[0]
    if len(parciales) > 1:
        # NUNCA bloquearse por ambiguedad: se elige de forma determinista la de nombre mas
        # corto (normalmente la vista base; las derivadas traen sufijos como " Copy 1") y
        # se avisa cual se uso, para que el usuario corrija el input si no era esa.
        elegida = min(parciales, key=lambda v: len(elem_name(v)))
        log.append('AVISO: "{}" coincide con {} vistas ({}); se usa la de nombre mas corto: "{}".'.format(
            nombre_vista, len(parciales),
            ', '.join(elem_name(v) for v in parciales[:6]), elem_name(elegida)))
        return elegida
    log.append('AVISO: no existe la vista "{}". Vistas 3D disponibles: {}'.format(
        nombre_vista,
        ', '.join(sorted(elem_name(v) for v in candidatas if str(v.ViewType) == 'ThreeD')[:15])))
    return None


def patron_solido():
    # se busca por la propiedad IsSolidFill y NO por el nombre ("Solid fill" / "Solido"),
    # que depende del idioma de Revit.
    for fp in FilteredElementCollector(doc).OfClass(FillPatternElement):
        try:
            if fp.GetFillPattern().IsSolidFill:
                return fp.Id
        except Exception:
            continue
    return None


def override_color(rgb, id_solido):
    cr, cg, cb = rgb
    col = Color(cr, cg, cb)
    ogs = OverrideGraphicSettings()
    ogs.SetProjectionLineColor(col)
    ogs.SetCutLineColor(col)
    # relleno SOLIDO: hay que asignar el PATRON ademas del color, si no la barra queda
    # pintada solo en sus lineas y sin relleno.
    if id_solido is not None:
        ogs.SetSurfaceForegroundPatternId(id_solido)
        ogs.SetSurfaceForegroundPatternVisible(True)
        ogs.SetCutForegroundPatternId(id_solido)
        ogs.SetCutForegroundPatternVisible(True)
    ogs.SetSurfaceForegroundPatternColor(col)
    ogs.SetCutForegroundPatternColor(col)
    return ogs


def pintar_por_partition(vista, barras):
    # Pinta SOLO las barras que TIENEN Partition, con el color de SU valor REAL. Las que
    # no lo tienen quedan explicitamente SIN color (se limpia cualquier override de una
    # corrida anterior) para que salten a la vista como pendientes.
    # 2026-07-21, correccion pedida por Javier: antes se pintaba la clasificacion
    # CALCULADA de todas las barras, y asi no se distinguia lo que ya estaba resuelto de
    # lo que faltaba - el color debe reflejar el estado REAL del modelo.
    # Devuelve (pintadas, ids_sin_partition, valores_desconocidos).
    id_solido = patron_solido()
    if id_solido is None:
        log.append('AVISO: no se encontro un patron solido; se pintan solo las lineas.')
    cache = {}
    vacio = OverrideGraphicSettings()
    pintadas = 0
    sin_part = []
    con_part = []
    desconocidos = {}
    for r in barras:
        valor = (leer_partition(r) or '').strip().upper()
        if not valor or valor not in COLORES:
            if valor:
                # tiene Partition pero con un valor fuera de la paleta: NO es pendiente
                desconocidos[valor] = desconocidos.get(valor, 0) + 1
                con_part.append(r.Id)
            else:
                sin_part.append(r.Id)
            try:
                vista.SetElementOverrides(r.Id, vacio)
            except Exception:
                pass
            continue
        con_part.append(r.Id)
        if valor not in cache:
            cache[valor] = override_color(COLORES[valor], id_solido)
        try:
            vista.SetElementOverrides(r.Id, cache[valor])
            pintadas += 1
        except Exception as e:
            log.append('ERROR pintando la barra {}: {}'.format(r.Id.Value, e))
    return pintadas, sin_part, con_part, desconocidos


def vista_sin_partition(vista_base, ids_sin, ids_con):
    # Segunda vista 3D donde quedan visibles SOLO las barras sin Partition (las pendientes).
    # Se ocultan PERMANENTEMENTE (View.HideElements) las barras que si lo tienen.
    # 2026-07-21: la 1a version usaba IsolateElementsTemporary (el "Isolate Element" de la
    # UI), pero ese es un modo de vista TEMPORAL - un estado de interfaz que no persiste de
    # forma confiable al aplicarse por API, y la vista salia mostrando todo. HideElements es
    # permanente y se guarda con la vista.
    nombre = NOMBRE_VISTA_PENDIENTES
    destino = None
    for v in FilteredElementCollector(doc).OfClass(View):
        if not v.IsTemplate and elem_name(v) == nombre:
            destino = v
            break
    if destino is None:
        try:
            nid = vista_base.Duplicate(ViewDuplicateOption.Duplicate)
            destino = doc.GetElement(nid)
        except Exception as e:
            log.append('ERROR duplicando la vista para los pendientes: {}'.format(e))
            return None
        # El renombrado se hace APARTE del Duplicate: si falla (nombre ocupado, caracteres
        # invalidos) la vista duplicada igual ya existe, y si se abandona ahi queda suelta
        # con el nombre por defecto "... Copy 1" -- que ademas ensucia el match parcial de
        # buscar_vista. Por eso se reintenta con sufijo numerico hasta encontrar uno libre.
        puesto = False
        for k in range(0, 30):
            try:
                destino.Name = nombre if k == 0 else '{} {}'.format(nombre, k + 1)
                puesto = True
                break
            except Exception:
                continue
        if not puesto:
            # se borra la duplicada en vez de dejarla suelta con el nombre por defecto
            # ("... Copy 1"): esos huerfanos se acumulan una por corrida y ensucian el
            # modelo y la busqueda de vistas.
            try:
                doc.Delete(destino.Id)
            except Exception:
                pass
            log.append('ERROR: no se pudo nombrar la vista de pendientes; se descarto la copia.')
            return None
    # limpiar el estado de corridas anteriores: si quedo un aislamiento temporal viejo, o
    # barras ocultas que ahora SI deben verse, la vista mostraria algo desactualizado.
    try:
        if destino.IsTemporaryHideIsolateActive():
            destino.DisableTemporaryViewMode(TemporaryViewMode.TemporaryHideIsolate)
    except Exception:
        pass
    todas = List[ElementId]()
    for i in ids_sin:
        todas.Add(i)
    for i in ids_con:
        todas.Add(i)
    if todas.Count > 0:
        try:
            destino.UnhideElements(todas)
        except Exception:
            pass
    ocultar = List[ElementId]()
    for i in ids_con:
        try:
            el = doc.GetElement(i)
            if el is not None and el.CanBeHidden(destino):
                ocultar.Add(i)
        except Exception:
            continue
    if ocultar.Count > 0:
        try:
            destino.HideElements(ocultar)
        except Exception as e:
            log.append('ERROR ocultando las barras ya clasificadas en la vista de pendientes: {}'.format(e))
    return destino


barras = barras_objetivo()
if not barras:
    log.append('No se encontraron barras que procesar (filtro "{}").'.format(filtro_txt))
    OUT = log
else:
    conteo = {}
    motivos = {}
    por_tipo = {}
    sin_clasificar = 0
    escritas = 0
    ya_tenian = 0
    aciertos = 0
    fallos = 0
    detalle_fallos = []
    sm_escritos = 0
    sm_ya_ok = 0
    sm_fuera_regla = 0
    sm_conteo = {}
    # desglose de las barras SUELTAS que entran en la regla (2026-07-30): son las que la
    # version anterior dejaba fuera, asi que conviene poder ver cuantas son y cuantas
    # estaban mal, sin tener que comparar contra una corrida vieja.
    sm_sueltas = 0
    sm_sueltas_pendientes = 0

    TransactionManager.Instance.EnsureInTransaction(doc)
    try:
        for r in barras:
            tipo, motivo = clasificar(r)
            if tipo is None:
                sin_clasificar += 1
                motivos[motivo] = motivos.get(motivo, 0) + 1
                continue
            conteo[tipo] = conteo.get(tipo, 0) + 1
            por_tipo.setdefault(tipo, []).append(r.Id)
            actual = leer_partition(r)

            if solo_auditar:
                # comparar contra el valor ya cargado (validacion de las reglas)
                if actual:
                    if actual.upper() == tipo:
                        aciertos += 1
                    else:
                        fallos += 1
                        if len(detalle_fallos) < 40:
                            detalle_fallos.append('  barra {}: real={} / calculado={} ({})'.format(
                                r.Id.Value, actual, tipo, motivo))
                continue

            # aplicar: solo RELLENA los vacios, no pisa lo ya cargado
            if actual:
                ya_tenian += 1
                continue
            p = param_partition(r)
            if p is not None and not p.IsReadOnly:
                try:
                    p.Set(tipo)
                    escritas += 1
                except Exception as e:
                    log.append('ERROR escribiendo Partition en la barra {}: {}'.format(r.Id.Value, e))

        # --- 2a pasada: Schedule Mark semantico (sets multibarra Y barras sueltas) ---
        # Pasada APARTE del arbol de clasificacion a proposito: asi puede usar el Partition
        # EFECTIVO del modelo, incluidas las barras que este script no supo clasificar pero
        # que YA traian Partition cargado (la 1a pasada las descarta con un continue).
        for r in barras:
            objetivo = schedule_mark_objetivo(r, leer_partition(r))
            if objetivo is None:
                sm_fuera_regla += 1
                continue
            sm_conteo[objetivo] = sm_conteo.get(objetivo, 0) + 1
            suelta = not es_set_multibarra(r)
            if suelta:
                sm_sueltas += 1
            if leer_schedule_mark(r) == objetivo:
                sm_ya_ok += 1
                continue
            if suelta:
                sm_sueltas_pendientes += 1
            if solo_auditar:
                continue
            p_sm = param_schedule_mark(r)
            if p_sm is None or p_sm.IsReadOnly:
                log.append('AVISO: la barra {} no expone un Schedule Mark escribible.'.format(r.Id.Value))
                continue
            try:
                p_sm.Set(objetivo)
                sm_escritos += 1
            except Exception as e:
                log.append('ERROR escribiendo Schedule Mark en la barra {}: {}'.format(r.Id.Value, e))

        aplicados_color = 0
        ids_sin_part = []
        if vista_colores:
            v3d = buscar_vista(vista_colores)
            if v3d is not None:
                aplicados_color, ids_sin_part, ids_con_part, desconocidos = pintar_por_partition(v3d, barras)
                log.append('Pintadas {} barras CON Partition en "{}"; {} quedaron SIN color (sin Partition).'.format(
                    aplicados_color, elem_name(v3d), len(ids_sin_part)))
                for k in sorted(desconocidos.keys()):
                    log.append('  AVISO: valor de Partition no reconocido "{}" en {} barra(s); quedan sin color.'.format(
                        k, desconocidos[k]))
                if ids_sin_part:
                    v2 = vista_sin_partition(v3d, ids_sin_part, ids_con_part)
                    if v2 is not None:
                        log.append('Vista de PENDIENTES: "{}" muestra solo las {} barras sin Partition ({} ya clasificadas ocultas).'.format(
                            elem_name(v2), len(ids_sin_part), len(ids_con_part)))
                else:
                    log.append('No quedaron barras sin Partition: no se creo vista de pendientes. '
                               '(Si corriste en modo APLICAR, es esperable: el script acaba de rellenarlas todas; '
                               'usa Solo AUDITAR para ver el estado real del modelo.)')
        else:
            log.append('(No se pinto nada: el input "Vista 3D para pintar" esta vacio.)')
    finally:
        TransactionManager.Instance.TransactionTaskDone()

    if solo_auditar:
        total_comparadas = aciertos + fallos
        pct = (100.0 * aciertos / total_comparadas) if total_comparadas else 0.0
        log.append('=== MODO AUDITORIA (no se escribio nada) ===')
        log.append('Barras evaluadas: {} | con Partition ya cargado (comparables): {}'.format(len(barras), total_comparadas))
        if total_comparadas == 0:
            log.append('OJO: ninguna barra de este modelo tiene Partition cargado, asi que no hay contra que')
            log.append('comparar y la auditoria no aplica. La clasificacion SI se calculo (ver el resumen de mas')
            log.append('abajo), pero no se escribio nada. Para asignarla de verdad, corre con "Solo AUDITAR" en False.')
        else:
            log.append('ACIERTOS: {} / {}  ({:.1f}%)   FALLOS: {}'.format(aciertos, total_comparadas, pct, fallos))
        if detalle_fallos:
            log.append('--- primeros fallos ---')
            log.extend(detalle_fallos)
    else:
        log.append('=== APLICADO ===')
        log.append('Partition escritos: {} | ya tenian valor (no se pisaron): {}'.format(escritas, ya_tenian))
    log.append('Sin clasificar: {}'.format(sin_clasificar))
    if motivos:
        log.append('--- por que quedaron sin clasificar ---')
        for m in sorted(motivos.keys(), key=lambda k: -motivos[k]):
            log.append('  {}: {}'.format(m, motivos[m]))
    log.append('--- Schedule Mark semantico (sets multibarra + barras sueltas) ---')
    sm_en_regla = sum(sm_conteo.values())
    if solo_auditar:
        log.append('  (auditoria: no se escribio nada) dentro de la regla: {} | ya correctos: {} | se corregirian: {}'.format(
            sm_en_regla, sm_ya_ok, sm_en_regla - sm_ya_ok))
    else:
        log.append('  escritos: {} | ya estaban correctos: {}'.format(sm_escritos, sm_ya_ok))
    log.append('  de las que entran en la regla, barras SUELTAS: {} (de ellas, {} sin la nota correcta)'.format(
        sm_sueltas, sm_sueltas_pendientes))
    log.append('  fuera de la regla (Partition sin nota asignada): {}'.format(sm_fuera_regla))
    for k in sorted(sm_conteo.keys()):
        log.append('  nota {}: {} barra(s)'.format(k, sm_conteo[k]))
    log.append('--- clasificacion obtenida ---')
    for k in sorted(conteo.keys()):
        log.append('  {}: {}'.format(k, conteo[k]))
    OUT = log
# ----------------------------------------
log = Watch(py_clasificar_y_asignar)  # graph output
