# Dynamo graph 01_Calcular y crear laminas.dyn (Dynamo 4.0.2.3852)
# PASO 2 de 5 - Cuenta las vistas de assembly que aun no estan colocadas, calcula cuantas laminas hacen falta y las crea numeradas. Requiere el paso 1.

viã_eta_title_block_â_elegir_del = FamilyTypes("BIOS_E_VINE_A1_NOVANDINO:Formato-DETALLE")  # "ViÃ±eta (Title Block) â€” elegir del dropdown"; graph input
numero_del_primer_sheet = StringInput("A1")  # graph input
nombre_del_primer_sheet = StringInput("A1")  # graph input
procesar_todos_los_assemblies = BoolSelector(true)  # graph input
filtro_assemblies_si_todos_false = StringInput("")  # graph input
margen_y_separacion_mm = IntegerSlider(5, range=5..50 step 1)  # graph input
reserva_lado_derecho_mm = IntegerSlider(200, range=0..200 step 5)  # graph input
separacion_de_vistas = IntegerSlider(100, range=40..200 step 5)  # graph input
py_calcular_y_crear_laminas = Python(IN[0]=viã_eta_title_block_â_elegir_del, IN[1]=numero_del_primer_sheet, IN[2]=nombre_del_primer_sheet, IN[3]=procesar_todos_los_assemblies, IN[4]=filtro_assemblies_si_todos_false, IN[5]=margen_y_separacion_mm, IN[6]=reserva_lado_derecho_mm, IN[7]=separacion_de_vistas)  # PythonNet3
# ---------- py_calcular_y_crear_laminas.python (344 lines) ----------
# 01_Calcular y crear laminas - calcula cuantas laminas hacen falta para las
# vistas de assembly pendientes y crea esa cantidad, con la numeracion de siempre.
#
# EMPAQUETADO (reescrito 2026-07-23): se empaqueta por el tamano del CROP de cada
# vista (View.CropBox / escala, que el 00 deja ajustado justo al borde de la
# fundacion) MAS el titulo - NO por el contorno completo con lineas de seccion
# (esas cruces que salen del crop se extienden muchisimo mas que la fundacion y,
# como son finas, cruzarse con las vistas vecinas es normal en estos planos; medir
# por ellas daba un bloque por pagina). El reparto usa un algoritmo SKYLINE
# (bottom-left): cada bloque cae en el hueco mas alto y a la izquierda que le
# quepa, asi un bloque alto y angosto ocupa solo su columna y el resto del ancho
# de la lamina se rellena con los bloques siguientes. 02_Colocar usa la MISMA
# medida y el MISMO empaquetado.
# Revit 2027 / Dynamo 4 / CPython3
# IN[0] = tipo de vineta (dropdown Family Types)
# IN[1] = numero del primer sheet
# IN[2] = nombre del primer sheet
# IN[3] = procesar todos los assemblies (bool)
# IN[4] = filtro de assemblies si IN[3] es False (parcial, comas)
# IN[5] = margen y separacion entre vistas (mm) - debe coincidir con 02
# IN[6] = reserva en el lado derecho (mm) - idem, debe coincidir con 02
# IN[7] = separacion de vistas (%) - regula cuantas vistas por lamina. 100 = ajustado
#         (denso); < 100 = mas montadas y menos laminas; > 100 = mas separadas y mas
#         laminas. DEBE coincidir con 02 para que el calculo y la colocacion cuadren.

import clr
import re
clr.AddReference('RevitAPI')
clr.AddReference('RevitServices')
from Autodesk.Revit.DB import (FilteredElementCollector, AssemblyInstance, ViewSheet,
                               Viewport, View, BuiltInCategory, Element, ElementId, XYZ)
from RevitServices.Persistence import DocumentManager
from RevitServices.Transactions import TransactionManager

doc = DocumentManager.Instance.CurrentDBDocument

tb_type = UnwrapElement(IN[0])
first_number = (IN[1] or '').strip()
first_name = (IN[2] or '').strip()
process_all = bool(IN[3])
filter_text = (IN[4] or '').strip()
margin = float(IN[5]) / 304.8
right_reserve = float(IN[6]) / 304.8
# separacion de vistas (%) - escala el hueco que reserva cada bloque al empaquetar
# (no el tamano real de las vistas): < 100 monta las vistas y usa menos laminas,
# > 100 las separa y usa mas laminas. Si el input aun no existe (grafo sin re-abrir
# en Dynamo), cae a 100.
try:
    esc = float(IN[7]) / 100.0
except Exception:
    esc = 1.0
if esc < 0.2:
    esc = 0.2
# separacion REAL dentro de cada bloque (planta -> corte A -> corte B -> callouts):
# margen general + 10 mm fijos, igual que 02.
gap_bloque = margin + 10.0 / 304.8

log = []
SUFIJO_ARMADURAS = ' - ARMADURA'
SUFIJO_CORTE = SUFIJO_ARMADURAS + ' - CORTE A'
SUFIJO_CORTE_B = SUFIJO_ARMADURAS + ' - CORTE B'
SUFIJOS_CORTE = (SUFIJO_CORTE, SUFIJO_CORTE_B)
PREFIJO_PEDESTAL = SUFIJO_ARMADURAS + ' - PEDESTAL '

# reserva bajo cada vista para su titulo (planta y cortes/callouts)
label_h_planta = 12.0 / 304.8
label_h_corte = (12.0 + 14.0) / 304.8

def sufijo_corte(nombre):
    for a in SUFIJOS_CORTE:
        if nombre.endswith(a):
            return a
    return None

def es_callout_pedestal(nombre):
    return PREFIJO_PEDESTAL in nombre

def elem_name(e):
    try:
        return e.Name
    except Exception:
        return Element.Name.__get__(e)

def label_h_de(v):
    nombre = elem_name(v)
    return label_h_corte if (sufijo_corte(nombre) or es_callout_pedestal(nombre)) else label_h_planta

def tb_label(t):
    try:
        return '{} : {}'.format(t.FamilyName, elem_name(t))
    except Exception:
        return 'Id ' + str(t.Id)

def list_titleblocks():
    col = (FilteredElementCollector(doc)
           .OfCategory(BuiltInCategory.OST_TitleBlocks)
           .WhereElementIsElementType())
    return list(col)

def paper_size(v):
    # tamano en papel (pies) = crop del modelo / escala (crop ya ajustado por 00)
    cb = v.CropBox
    s = v.Scale if v.Scale > 0 else 1
    return ((cb.Max.X - cb.Min.X) / s, (cb.Max.Y - cb.Min.Y) / s)

def dims_bloque(grupo):
    # bloque vertical: planta arriba, cortes/callouts abajo. Ancho = crop mas ancho;
    # alto = suma de (crop + titulo) + gap_bloque entre vistas.
    ws = []
    hs = []
    for v in grupo:
        w, h = paper_size(v)
        ws.append(w)
        hs.append(h + label_h_de(v))
    bw = max(ws)
    bh = sum(hs) + gap_bloque * (len(grupo) - 1)
    return bw, bh

def usable_rect(sheet):
    # area util = bbox de la vineta menos margenes (y reserva derecha)
    col = FilteredElementCollector(doc, sheet.Id).OfCategory(BuiltInCategory.OST_TitleBlocks)
    tb = col.FirstElement()
    if tb is not None:
        bb = tb.get_BoundingBox(sheet)
        if bb is not None:
            return (bb.Min.X + margin, bb.Min.Y + margin,
                    bb.Max.X - margin - right_reserve, bb.Max.Y - margin)
    o = sheet.Outline
    return (o.Min.U + margin, o.Min.V + margin,
            o.Max.U - margin - right_reserve, o.Max.V - margin)

# ---------------- empaquetado SKYLINE (bottom-left, first-fit) ----------------
# Mantiene el orden por nombre ENTRE laminas y rellena huecos DENTRO de cada una.
# Solo abre lamina nueva cuando el bloque no entra en la actual; nunca vuelve a
# laminas anteriores. Un bloque mas grande que la lamina entera ocupa su columna
# desde el tope, dejando el resto del ancho libre para rellenar.
EPS = 1e-9

def depth_max(sky, a, b):
    d = 0.0
    for xi, xf, dep in sky:
        if xf <= a + EPS or xi >= b - EPS:
            continue
        if dep > d:
            d = dep
    return d

def ocupa(sky, a, b, nd):
    nuevos = []
    for xi, xf, dep in sky:
        if xi < a - EPS:
            nuevos.append([xi, min(xf, a), dep])
        if xf > b + EPS:
            nuevos.append([max(xi, b), xf, dep])
    nuevos.append([a, b, nd])
    nuevos = [s for s in nuevos if s[1] - s[0] > EPS]
    nuevos.sort(key=lambda s: s[0])
    sky[:] = nuevos

def mejor_pos(sky, x0, x1, H, ew, eh):
    best = None
    for seg in sky:
        x = seg[0]
        if x + ew > x1 + EPS:
            continue
        depth = depth_max(sky, x, x + ew)
        if depth + eh > H + EPS:
            continue
        if best is None or depth < best[1] - EPS or (abs(depth - best[1]) < EPS and x < best[0] - EPS):
            best = (x, depth)
    return best

def bin_usado(sky):
    for xi, xf, dep in sky:
        if dep > EPS:
            return True
    return False

def empaquetar(dims_bloques, x0, y0, x1, y1):
    H = y1 - y0
    bins = []
    asign = []
    avisos = []
    def nuevo():
        bins.append([[x0, x1, 0.0]])
        return len(bins) - 1
    cur = nuevo()
    for idx, (bw, bh) in enumerate(dims_bloques):
        # el hueco reservado por bloque se escala con la densidad (esc); el tamano
        # real de las vistas no cambia, asi que con esc < 1 los bloques se montan.
        ew = bw * esc
        eh = bh * esc
        pos = mejor_pos(bins[cur], x0, x1, H, ew, eh)
        # solo abrir lamina nueva si la actual YA tiene algo; si esta fresca y aun
        # asi no cabe (bloque mas grande que la lamina), se coloca igual aca - de lo
        # contrario quedaba una primera lamina vacia (bug 2026-07-23).
        if pos is None and bin_usado(bins[cur]):
            cur = nuevo()
            pos = mejor_pos(bins[cur], x0, x1, H, ew, eh)
        if pos is None:
            pos = (x0, 0.0)
            if bh > H:  # genuinamente mas alto que el area util de una lamina
                avisos.append(idx)
        bx, depth = pos
        asign.append((cur, bx, y1 - depth))
        ocupa(bins[cur], bx, min(bx + ew, x1), depth + eh)
    return asign, len(bins), avisos

def bump(text, steps):
    last = None
    for m in re.finditer('\\d+', text):
        last = m
    if last is None:
        return '{} {:02d}'.format(text, steps + 1)
    width = len(last.group(0))
    val = int(last.group(0)) + steps
    return text[:last.start()] + str(val).zfill(width) + text[last.end():]

# --- validar la vineta seleccionada ---
tb_cat_id = ElementId(BuiltInCategory.OST_TitleBlocks)
is_tb = (tb_type is not None
         and tb_type.Category is not None
         and tb_type.Category.Id == tb_cat_id)

if not is_tb:
    log.append('ERROR: el tipo seleccionado en el dropdown NO es una vineta (Title Block).')
    log.append('Selecciona una de estas vinetas cargadas en el proyecto:')
    tbs = list_titleblocks()
    if not tbs:
        log.append('  (no hay vinetas cargadas en el proyecto)')
    for t in tbs:
        log.append('  - ' + tb_label(t))
    OUT = log
else:
    by_type = {}
    for ai in FilteredElementCollector(doc).OfClass(AssemblyInstance):
        by_type.setdefault(ai.AssemblyTypeName, []).append(ai)

    names = sorted(by_type.keys())
    if not process_all:
        tokens = [t.strip().lower() for t in filter_text.split(',') if t.strip()]
        if tokens:
            names = [n for n in names if any(tok in n.lower() for tok in tokens)]
        else:
            names = []
            log.append('ERROR: \"Todos\" esta en False y el filtro esta vacio.')

    view_by_name = {}
    for v in FilteredElementCollector(doc).OfClass(View):
        if not v.IsTemplate:
            view_by_name[elem_name(v)] = v

    placed_ids = set()
    for vp in FilteredElementCollector(doc).OfClass(Viewport):
        placed_ids.add(vp.ViewId.Value)

    bloques = []
    for n in names:
        grupo = []
        for vname in (n + SUFIJO_ARMADURAS, n + SUFIJO_CORTE, n + SUFIJO_CORTE_B):
            v = view_by_name.get(vname)
            if v is None:
                log.append('AVISO: no existe la vista \"{}\" (corre 00_Vistas de assembly).'.format(vname))
            elif v.Id.Value in placed_ids:
                pass  # ya colocada en una lamina, no cuenta como pendiente
            else:
                grupo.append(v)
        prefijo_ped = n + PREFIJO_PEDESTAL
        for vname_ped in sorted(nm for nm in view_by_name if nm.startswith(prefijo_ped)):
            v_ped = view_by_name[vname_ped]
            if v_ped.Id.Value not in placed_ids:
                grupo.append(v_ped)
        if grupo:
            bloques.append(grupo)

    if not bloques:
        log.append('No hay vistas pendientes de colocar; no se creo ninguna lamina.')
        OUT = log
    else:
        created = 0
        sheets_needed = 0
        TransactionManager.Instance.EnsureInTransaction(doc)
        try:
            if hasattr(tb_type, 'IsActive') and not tb_type.IsActive:
                tb_type.Activate()

            # --- lamina de prueba solo para medir el area util de la vineta ---
            probe = ViewSheet.Create(doc, tb_type.Id)
            doc.Regenerate()
            x0, y0, x1, y1 = usable_rect(probe)
            doc.Delete(probe.Id)

            dims_bloques = [dims_bloque(g) for g in bloques]
            asign, sheets_needed, avisos = empaquetar(dims_bloques, x0, y0, x1, y1)
            for idx in avisos:
                bw, bh = dims_bloques[idx]
                log.append('AVISO: \"{}\" ({:.0f} x {:.0f} mm en papel) es mas grande que el area util de una lamina; ocupara su columna y puede sobrepasar el borde.'.format(
                    elem_name(bloques[idx][0]), bw * 304.8, bh * 304.8))

            # --- crear esa cantidad de laminas, con la numeracion de siempre ---
            if not first_number:
                first_number = 'A-001'
                log.append('AVISO: numero inicial vacio, se usa A-001.')
            if not first_name:
                first_name = 'SIN NOMBRE 01'
                log.append('AVISO: nombre inicial vacio, se usa SIN NOMBRE 01.')

            existing = set()
            for vs in FilteredElementCollector(doc).OfClass(ViewSheet):
                existing.add(vs.SheetNumber)

            plan = []
            produced = 0
            offset = 0
            while produced < sheets_needed and offset < sheets_needed + 1000:
                num = first_number if offset == 0 else bump(first_number, offset)
                offset += 1
                if num in existing:
                    log.append('AVISO: el numero {} ya existe en el proyecto, se salta.'.format(num))
                    continue
                name = first_name if produced == 0 else bump(first_name, produced)
                plan.append((num, name))
                existing.add(num)
                produced += 1

            for num, name in plan:
                try:
                    sheet = ViewSheet.Create(doc, tb_type.Id)
                    sheet.SheetNumber = num
                    try:
                        sheet.Name = name
                    except Exception:
                        Element.Name.__set__(sheet, name)
                    created += 1
                    log.append('OK: {}  |  {}'.format(num, name))
                except Exception as e:
                    log.append('ERROR creando {}: {}'.format(num, e))
        finally:
            TransactionManager.Instance.TransactionTaskDone()

        log.insert(0, 'Vineta usada: ' + tb_label(tb_type))
        log.insert(1, 'Laminas necesarias calculadas: {} | creadas: {} (empaquetado skyline por crop)'.format(sheets_needed, created))
        log.append('Listo. Ahora corre 02_Colocar vistas en laminas para distribuir las vistas en estas laminas.')
        OUT = log
# ----------------------------------------
log = Watch(py_calcular_y_crear_laminas)  # graph output
