# Dynamo graph 01_Vistas de assembly.dyn (Dynamo 4.0.2.3852)
# PASO 2 de 6 - Crea las vistas de cada assembly: planta, cortes A y B, y un callout por cada tipo de pedestal. Les aplica template y escala automatica, y deja la armadura visible. Correr despues de Asignar Partition (paso 1); los pasos siguientes trabajan sobre estas vistas.

procesar_todos_los_assemblies = BoolSelector(true)  # graph input
filtro_por_nombre_si_todos_false = StringInput("")  # graph input
recrear_vistas_existentes_borra = BoolSelector(false)  # "Recrear vistas existentes (borra y rehace)"; graph input
altura_del_corte_sobre_el = IntegerSlider(30, range=10..100 step 5)  # "Altura del corte sobre el assembly (cm)"; graph input
tipo_de_vista_para_cortes = StringInput("02_FORMAS")  # "Tipo de vista para cortes (simbolo)"; graph input
view_template_para_la_planta = StringInput("RLO_ARMADURA_GENERAL_SECC")  # "View template para la planta (default RLO_ARMADURA_GENERAL_SECC)"; graph input
margen_del_crop_planta_y_cortes = IntegerSlider(30, range=0..30 step 1)  # "Margen del crop, planta y cortes (mm)"; graph input
familia_de_pedestal_para = StringInput("C-Pedestal")  # "Familia de pedestal para callouts"; graph input
escala_de_los_callouts_1_n = IntegerSlider(20, range=5..50 step 5)  # graph input
margen_del_callout_mm = IntegerSlider(15, range=5..50 step 1)  # graph input
view_template_para_los_cortes_y = StringInput("RLO_ARMADURA_GENERAL_SECC")  # "View template para los cortes y callouts (secciones)"; graph input
altura_de_corte_de_zapata_en = IntegerSlider(100, range=5..100 step 5)  # "Altura de corte de zapata en planta armadura (cm)"; graph input
py_crear_planta_corte_por = Python(IN[0]=procesar_todos_los_assemblies, IN[1]=filtro_por_nombre_si_todos_false, IN[2]=recrear_vistas_existentes_borra, IN[3]=altura_del_corte_sobre_el, IN[4]=tipo_de_vista_para_cortes, IN[5]=view_template_para_la_planta, IN[6]=margen_del_crop_planta_y_cortes, IN[7]=familia_de_pedestal_para, IN[8]=escala_de_los_callouts_1_n, IN[9]=margen_del_callout_mm, IN[10]=view_template_para_los_cortes_y, IN[11]=altura_de_corte_de_zapata_en)  # "PY | Crear planta + corte por assembly"; PythonNet3
# ---------- py_crear_planta_corte_por.python (1559 lines) ----------
# 01_Vistas de assembly (ARMADURAS) - Planta + cortes por assembly mostrando el refuerzo
# (Structural Rebar), escala automatica, Detail Level Fine. Crea un set de vista
# PARALELO al de la rutina de Formas, con sufij ' - ARMADURA' - las vistas de
# Formas (FN-1001, FN-1001 - CORTE A/B) NUNCA se tocan.
# MODIFICADO: Duplica la planta original mediante la API de Revit para evitar el bloqueo de "ya existe".
# Revit 2027 / Dynamo 4 / CPython3

import clr
clr.AddReference('RevitAPI')
clr.AddReference('RevitServices')
from Autodesk.Revit.DB import (FilteredElementCollector, AssemblyInstance,
                               AssemblyViewUtils, AssemblyDetailViewOrientation,
                               View, UnitUtils, UnitTypeId, XYZ, Element,
                               ElementTransformUtils, BuiltInParameter, BuiltInCategory,
                               ElementId, ViewFamilyType, ViewFamily, StorageType,
                               BoundingBoxXYZ, ViewDetailLevel, Options, Solid,
                               GeometryInstance, Plane, FamilyInstance, ViewSection,
                               ViewDuplicateOption) # <-- Importante para duplicar vistas
from Autodesk.Revit.DB.Structure import Rebar, RebarInSystem, RebarContainer, RebarHostData, RebarPresentationMode
from RevitServices.Persistence import DocumentManager
from RevitServices.Transactions import TransactionManager
from System.Collections.Generic import List

doc = DocumentManager.Instance.CurrentDBDocument

process_all = bool(IN[0])
filter_text = (IN[1] or '').strip()
recreate = bool(IN[2])
cut_margin = float(IN[3]) / 30.48  # cm -> pies
sec_type_text = (IN[4] or '').strip()
tpl_planta_text = (IN[5] or '').strip()
crop_margin_mm = float(IN[6])
pedestal_fam = (IN[7] or '').strip() or 'C-Pedestal'
pedestal_fam_low = pedestal_fam.lower()
callout_scale = int(IN[8]) if IN[8] else 20  # 2026-07-30 (Javier): los callouts de pedestal pasan de 1:10 a 1:20. El valor REAL lo manda el slider "Escala de los callouts (1:N)" (IN[8]), que se movio a 20 en el graph; este default solo aplica si ese input llega vacio.
callout_margin_mm = float(IN[9]) if IN[9] else 15.0
tpl_cortes_text = (IN[10] or '').strip()
# 2026-07-27 (pedido de Javier): slider DEDICADO para la altura de corte de zapata en la
# planta ARMADURA, separado de cut_margin (IN[3], que sigue siendo solo el margen por
# encima del assembly para la planta de FORMAS). Antes ambos usaban IN[3]: al bajarlo para
# revelar el contorno de la zapata en ARMADURA, tambien se corria el plano de corte de
# FORMAS, lo que terminaba afectando cuantas vistas entraban por lamina en 02_Calcular.
altura_corte_zapata = float(IN[11]) / 30.48  # cm -> pies

log = []
log.append('AVISO: planta y cortes de ARMADURAS quedan en Detail Level Coarse con Structural Rebar/Couplers activados; Revit por defecto solo dibuja Structural Rebar en Fine, verificar visualmente que las barras se vean en Coarse.')
SUFIJO_ARMADURAS = ' - ARMADURA'
SUFIJO_CORTE = SUFIJO_ARMADURAS + ' - CORTE A'
SUFIJO_CORTE_B = SUFIJO_ARMADURAS + ' - CORTE B'
# CORTE DE PEDESTAL (2026-07-31, Javier): seccion adicional POR CADA callout de pedestal,
# "muy parecida a los cortes A/B" pero mostrando solo el pedestal. El nombre completo es
# {assembly}{SUFIJO_CORTE_PEDESTAL}{tipo} (ej. "FN-01 - ARMADURA - CORTE PEDESTAL PD-1001").
# El texto ' - CORTE PEDESTAL ' es DELIBERADAMENTE distinto del prefijo de los callouts
# (' - PEDESTAL '): el 02 y el 03 arman su lista de vistas por WHITELIST (nombres exactos de
# planta / corte A / corte B + startswith del prefijo de callouts), asi que estos cortes
# quedan FUERA del calculo de laminas y de la colocacion POR CONSTRUCCION - pedido
# MANDATORIO de Javier: estas vistas las coloca el modelador a mano, opcionalmente fuera de
# la lamina. NO renombrar este sufijo a algo que empiece con ' - PEDESTAL ' o el 02/03 los
# capturarian.
SUFIJO_CORTE_PEDESTAL = SUFIJO_ARMADURAS + ' - CORTE PEDESTAL '
SUFIJO_TITULO_PLANTA = SUFIJO_ARMADURAS
FAR_CLIP_MARGIN_MM = 300.0  # Far Clip Offset FIJO (total, no margen) para los cortes A/B (2026-07-20 R2: pedido explicito de Javier, revierte el fix anterior del mismo dia que lo calculaba como profundidad real del assembly + margen -- ese calculo evitaba cortar geometria y romper cotas/tags del 04 en assemblies profundos, pero el estandar de oficina pedido es un valor FIJO para TODOS los cortes sin importar la profundidad real; asumido con la consecuencia conocida: en assemblies mas profundos que este offset se corta geometria mas alla de ese plano y Revit puede borrar en el regen siguiente, sin avisar, las cotas/spot elevations/tags del 04 que referencian caras ahora fuera del far clip. 2026-07-30, Javier: baja de 500 a 300 mm. Solo afecta a los CORTES -- la PLANTA calcula su propio far clip desde la profundidad real del assembly (ver ajustar_altura_corte_planta), no usa esta constante. OJO: al bajarlo, la consecuencia de arriba pasa a alcanzar tambien a los assemblies de entre 300 y 500 mm de profundidad, que antes quedaban dentro)
far_clip_margin_corte = FAR_CLIP_MARGIN_MM / 304.8
# --- Extents de los CALLOUTS de pedestal (2026-07-30, pedido de Javier) ---
# Los callouts nacen con "Far Clip Settings" = Same as parent view, o sea heredando el far
# clip de la planta; deben quedar en INDEPENDENT con su propio offset de 500 mm.
# El valor del enum se verifico por MCP contra el modelo real (no esta documentado en el
# script de forma obvia): de los 17 callouts de pedestal del modelo, 15 marcaban 1 y los 2
# que Javier ya habia pasado a mano a "Independent" marcaban 0. El parametro se busca POR
# NOMBRE, igual que el Layout Rule y otros de este pipeline, para no depender de acertarle
# al BuiltInParameter.
NOMBRE_PARAM_FAR_CLIP_SETTINGS = 'Far Clip Settings'
FAR_CLIP_SETTINGS_INDEPENDIENTE = 0   # 1 = Same as parent view
FAR_CLIP_CALLOUT_MM = 500.0
far_clip_callout = FAR_CLIP_CALLOUT_MM / 304.8

def to_m(v):
    return UnitUtils.ConvertFromInternalUnits(v, UnitTypeId.Meters)

def elem_name(e):
    try:
        return e.Name
    except Exception:
        return Element.Name.__get__(e)

def set_name(e, name):
    try:
        e.Name = name
    except Exception:
        Element.Name.__set__(e, name)

# --- tipo de vista para los cortes (define el simbolo de corte en la planta) ---
sec_type = None
if sec_type_text:
    detail_types = [t for t in FilteredElementCollector(doc).OfClass(ViewFamilyType)
                    if t.ViewFamily in (ViewFamily.Detail, ViewFamily.Section)]
    low = sec_type_text.lower()
    for t in detail_types:
        if elem_name(t).lower() == low:
            sec_type = t
            break

# --- view templates: uno para planta, otro para cortes (y callouts, que son secciones) ---
templates = [t for t in FilteredElementCollector(doc).OfClass(View) if t.IsTemplate]

def resolver_template(texto, etiqueta):
    if not texto:
        return None
    low = texto.lower()
    for t in templates:
        if elem_name(t).lower() == low:
            return t
    log.append('AVISO: no existe el view template "{}" para {} en el proyecto.'.format(texto, etiqueta))
    if templates:
        log.append('Templates de vista disponibles: ' + ', '.join(sorted(elem_name(t) for t in templates)))
    return None

view_template_planta = resolver_template(tpl_planta_text, 'la planta')
view_template_corte = resolver_template(tpl_cortes_text, 'los cortes')

# --- tipo de vista para los callouts de pedestal (debe ser ViewFamily.Detail) ---
vftype_detail = None
tipos_vft_detail = [t for t in FilteredElementCollector(doc).OfClass(ViewFamilyType)
                    if t.ViewFamily == ViewFamily.Detail]
if tipos_vft_detail:
    vftype_detail = sorted(tipos_vft_detail, key=lambda t: elem_name(t))[0]

# --- assemblies unicos por tipo ---
by_type = {}
for ai in FilteredElementCollector(doc).OfClass(AssemblyInstance):
    by_type.setdefault(ai.AssemblyTypeName, []).append(ai)

if process_all:
    targets = sorted(by_type.keys())
else:
    tokens = [t.strip().lower() for t in filter_text.split(',') if t.strip()]
    targets = [n for n in sorted(by_type.keys()) if any(tok in n.lower() for tok in tokens)] if tokens else []

# vistas existentes por nombre (para idempotencia)
view_ids = {}
for v in FilteredElementCollector(doc).OfClass(View):
    if not v.IsTemplate:
        view_ids[elem_name(v)] = v.Id

def member_solid_bbox(el):
    opt = Options()
    opt.DetailLevel = ViewDetailLevel.Fine
    try:
        geo = el.get_Geometry(opt)
    except Exception:
        geo = None
    if geo is None:
        return None
    minx = miny = minz = float('inf')
    maxx = maxy = maxz = float('-inf')
    hay = False
    def acumular(solid, trf):
        sbb = solid.GetBoundingBox()
        for x in (sbb.Min.X, sbb.Max.X):
            for y in (sbb.Min.Y, sbb.Max.Y):
                for z in (sbb.Min.Z, sbb.Max.Z):
                    p = sbb.Transform.OfPoint(XYZ(x, y, z))
                    if trf is not None:
                        p = trf.OfPoint(p)
                    yield p
    pts = []
    for g in geo:
        if isinstance(g, Solid) and g.Volume > 1e-9:
            pts.extend(list(acumular(g, None)))
        elif isinstance(g, GeometryInstance):
            for sg in g.GetSymbolGeometry():
                if isinstance(sg, Solid) and sg.Volume > 1e-9:
                    pts.extend(list(acumular(sg, g.Transform)))
    for p in pts:
        hay = True
        if p.X < minx: minx = p.X
        if p.X > maxx: maxx = p.X
        if p.Y < miny: miny = p.Y
        if p.Y > maxy: maxy = p.Y
        if p.Z < minz: minz = p.Z
        if p.Z > maxz: maxz = p.Z
    if not hay:
        return None
    class _BB(object):
        pass
    r = _BB()
    r.Min = XYZ(minx, miny, minz)
    r.Max = XYZ(maxx, maxy, maxz)
    return r

def elementos_geometria(ai):
    # Todos los elementos que aportan geometria solida al assembly: miembros de PRIMER
    # NIVEL de cualquier tipo (Floors y demas familias de sistema incluidas) MAS los
    # sub-componentes recursivos de las FamilyInstance. Necesario para las familias
    # COMBINADAS cuya geometria vive en sub-familias anidadas (ej. C-Fundacion+2-Pedestal:
    # el miembro de primer nivel es un CONTENEDOR y member_solid_bbox() da None/parcial
    # sobre el, dejando la planta VACIA -- bug real 2026-07-25, planta de FN-03 en blanco).
    # Mismo patron que collect_faces()/instancias_recursivas del 03/00.
    vistos = set()
    resultado = []
    stack = list(ai.GetMemberIds())
    while stack:
        eid = stack.pop()
        if eid.Value in vistos:
            continue
        vistos.add(eid.Value)
        el = doc.GetElement(eid)
        if el is None:
            continue
        resultado.append(el)
        if isinstance(el, FamilyInstance):
            try:
                stack.extend(list(el.GetSubComponentIds()))
            except Exception:
                pass
    return resultado

def local_size(ai):
    t = ai.GetTransform()
    tinv = t.Inverse
    mins = [float('inf')] * 3
    maxs = [float('-inf')] * 3
    for el in elementos_geometria(ai):
        bb = member_solid_bbox(el)
        if bb is None:
            continue
        for x in (bb.Min.X, bb.Max.X):
            for y in (bb.Min.Y, bb.Max.Y):
                for z in (bb.Min.Z, bb.Max.Z):
                    p = tinv.OfPoint(XYZ(x, y, z))
                    vals = (p.X, p.Y, p.Z)
                    for i in range(3):
                        if vals[i] < mins[i]:
                            mins[i] = vals[i]
                        if vals[i] > maxs[i]:
                            maxs[i] = vals[i]
    if mins[0] == float('inf'):
        return None
    return [to_m(maxs[i] - mins[i]) for i in range(3)]

def world_z_range(ai):
    zmin = float('inf')
    zmax = float('-inf')
    for el in elementos_geometria(ai):
        bb = member_solid_bbox(el)
        if bb is None:
            continue
        if bb.Min.Z < zmin:
            zmin = bb.Min.Z
        if bb.Max.Z > zmax:
            zmax = bb.Max.Z
    if zmin > zmax:
        return None
    return (zmin, zmax)

def find_viewer(vname):
    for ve in FilteredElementCollector(doc).OfCategory(BuiltInCategory.OST_Viewers):
        if elem_name(ve) == vname:
            return ve
    return None

def ocultar_marcador_en(view, viewer, etiqueta_v, etiqueta_dest, tname):
    if view is None or viewer is None:
        return
    try:
        if viewer.IsHidden(view):
            return
        if viewer.CanBeHidden(view):
            view.HideElements(List[ElementId]([viewer.Id]))
            log.append('{}: marcador de \"{}\" oculto en {}.'.format(tname, etiqueta_v, etiqueta_dest))
    except Exception as e:
        pass

def ocultar_marcadores_cruzados(tname, vplan_arm):
    doc.Regenerate()
    vplan_formas = None
    fid = view_ids.get(tname)
    if fid is not None:
        vf = doc.GetElement(fid)
        if isinstance(vf, View):
            vplan_formas = vf
    nombres_arm = (tname + SUFIJO_CORTE, tname + SUFIJO_CORTE_B)
    nombres_formas = (tname + ' - CORTE A', tname + ' - CORTE B')
    pref_ped_arm = tname + SUFIJO_ARMADURAS + ' - PEDESTAL '
    pref_ped_formas = tname + ' - PEDESTAL '
    pref_corte_ped = tname + SUFIJO_CORTE_PEDESTAL
    for ve in FilteredElementCollector(doc).OfCategory(BuiltInCategory.OST_Viewers):
        nom = elem_name(ve)
        if nom.startswith(pref_corte_ped):
            # marcador del CORTE DE PEDESTAL: se ve SOLO en su callout (2026-07-31, Javier).
            # Aca se oculta en LAS DOS plantas; la parte "dejarlo visible en su callout y
            # ocultar los demas ahi" vive en ajustar_marcadores_callout_pedestal.
            ocultar_marcador_en(vplan_formas, ve, nom, 'la planta de FORMAS', tname)
            ocultar_marcador_en(vplan_arm, ve, nom, 'la planta de ARMADURAS', tname)
        elif nom in nombres_arm or nom.startswith(pref_ped_arm):
            ocultar_marcador_en(vplan_formas, ve, nom, 'la planta de FORMAS', tname)
        elif nom in nombres_formas or nom.startswith(pref_ped_formas):
            ocultar_marcador_en(vplan_arm, ve, nom, 'la planta de ARMADURAS', tname)

def orientar_burbuja_corte(v, tname, label):
    vd = v.ViewDirection
    if abs(vd.X) <= abs(vd.Y):
        return
    viewer = find_viewer(elem_name(v))
    if viewer is None:
        return
    cb = v.CropBox
    centro_local = XYZ((cb.Min.X + cb.Max.X) / 2.0, (cb.Min.Y + cb.Max.Y) / 2.0, (cb.Min.Z + cb.Max.Z) / 2.0)
    centro = cb.Transform.OfPoint(centro_local)
    try:
        marcador_y = viewer.Location.Point.Y
    except Exception:
        marcador_y = v.Origin.Y
    if marcador_y >= centro.Y:
        return
    plano = Plane.CreateByNormalAndOrigin(XYZ(0.0, 1.0, 0.0), centro)
    ids = List[ElementId]([viewer.Id])
    ElementTransformUtils.MirrorElements(doc, ids, plano, False)
    doc.Regenerate()

def ajustar_corte_planta(vplan, ai, tname, cortar=False, altura_corte=None):
    dirz = vplan.ViewDirection.Z
    if abs(dirz) < 0.99:
        return
    zr = world_z_range(ai)
    if zr is None:
        return
    zmin, zmax = zr
    if cortar:
        # 2026-07-27 (pedido de Javier): en la PLANTA ARMADURA el plano de corte CORTA la
        # zapata (a altura_corte sobre el fondo del assembly) en vez de subirse por encima del
        # tope. Asi el contorno del hormigon se dibuja en SECCION -- necesario para las
        # familias cargables combinadas, que en PROYECCION no dibujan su contorno (las de
        # sistema si). En planta quedan solo el contorno + las barras que cruzan/pasan por la
        # zapata (arranques de pedestal, mallas); los pedestales completos quedan por encima
        # del corte (del lado de la camara) y se leen en los cortes. altura_corte (IN[11],
        # slider dedicado) es la ALTURA del plano de corte desde el fondo: bajalo si la
        # zapata es mas delgada que ese valor, subilo para cortar mas arriba. Deliberadamente
        # SEPARADO de cut_margin (IN[3]): ese sigue siendo solo el margen por encima del
        # assembly para la planta de FORMAS (cortar=False), que no se toca aqui.
        altura = altura_corte if altura_corte is not None else cut_margin
        objetivo = zmin + altura
        far = 2.0 * altura
    elif dirz > 0:
        objetivo = zmax + cut_margin
        far = (objetivo - zmin) + cut_margin
    else:
        objetivo = zmin - cut_margin
        far = (zmax - objetivo) + cut_margin
    dz = objetivo - vplan.Origin.Z
    if abs(dz) > 0.003:
        viewer = find_viewer(elem_name(vplan))
        if viewer is None:
            return
        ElementTransformUtils.MoveElement(doc, viewer.Id, XYZ(0.0, 0.0, dz))
    p = vplan.get_Parameter(BuiltInParameter.VIEWER_BOUND_OFFSET_FAR)
    if p is not None and not p.IsReadOnly:
        p.Set(far)

def ajustar_crop_planta(vplan, ai, tname):
    bb = vplan.CropBox
    inv = bb.Transform.Inverse
    minx = miny = float('inf')
    maxx = maxy = float('-inf')
    hay_geo = False
    for el in elementos_geometria(ai):
        mbb = member_solid_bbox(el)
        if mbb is None:
            continue
        hay_geo = True
        for x in (mbb.Min.X, mbb.Max.X):
            for y in (mbb.Min.Y, mbb.Max.Y):
                for z in (mbb.Min.Z, mbb.Max.Z):
                    p = inv.OfPoint(XYZ(x, y, z))
                    if p.X < minx: minx = p.X
                    if p.X > maxx: maxx = p.X
                    if p.Y < miny: miny = p.Y
                    if p.Y > maxy: maxy = p.Y
    if not hay_geo:
        return
    margen = crop_margin_mm / 304.8 * vplan.Scale
    nuevo = BoundingBoxXYZ()
    nuevo.Transform = bb.Transform
    nuevo.Min = XYZ(minx - margen, miny - margen, bb.Min.Z)
    nuevo.Max = XYZ(maxx + margen, maxy + margen, bb.Max.Z)
    vplan.CropBox = nuevo
    try:
        mgr = vplan.GetCropRegionShapeManager()
        mgr.IsAnnotationCropActive = False
    except Exception:
        pass

def ajustar_crop_corte(vsec, ai, tname, label):
    bb = vsec.CropBox
    inv = bb.Transform.Inverse
    minx = miny = float('inf')
    maxx = maxy = float('-inf')
    hay_geo = False
    for el in elementos_geometria(ai):
        mbb = member_solid_bbox(el)
        if mbb is None:
            continue
        hay_geo = True
        for x in (mbb.Min.X, mbb.Max.X):
            for y in (mbb.Min.Y, mbb.Max.Y):
                for z in (mbb.Min.Z, mbb.Max.Z):
                    p = inv.OfPoint(XYZ(x, y, z))
                    if p.X < minx: minx = p.X
                    if p.X > maxx: maxx = p.X
                    if p.Y < miny: miny = p.Y
                    if p.Y > maxy: maxy = p.Y
    if not hay_geo:
        return
    margen = crop_margin_mm / 304.8 * vsec.Scale
    nuevo = BoundingBoxXYZ()
    nuevo.Transform = bb.Transform
    nuevo.Min = XYZ(minx - margen, miny - margen, bb.Min.Z)
    nuevo.Max = XYZ(maxx + margen, maxy + margen, bb.Max.Z)
    vsec.CropBox = nuevo
    try:
        mgr = vsec.GetCropRegionShapeManager()
        mgr.IsAnnotationCropActive = False
    except Exception:
        pass

def ajustar_crop_callout(vsec, bb_mundo, margen_mm, escala):
    # mismo patron que ajustar_crop_planta/ajustar_crop_corte: bb_mundo (coordenadas
    # MUNDO, ver bbox_barras_pedestal) se reproyecta al sistema local del CropBox
    # actual del callout. Se usa tanto al crear el callout como para RETROFITEAR uno ya
    # existente cuyo crop haya quedado grande (ver bbox_barras_pedestal).
    bbc = vsec.CropBox
    inv = bbc.Transform.Inverse
    minx = miny = float('inf')
    maxx = maxy = float('-inf')
    for x in (bb_mundo.Min.X, bb_mundo.Max.X):
        for y in (bb_mundo.Min.Y, bb_mundo.Max.Y):
            for z in (bb_mundo.Min.Z, bb_mundo.Max.Z):
                p = inv.OfPoint(XYZ(x, y, z))
                if p.X < minx: minx = p.X
                if p.X > maxx: maxx = p.X
                if p.Y < miny: miny = p.Y
                if p.Y > maxy: maxy = p.Y
    margen = margen_mm / 304.8 * escala
    nuevo = BoundingBoxXYZ()
    nuevo.Transform = bbc.Transform
    nuevo.Min = XYZ(minx - margen, miny - margen, bbc.Min.Z)
    nuevo.Max = XYZ(maxx + margen, maxy + margen, bbc.Max.Z)
    vsec.CropBox = nuevo

def ajustar_far_clip_corte(vsec, ai, tname, label):
    # Far Clip Offset FIJO en FAR_CLIP_MARGIN_MM para TODOS los cortes A/B, sin
    # importar la profundidad real del assembly (2026-07-20 R2, pedido explicito de
    # Javier -- ver comentario en FAR_CLIP_MARGIN_MM sobre la consecuencia conocida en
    # assemblies mas profundos que el offset).
    p_activo = vsec.get_Parameter(BuiltInParameter.VIEWER_BOUND_ACTIVE_FAR)
    if p_activo is not None and not p_activo.IsReadOnly:
        p_activo.Set(1)
    p_offset = vsec.get_Parameter(BuiltInParameter.VIEWER_BOUND_OFFSET_FAR)
    if p_offset is not None and not p_offset.IsReadOnly:
        p_offset.Set(far_clip_margin_corte)

def ajustar_far_clip_callout(v, tname, label, offset_pies=None):
    # "Far Clip Settings" a INDEPENDENT y su propio Far Clip Offset (2026-07-30, pedido de
    # Javier; ver las constantes mas arriba). Por defecto FAR_CLIP_CALLOUT_MM (los callouts);
    # con offset_pies se reusa para el CORTE DE PEDESTAL con el offset de cortes (300) --
    # 2026-07-31: en la primera corrida ese corte quedo en 500 pese a que se le escribia 300
    # con ajustar_far_clip_corte, porque es un Detail View igual que el callout y con "Same
    # as parent view" el offset escrito no queda guardado. Hace falta esta secuencia.
    # ORDEN: primero Independent y DESPUES el offset -- mientras la vista hereda del padre
    # ("Same as parent view") el offset lo manda la vista padre, asi que escribirlo antes no
    # queda guardado.
    # Se llama DESPUES de aplicar_template: si el view template gobierna estos parametros
    # quedan de solo lectura, y entonces conviene que el log lo diga en vez de fallar en
    # silencio (mismo problema ya visto en este script con las categorias gobernadas por
    # template, ver liberar_del_template).
    p_set = None
    try:
        p_set = v.LookupParameter(NOMBRE_PARAM_FAR_CLIP_SETTINGS)
    except Exception:
        p_set = None
    if p_set is None:
        log.append('AVISO {}: el {} no expone "{}"; no se toco el far clip.'.format(
            tname, label, NOMBRE_PARAM_FAR_CLIP_SETTINGS))
        return
    if p_set.IsReadOnly:
        log.append('AVISO {}: "{}" del {} es de solo lectura (probablemente lo gobierna el view template); no se pudo dejar en Independent.'.format(
            tname, NOMBRE_PARAM_FAR_CLIP_SETTINGS, label))
        return
    try:
        if p_set.AsInteger() != FAR_CLIP_SETTINGS_INDEPENDIENTE:
            p_set.Set(FAR_CLIP_SETTINGS_INDEPENDIENTE)
    except Exception as e:
        log.append('AVISO {}: no se pudo dejar "{}" en Independent en el {}: {}'.format(
            tname, NOMBRE_PARAM_FAR_CLIP_SETTINGS, label, e))
        return
    p_off = v.get_Parameter(BuiltInParameter.VIEWER_BOUND_OFFSET_FAR)
    if p_off is None:
        try:
            p_off = v.LookupParameter('Far Clip Offset')
        except Exception:
            p_off = None
    if p_off is None or p_off.IsReadOnly:
        log.append('AVISO {}: no se pudo escribir el Far Clip Offset del {} (falta el parametro o es de solo lectura).'.format(
            tname, label))
        return
    try:
        p_off.Set(far_clip_callout if offset_pies is None else offset_pies)
    except Exception as e:
        log.append('AVISO {}: no se pudo escribir el Far Clip Offset del {}: {}'.format(tname, label, e))

def ajustar_titulo_planta(v, tname):
    p = v.get_Parameter(BuiltInParameter.VIEW_DESCRIPTION)
    if p is None or p.IsReadOnly:
        return
    deseado = tname + SUFIJO_TITULO_PLANTA
    if p.AsString() != deseado:
        p.Set(deseado)

def ocultar_simbolos_corte(v, tname, label):
    try:
        cat = ElementId(BuiltInCategory.OST_Sections)
        if v.CanCategoryBeHidden(cat) and not v.GetCategoryHidden(cat):
            v.SetCategoryHidden(cat, True)
    except Exception as e:
        log.append('{}: no se pudo ocultar Sections en {} (probablemente el view template la controla): {}'.format(tname, label, e))

CATS_ARMADURA = ((BuiltInCategory.OST_Rebar, 'Structural Rebar'), (BuiltInCategory.OST_Coupler, 'Structural Rebar Couplers'))

def preparar_vista_armadura(v, tname, label):
    try:
        if v.DetailLevel != ViewDetailLevel.Coarse:
            v.DetailLevel = ViewDetailLevel.Coarse
    except Exception:
        pass
    for bic, nombre_cat in CATS_ARMADURA:
        try:
            cat = ElementId(bic)
            if v.CanCategoryBeHidden(cat) and v.GetCategoryHidden(cat):
                v.SetCategoryHidden(cat, False)
                log.append('{}: categoria {} activada en {}.'.format(tname, nombre_cat, label))
        except Exception:
            pass

def liberar_categoria_de_template(v, cat_id):
    # Si la vista tiene View Template y este CONTROLA el V/G Override de cat_id (su
    # ElementId aparece en GetTemplateParameterIds()), SetCategoryHidden tira una
    # excepcion silenciosa (la capturan los try/except de mas abajo) y la categoria
    # queda tal cual estaba -- confirmado 2026-07-28: los cortes/callouts de pedestal
    # seguian sin verse en la planta pese a que el codigo de forzado ya corria sin
    # error. Este helper libera cat_id del control del template SOLO para esta vista
    # puntual (no toca el template, no afecta otras vistas que lo usen) para que el
    # SetCategoryHidden de mas abajo si pueda aplicar.
    try:
        if v.ViewTemplateId == ElementId.InvalidElementId:
            return
        controlados = v.GetTemplateParameterIds()
        if not any(cid.Value == cat_id.Value for cid in controlados):
            return
        no_controlados = list(v.GetNonControlledTemplateParameterIds())
        if any(cid.Value == cat_id.Value for cid in no_controlados):
            return
        no_controlados.append(cat_id)
        v.SetNonControlledTemplateParameterIds(List[ElementId](no_controlados))
    except Exception:
        pass

CATS_SECCIONES_PLANTA = ((BuiltInCategory.OST_Sections, 'Sections'),)

def mostrar_categoria_secciones(v, tname, label):
    # Los marcadores de CORTE A/B (burbuja + linea de corte) en la planta usan la
    # categoria OST_Sections. Mismo problema que CATS_CALLOUT (la planta nace duplicada
    # de la de FORMAS, que nunca referencio secciones propias con este patron) -- pedido
    # de Javier 2026-07-28: los cortes deben verse EN LA PLANTA (no se toca la vista de
    # corte en si, que sigue ocultando Sections adentro via ocultar_simbolos_corte).
    for bic, nombre_cat in CATS_SECCIONES_PLANTA:
        try:
            cat = ElementId(bic)
            liberar_categoria_de_template(v, cat)
            if v.CanCategoryBeHidden(cat) and v.GetCategoryHidden(cat):
                v.SetCategoryHidden(cat, False)
                log.append('{}: categoria {} activada en {}.'.format(tname, nombre_cat, label))
        except Exception:
            pass

CATS_CALLOUT = ((BuiltInCategory.OST_Callouts, 'Callouts'), (BuiltInCategory.OST_CalloutBoundary, 'Callout Boundary'), (BuiltInCategory.OST_CalloutHeads, 'Callout Heads'))

def mostrar_categoria_callouts(v, tname, label):
    # La planta de ARMADURAS nace duplicada de la planta de FORMAS (Duplicate), que
    # nunca crea callouts de pedestal -- si su template/estado tenia la categoria
    # Callouts oculta (plausible, nadie la necesitaba antes), la planta de ARMADURAS
    # hereda esa categoria oculta y el marcador del callout de pedestal (creado por
    # crear_callout_pedestal) queda invisible en la planta aunque el elemento exista y
    # no este oculto por si mismo (2026-07-21, mismo patron que CATS_ARMADURA con Structural
    # Rebar/Couplers, que ya se forzaban visibles por la misma razon). Reforzado
    # 2026-07-28 con liberar_categoria_de_template: confirmado por MCP contra el modelo
    # real que esta funcion corria sin error pero el marcador seguia sin verse -- la
    # categoria estaba bajo control del template, que impide SetCategoryHidden en
    # silencio.
    for bic, nombre_cat in CATS_CALLOUT:
        try:
            cat = ElementId(bic)
            liberar_categoria_de_template(v, cat)
            if v.CanCategoryBeHidden(cat) and v.GetCategoryHidden(cat):
                v.SetCategoryHidden(cat, False)
                log.append('{}: categoria {} activada en {}.'.format(tname, nombre_cat, label))
        except Exception:
            pass

PARAM_CANTIDAD = 'Cantidad_Inserto'

def set_cantidad(v, cantidad, tname):
    p = v.LookupParameter(PARAM_CANTIDAD)
    if p is None or p.IsReadOnly:
        return
    st = p.StorageType
    if st == StorageType.Integer:
        p.Set(int(cantidad))
    elif st == StorageType.Double:
        p.Set(float(cantidad))
    else:
        p.Set(str(cantidad))

def armaduras_del_assembly(ai):
    # RebarHostData se chequea en CUALQUIER instancia del assembly, a cualquier
    # profundidad de anidamiento (instancias_recursivas, 2026-07-20) -- no solo en
    # los miembros de PRIMER NIVEL: si el host de la barra es un sub-componente
    # anidado 2+ niveles adentro, RebarHostData.GetRebarHostData() sobre el miembro
    # de primer nivel daba None y la barra no se mostraba/pasaba a modo
    # primera-y-ultima (mismo bug que rebar_del_assembly de 03).
    barras = {}
    def agregar(r):
        try:
            barras[r.Id.Value] = r
        except Exception:
            pass
    for mid in ai.GetMemberIds():
        el = doc.GetElement(mid)
        if isinstance(el, (Rebar, RebarInSystem, RebarContainer)):
            agregar(el)
    for el in instancias_recursivas(ai):
        try:
            hd = RebarHostData.GetRebarHostData(el)
        except Exception:
            hd = None
        if hd is None:
            continue
        try:
            for r in hd.GetRebarsInHost():
                agregar(r)
        except Exception:
            pass
    return list(barras.values())

def mostrar_armaduras(v, barras, tname, label):
    if not barras:
        return
    cambiadas = 0
    for r in barras:
        try:
            if not r.IsUnobscuredInView(v):
                r.SetUnobscuredInView(v, True)
                cambiadas += 1
        except Exception:
            pass
    if cambiadas:
        log.append('{}: {} barras visibles en {}.'.format(tname, cambiadas, label))

def mostrar_primera_ultima(v, barras, tname, label):
    # 'Show First and Last Rebar in Rebar Set' (checkbox de Presentation en la UI) =
    # Rebar.SetPresentationMode(view, RebarPresentationMode.FirstLast). Solo aplica a
    # sets con mas de una barra (CanApplyPresentationMode devuelve False para barras
    # individuales, ej. Layout 'Single' - se salta sin error, no hace falta releer el
    # Layout Rule de la barra aca).
    if not barras:
        return
    cambiadas = 0
    for r in barras:
        try:
            if not r.CanApplyPresentationMode(v):
                continue
            if r.GetPresentationMode(v) != RebarPresentationMode.FirstLast:
                r.SetPresentationMode(v, RebarPresentationMode.FirstLast)
                cambiadas += 1
        except Exception:
            pass
    if cambiadas:
        log.append('{}: {} sets de barras en modo \"primera y ultima\" en {}.'.format(tname, cambiadas, label))

def es_familia_pedestal(nombre_familia):
    # 2026-07-15: no todos los pedestales son la familia \"C-Pedestal\" pura (PD-1004,
    # PD-1003, PD-1010) - hay familias COMBINADAS fundacion+pedestal en una sola pieza
    # (\"C-Fundacion+Pedestal\", \"C-Fundacion+2-Pedestal\": confirmado con Javier que ahi
    # el sub-componente que hospeda la barra, ej. G35, cuelga DIRECTO de esa familia
    # combinada via SuperComponent, sin un nivel intermedio \"solo pedestal\" separable).
    # Match por substring (no exacto) para no tener que mantener una lista de nombres.
    try:
        return 'pedestal' in nombre_familia.strip().lower()
    except Exception:
        return False

def es_familia_pedestal_pura(nombre_familia):
    # PEDESTAL PURO: familia que es SOLO pedestal (ej. C-Pedestal, tipos PD-xxxx),
    # separada de la fundacion. Se distingue de las familias COMBINADAS
    # fundacion+pedestal (C-Fundacion+Pedestal, C-Fundacion+2-Pedestal): esas tienen
    # 'fundacion' en el nombre. Se usa SOLO para el filtro de la PLANTA
    # (ocultar_barras_pedestal). En una familia combinada la zapata y el pedestal son
    # el mismo elemento host (sin nivel separable), asi que ahi el filtro 'solo PPL-PPL'
    # ocultaba tambien la armadura de zapata -> por pedido de Javier (2026-07-21) esas
    # plantas muestran TODAS las barras. Los callouts siguen usando es_familia_pedestal
    # (amplio, incluye combinadas) y NO cambian.
    try:
        low = nombre_familia.strip().lower()
        return 'pedestal' in low and 'fundacion' not in low
    except Exception:
        return False

def pedestales_del_assembly(ai):
    # todas las instancias del assembly (a cualquier profundidad, via
    # instancias_recursivas) cuya familia matchea es_familia_pedestal - se usa SOLO
    # para CONTAR cuantos pedestales tiene el assembly, no para decidir barra por
    # barra (ver ocultar_barras_pedestal).
    resultado = []
    for el in instancias_recursivas(ai):
        try:
            fam = el.Symbol.Family.Name
        except Exception:
            continue
        if es_familia_pedestal(fam):
            resultado.append(el)
    return resultado

def es_barra_de_pedestal(r, pedestal_ids):
    # host de la barra (Rebar.GetHostId) y su cadena de anidamiento
    # (FamilyInstance.SuperComponent): True si el host o algun ancestro ES una de las
    # instancias de pedestal del assembly (pedestal_ids, ver pedestales_del_assembly) -
    # no compara por nombre de familia aca, compara por ElementId puntual.
    try:
        host = doc.GetElement(r.GetHostId())
    except Exception:
        return False
    pasos = 0
    while host is not None and pasos < 50:
        try:
            hid = host.Id.Value
        except Exception:
            hid = None
        if hid is not None and hid in pedestal_ids:
            return True
        try:
            host = host.SuperComponent
        except Exception:
            host = None
        pasos += 1
    return False

def resolver_pedestal_de_barra(r, pedestal_ids):
    # Mismo recorrido que es_barra_de_pedestal (GetHostId + SuperComponent hacia
    # arriba), pero devuelve el ElementId.Value del pedestal encontrado en vez de
    # True/False -- para filtrar el callout por el pedestal ESPECIFICO que le
    # corresponde (no solo "es de algun pedestal"). None si la barra no cuelga de
    # ningun pedestal del assembly (ej. armadura de zapata/radier).
    try:
        host = doc.GetElement(r.GetHostId())
    except Exception:
        return None
    pasos = 0
    while host is not None and pasos < 50:
        try:
            hid = host.Id.Value
        except Exception:
            hid = None
        if hid is not None and hid in pedestal_ids:
            return hid
        try:
            host = host.SuperComponent
        except Exception:
            host = None
        pasos += 1
    return None

def es_barra_de_viga(r):
    # True si el host de la barra (Rebar.GetHostId) o algun ancestro por SuperComponent es
    # una VIGA (Structural Framing / OST_StructuralFraming). Mismo recorrido que
    # es_barra_de_pedestal, pero compara por CATEGORIA del host, no por ElementId. Se usa
    # para OCULTAR en la planta las barras que pertenecen a vigas (pedido de Javier
    # 2026-07-25: la armadura de las vigas no va en la planta del assembly).
    try:
        host = doc.GetElement(r.GetHostId())
    except Exception:
        return False
    pasos = 0
    while host is not None and pasos < 50:
        try:
            cat = host.Category
            if cat is not None and cat.Id == ElementId(BuiltInCategory.OST_StructuralFraming):
                return True
        except Exception:
            pass
        try:
            host = host.SuperComponent
        except Exception:
            host = None
        pasos += 1
    return False

PEDESTAL_PARTITION_PREFIX = 'PPL-PPL'
ESTRIBO_PEDESTAL_PARTITION = 'SEC-EST'
def leer_partition_barra(r):
    # mismo patron que leer_partition del 04: parametro de instancia de texto plano,
    # AsString() (no AsValueString(), no es un enum).
    try:
        p = r.LookupParameter('Partition')
    except Exception:
        p = None
    if p is None:
        return None
    try:
        valor = p.AsString()
    except Exception:
        valor = None
    return valor.strip() if valor else None

def ocultar_barras_pedestal(v, barras, tname, label, pedestales):
    # Regla de negocio 2026-07-15, AMPLIADA 2026-07-20 (definida con el jefe de area):
    # antes, con 2+ pedestales se ocultaba TODA la armadura de pedestal (ambiguo a cual
    # pedestal pertenece cada barra) y con 0 o 1 pedestal se mostraba todo sin filtrar.
    # Ahora, sin importar cuantos pedestales tenga el assembly, toda barra que
    # pertenezca a un pedestal se muestra en planta UNICAMENTE si su parametro de
    # instancia Partition empieza con PPL-PPL (la armadura principal/longitudinal del
    # pedestal) O CON SEC-EST (estribos de pedestal, agregado 2026-07-27 a pedido de
    # Javier) - cualquier otro tipo de armadura del pedestal se oculta siempre, ya no
    # depende de la ambiguedad entre pedestales porque el filtro es por
    # Partition, no por a que pedestal pertenece cada barra. Las barras que NO son de
    # pedestal (zapata/radier: PPL-SUP, PPL-INF, SEC-LAT, SEC-RFZ) nunca pasan por este
    # filtro, siguen mostrandose igual que siempre. Oculta explicitamente
    # (View.HideElements) - complementa el forzado de categoria visible de
    # preparar_vista_armadura, que no distingue por elemento. Devuelve las barras que SI
    # deben mostrarse (para encadenar con mostrar_armaduras / mostrar_primera_ultima).
    if not barras or not pedestales:
        return list(barras)
    # SOLO los pedestales PUROS (familia separada, es_familia_pedestal_pura) activan
    # este filtro en la PLANTA. En un assembly de familia COMBINADA fundacion+pedestal
    # no se puede distinguir la barra de zapata de la de pedestal (mismo elemento host),
    # y el filtro 'solo PPL-PPL' las ocultaba a casi todas -> esas plantas muestran
    # TODAS las barras (Javier, 2026-07-21). El filtro de pedestal-solo sigue vivo en los
    # callouts (limitar_callout_a_pedestal), que no usan esta funcion.
    pedestales_puros = []
    for el in pedestales:
        try:
            fam = el.Symbol.Family.Name
        except Exception:
            fam = ''
        if es_familia_pedestal_pura(fam):
            pedestales_puros.append(el)
    if not pedestales_puros:
        log.append('{}: planta sin filtro de pedestal (0 pedestales puros; {} pedestal(es) en familia combinada muestran todas las barras).'.format(tname, len(pedestales)))
        return list(barras)
    pedestal_ids = set()
    for el in pedestales_puros:
        try:
            pedestal_ids.add(el.Id.Value)
        except Exception:
            pass
    visibles = []
    ids = List[ElementId]()
    for r in barras:
        if es_barra_de_pedestal(r, pedestal_ids):
            partition = leer_partition_barra(r)
            if partition and (partition.startswith(PEDESTAL_PARTITION_PREFIX) or partition.startswith(ESTRIBO_PEDESTAL_PARTITION)):
                visibles.append(r)
                continue
            try:
                if r.CanBeHidden(v) and not r.IsHidden(v):
                    ids.Add(r.Id)
            except Exception:
                pass
        else:
            visibles.append(r)
    if ids.Count > 0:
        try:
            v.HideElements(ids)
            log.append('{}: {} barras de pedestal ocultas en {} (Partition distinto de {}/{}, {} pedestales en el assembly).'.format(tname, ids.Count, label, PEDESTAL_PARTITION_PREFIX, ESTRIBO_PEDESTAL_PARTITION, len(pedestales)))
        except Exception as e:
            log.append('ERROR {} ocultando barras de pedestal en {}: {}'.format(tname, label, e))
    return visibles

def ocultar_barras_viga(v, barras, tname, label):
    # Oculta en la PLANTA (View.HideElements) las barras cuyo host es una VIGA (Structural
    # Framing) - pedido de Javier 2026-07-25: la armadura de las vigas no va en la planta
    # del assembly. Mismo patron/encadenado que ocultar_barras_pedestal: devuelve las barras
    # que SI deben mostrarse (para seguir con mostrar_armaduras). Solo aplica a la planta,
    # NO a los cortes (que muestran toda la armadura a proposito).
    if not barras:
        return list(barras)
    visibles = []
    ids = List[ElementId]()
    for r in barras:
        if es_barra_de_viga(r):
            try:
                if r.CanBeHidden(v) and not r.IsHidden(v):
                    ids.Add(r.Id)
            except Exception:
                pass
        else:
            visibles.append(r)
    if ids.Count > 0:
        try:
            v.HideElements(ids)
            log.append('{}: {} barras de viga (Structural Framing) ocultas en {}.'.format(tname, ids.Count, label))
        except Exception as e:
            log.append('ERROR {} ocultando barras de viga en {}: {}'.format(tname, label, e))
    return visibles

def aplicar_template(v, tname, label, scale, template):
    if template is None:
        return
    try:
        if v.ViewTemplateId != template.Id:
            v.ViewTemplateId = template.Id
            log.append('{}: template aplicado a {}.'.format(tname, label))
        if v.Scale != scale:
            v.Scale = scale
    except Exception as e:
        pass

def instancias_recursivas(ai):
    vistos = set()
    resultado = []
    stack = list(ai.GetMemberIds())
    while stack:
        eid = stack.pop()
        if eid.Value in vistos:
            continue
        vistos.add(eid.Value)
        el = doc.GetElement(eid)
        if el is None or not isinstance(el, FamilyInstance):
            continue
        resultado.append(el)
        try:
            stack.extend(list(el.GetSubComponentIds()))
        except Exception:
            pass
    return resultado

def tipos_pedestal(ai):
    # 2026-07-21 R2: antes exact-matcheaba la familia contra pedestal_fam_low
    # (default 'C-Pedestal'), asi que los assemblies cuyo unico pedestal vive en una
    # familia COMBINADA (ej. C-Fundacion+Pedestal, C-Fundacion+2-Pedestal) nunca
    # generaban ningun callout -- quedaban con grupos={} aunque
    # pedestales_del_assembly() (usada para el filtro de armadura) SI los contaba. Ahora
    # usa el mismo criterio amplio es_familia_pedestal() (substring 'pedestal' en el
    # nombre de familia, case-insensitive) que ya rige en toda la rutina para identificar
    # que es 'tipo pedestal' -- pedestal_fam_low queda sin uso aca (el input "Familia de
    # pedestal para callouts" no filtra mas la deteccion, cualquier familia con
    # 'pedestal' en el nombre cuenta). Se sigue agrupando por Symbol.Name (tipo), no por
    # familia -- si el mismo tipo se repite varias instancias, es UN solo grupo.
    grupos = {}
    for el in instancias_recursivas(ai):
        try:
            fam = el.Symbol.Family.Name
        except Exception:
            continue
        if not es_familia_pedestal(fam):
            continue
        tn = elem_name(el.Symbol)
        grupos.setdefault(tn, []).append(el)
    return grupos

def bbox_con_anidados(el):
    pila = [el]
    vistos = set()
    minx = miny = minz = float('inf')
    maxx = maxy = maxz = float('-inf')
    hay = False
    while pila:
        e = pila.pop()
        if e is None:
            continue
        try:
            eid = e.Id.Value
        except Exception:
            eid = None
        if eid is not None:
            if eid in vistos:
                continue
            vistos.add(eid)
        bb = member_solid_bbox(e)
        if bb is not None:
            hay = True
            if bb.Min.X < minx: minx = bb.Min.X
            if bb.Max.X > maxx: maxx = bb.Max.X
            if bb.Min.Y < miny: miny = bb.Min.Y
            if bb.Max.Y > maxy: maxy = bb.Max.Y
            if bb.Min.Z < minz: minz = bb.Min.Z
            if bb.Max.Z > maxz: maxz = bb.Max.Z
        if isinstance(e, FamilyInstance):
            try:
                for sid in e.GetSubComponentIds():
                    pila.append(doc.GetElement(sid))
            except Exception:
                pass
    if not hay:
        return None
    class _BB(object):
        pass
    r = _BB()
    r.Min = XYZ(minx, miny, minz)
    r.Max = XYZ(maxx, maxy, maxz)
    return r

def barras_del_pedestal(el_ped, pedestales, barras, vplan):
    # Fuente UNICA de verdad de "que barras pertenecen a este pedestal especifico" --
    # la usan tanto limitar_callout_a_pedestal (visibilidad) como bbox_barras_pedestal
    # (crop), para no duplicar el criterio en dos lados.
    #
    # Historial 2026-07-21 (iterado varias veces con Javier): SuperComponent solo no
    # alcanza (no distingue pedestal de zapata en familias COMBINADAS, donde ambas
    # cuelgan del mismo elemento). Una lista de Partitions tampoco alcanza, ni blanca
    # (PPL-PPL unicamente dejaba afuera barras reales del pedestal con otra Partition,
    # ej. estribos SEC-EST) ni negra (ZAPATA_PARTITIONS dejaba pasar barras de zapata
    # reales con Partition en blanco -- Schedule Mark "(SUP.-INF.)"/"(LATERAL)" en el
    # modelo real -- porque el modelador nunca les asigno el parametro). Javier senalo
    # el problema de fondo: una lista de valores (blanca o negra) NUNCA es escalable,
    # cualquier Partition nueva o mal cargada la rompe de nuevo.
    #
    # Criterio: PEDESTAL_PARTITION_PREFIX (PPL-PPL, la unica Partition inequivoca desde
    # el pedido original) se usa SOLO como ANCLA para identificar el/los elemento(s) de
    # hormigon que HOSPEDAN (Rebar.GetHostId, host directo, no SuperComponent) la
    # armadura principal del pedestal -- y despues se acepta CUALQUIER barra hospedada
    # en ese host, sin importar su propia Partition (vacia, con un valor nuevo, como
    # sea). No depende de que Partition este bien cargado en cada barra individual,
    # solo en al menos una (la PPL-PPL) por host.
    #
    # Un solo pedestal por callout, aunque haya 2+ hosts anclados (2026-07-21, caso real
    # FN-1011: dos pedestales "iguales" (mismo tipo) fusionados en UNA sola instancia
    # combinada -- no son dos FamilyInstance entre las que elegir, son dos capas
    # anidadas distintas dentro de la MISMA instancia, cada una con su propia barra
    # PPL-PPL). Si hosts_ancla tiene mas de un host, host_mas_a_la_derecha() elige UNO
    # solo (mismo criterio que elemento_mas_a_la_derecha para elegir entre instancias
    # distintas) y se descartan las barras de los demas hosts anclados.
    try:
        target_id = el_ped.Id.Value
    except Exception:
        return []
    pedestal_ids = set()
    for p in pedestales:
        try:
            pedestal_ids.add(p.Id.Value)
        except Exception:
            pass
    del_pedestal = [r for r in barras if resolver_pedestal_de_barra(r, pedestal_ids) == target_id]
    hosts_ancla = set()
    for r in del_pedestal:
        partition = leer_partition_barra(r)
        if partition and partition.strip().upper().startswith(PEDESTAL_PARTITION_PREFIX):
            try:
                hid = r.GetHostId()
            except Exception:
                hid = None
            if hid is not None and hid.Value >= 0:
                hosts_ancla.add(hid.Value)
    if not hosts_ancla:
        # sin ninguna barra PPL-PPL para anclar (no deberia pasar en un pedestal bien
        # modelado) -- se cae a todo lo que resuelva por SuperComponent, mejor que
        # dejar el callout vacio.
        return del_pedestal
    host_elegido = host_mas_a_la_derecha(vplan, hosts_ancla)
    if host_elegido is None:
        return del_pedestal
    resultado = []
    for r in del_pedestal:
        try:
            hid = r.GetHostId()
        except Exception:
            hid = None
        if hid is not None and hid.Value == host_elegido:
            resultado.append(r)
    return resultado

def bbox_barras_pedestal(el_ped, pedestales, barras, vplan):
    # 2026-07-21: el crop del callout NO puede seguir midiendose con
    # bbox_con_anidados(el_ped) en familias COMBINADAS (ej. C-Fundacion+Pedestal) --
    # ahi el_ped ES la zapata y el pedestal fusionados en un solo solido, asi que su
    # bbox completo incluye la zapata entera (Javier: "el crop deberia ajustarse
    # unicamente al pedestal, no a toda la zapata"). En cambio, se mide el bbox de los
    # HOSTS REALES de barras_del_pedestal() -- ese host tipicamente es la capa anidada
    # especifica del pedestal (ej. G35), mas chica que la zapata completa, sin importar
    # si el_ped es una familia pura o combinada. None si no se encontro ninguna barra
    # valida (el caller cae de vuelta a bbox_con_anidados(el_ped) en ese caso).
    hosts = set()
    for r in barras_del_pedestal(el_ped, pedestales, barras, vplan):
        try:
            hid = r.GetHostId()
        except Exception:
            hid = None
        if hid is not None and hid.Value >= 0:
            hosts.add(hid.Value)
    if not hosts:
        return None
    minx = miny = minz = float('inf')
    maxx = maxy = maxz = float('-inf')
    hay = False
    for hid in hosts:
        el_host = doc.GetElement(ElementId(hid))
        bb = member_solid_bbox(el_host)
        if bb is None:
            continue
        hay = True
        if bb.Min.X < minx: minx = bb.Min.X
        if bb.Max.X > maxx: maxx = bb.Max.X
        if bb.Min.Y < miny: miny = bb.Min.Y
        if bb.Max.Y > maxy: maxy = bb.Max.Y
        if bb.Min.Z < minz: minz = bb.Min.Z
        if bb.Max.Z > maxz: maxz = bb.Max.Z
    if not hay:
        return None
    class _BB(object):
        pass
    r_ = _BB()
    r_.Min = XYZ(minx, miny, minz)
    r_.Max = XYZ(maxx, maxy, maxz)
    return r_

def elemento_mas_a_la_derecha(vplan, instancias):
    inv = vplan.CropBox.Transform.Inverse
    mejor = None
    mejor_x = float('-inf')
    for el in instancias:
        bb = bbox_con_anidados(el)
        if bb is None:
            continue
        cx = (bb.Min.X + bb.Max.X) / 2.0
        cy = (bb.Min.Y + bb.Max.Y) / 2.0
        cz = (bb.Min.Z + bb.Max.Z) / 2.0
        p_local = inv.OfPoint(XYZ(cx, cy, cz))
        if p_local.X > mejor_x:
            mejor_x = p_local.X
            mejor = (el, bb)
    return mejor

def host_mas_a_la_derecha(vplan, host_ids):
    # mismo criterio que elemento_mas_a_la_derecha, pero para elegir UN host de
    # hormigon entre varios anclados por PPL-PPL (ver barras_del_pedestal) -- caso real
    # 2026-07-21: un assembly puede tener DOS pedestales "iguales" (mismo tipo)
    # fusionados en una UNICA instancia combinada (ej. FN-1011), asi que no hay dos
    # instancias de FamilyInstance entre las que elegir (elemento_mas_a_la_derecha no
    # aplica, son la MISMA instancia) -- hay que elegir entre los HOSTS anidados de esa
    # unica instancia.
    inv = vplan.CropBox.Transform.Inverse
    mejor = None
    mejor_x = float('-inf')
    for hid in host_ids:
        el_host = doc.GetElement(ElementId(hid))
        bb = member_solid_bbox(el_host)
        if bb is None:
            continue
        cx = (bb.Min.X + bb.Max.X) / 2.0
        cy = (bb.Min.Y + bb.Max.Y) / 2.0
        cz = (bb.Min.Z + bb.Max.Z) / 2.0
        p_local = inv.OfPoint(XYZ(cx, cy, cz))
        if p_local.X > mejor_x:
            mejor_x = p_local.X
            mejor = hid
    return mejor

def limitar_callout_a_pedestal(callout, el_ped, pedestales, barras, tname, tipo, vplan):
    # El callout de un tipo de pedestal debe mostrar EXCLUSIVAMENTE la armadura de ESE
    # pedestal (2026-07-21, pedido explicito de Javier, iterado varias veces -- version
    # final). Ver barras_del_pedestal() para el criterio completo (estructural, por
    # host de hormigon anclado en la Partition PPL-PPL -- no por lista de valores de
    # Partition, ni blanca ni negra, ninguna de las dos escalaba). Cualquier barra que
    # NO este en barras_del_pedestal() se oculta. Ademas se ocultan los elementos de
    # CONCRETO de otros pedestales (y sus subcomponentes anidados) para que tampoco
    # aparezca su geometria. El pedestal elegido y su propio contenido quedan intactos.
    try:
        target_id = el_ped.Id.Value
    except Exception:
        return
    validas_ids = set()
    for r in barras_del_pedestal(el_ped, pedestales, barras, vplan):
        try:
            validas_ids.add(r.Id.Value)
        except Exception:
            pass
    ids = List[ElementId]()
    for r in barras:
        try:
            rid = r.Id.Value
        except Exception:
            rid = None
        if rid is not None and rid in validas_ids:
            continue
        try:
            if r.CanBeHidden(callout) and not r.IsHidden(callout):
                ids.Add(r.Id)
        except Exception:
            pass
    for otro in pedestales:
        try:
            if otro.Id.Value == target_id:
                continue
        except Exception:
            continue
        pila = [otro]
        while pila:
            e = pila.pop()
            if e is None:
                continue
            try:
                if e.CanBeHidden(callout) and not e.IsHidden(callout):
                    ids.Add(e.Id)
            except Exception:
                pass
            if isinstance(e, FamilyInstance):
                try:
                    for sid in e.GetSubComponentIds():
                        pila.append(doc.GetElement(sid))
                except Exception:
                    pass
    if ids.Count > 0:
        try:
            callout.HideElements(ids)
            log.append('{}: {} elementos fuera del pedestal {} ocultos en su callout.'.format(tname, ids.Count, tipo))
        except Exception as e:
            log.append('ERROR {} limitando el callout de {} al pedestal: {}'.format(tname, tipo, e))

def crear_callout_pedestal(vplan, tname, tipo, bb, vftype, escala, margen_mm, barras, el_ped, pedestales):
    global callouts_creados, callouts_saltados
    vname = '{}{} - PEDESTAL {}'.format(tname, SUFIJO_ARMADURAS, tipo)
    # bbox_barras_pedestal (mas ajustado, mide los hosts reales de las barras del
    # pedestal) reemplaza a bb (bbox_con_anidados de el_ped completo, ver comentario en
    # esa funcion) como fuente del crop -- si no se encontro ninguna barra valida, cae
    # de vuelta a bb para no dejar el callout sin crop.
    bb_ajustado = bbox_barras_pedestal(el_ped, pedestales, barras, vplan)
    if bb_ajustado is None:
        bb_ajustado = bb
    callout = None
    if vname in view_ids:
        if recreate:
            doc.Delete(view_ids[vname])
            del view_ids[vname]
        else:
            callout = doc.GetElement(view_ids[vname])
            callouts_saltados += 1
    if callout is None:
        inv = vplan.CropBox.Transform.Inverse
        tr = vplan.CropBox.Transform
        minx = miny = float('inf')
        maxx = maxy = float('-inf')
        for x in (bb_ajustado.Min.X, bb_ajustado.Max.X):
            for y in (bb_ajustado.Min.Y, bb_ajustado.Max.Y):
                for z in (bb_ajustado.Min.Z, bb_ajustado.Max.Z):
                    p = inv.OfPoint(XYZ(x, y, z))
                    if p.X < minx: minx = p.X
                    if p.X > maxx: maxx = p.X
                    if p.Y < miny: miny = p.Y
                    if p.Y > maxy: maxy = p.Y
        margen = margen_mm / 304.8 * escala
        p1 = tr.OfPoint(XYZ(minx - margen, miny - margen, 0.0))
        p2 = tr.OfPoint(XYZ(maxx + margen, maxy + margen, 0.0))
        callout = ViewSection.CreateCallout(doc, vplan.Id, vftype.Id, p1, p2)
        set_name(callout, vname)
        callout.Scale = escala
        callout.DetailLevel = ViewDetailLevel.Fine
        view_ids[vname] = callout.Id
        callouts_creados += 1
        log.append('OK {}: callout de pedestal {} creado.'.format(tname, tipo))
    else:
        # retrofit: recalcular el crop tambien en callouts YA EXISTENTES, creados en
        # una corrida anterior con el bbox viejo (mas ancho en familias combinadas).
        try:
            ajustar_crop_callout(callout, bb_ajustado, margen_mm, escala)
        except Exception as e:
            log.append('ERROR {} ajustando crop del callout de {}: {}'.format(tname, tipo, e))
    aplicar_template(callout, tname, 'callout de ' + tipo, escala, view_template_corte)
    # Far clip propio del callout (Independent + 500 mm). Corre SIEMPRE, tanto en el callout
    # recien creado como en el retrofit de uno existente, para que los callouts de corridas
    # anteriores tambien queden corregidos sin tener que recrearlos.
    ajustar_far_clip_callout(callout, tname, 'callout de ' + tipo)
    try:
        mostrar_armaduras(callout, barras, tname, 'callout de ' + tipo)
    except Exception:
        pass
    try:
        if callout.CropBoxVisible:
            callout.CropBoxVisible = False
    except Exception:
        pass
    limitar_callout_a_pedestal(callout, el_ped, pedestales, barras, tname, tipo, vplan)
    # bbox (mundo) de las barras del pedestal: lo reusa crear_corte_pedestal como crop de la
    # seccion hermana (2026-07-31), para que callout y corte encuadren lo mismo.
    return bb_ajustado

def crear_corte_pedestal(tname, tipo, ai, bb_mundo, barras, escala):
    # CORTE DE PEDESTAL (2026-07-31, pedido de Javier): seccion nueva POR CADA callout de
    # pedestal, "muy parecida a los cortes A/B" pero mostrando SOLO el pedestal - el simbolo
    # de corte se ve exclusivamente en el callout (ver ajustar_marcadores_callout_pedestal y
    # ocultar_marcadores_cruzados). Decisiones tomadas con Javier el 2026-07-31:
    #   - orientacion: la misma del corte A (DetailSectionA), un solo corte por pedestal.
    #   - crop: bbox de las barras del pedestal (el MISMO bb_mundo del callout, asi las dos
    #     vistas encuadran lo mismo) + el margen del callout hacia los 4 lados ("muestran un
    #     poco hacia los lados igual", criterio de los modeladores). Como las barras
    #     verticales del pedestal anclan DENTRO de la zapata, el crop baja lo justo para
    #     mostrar el tope de la zapata - que es donde cierra la cadena del 04.
    #   - escala: la del CALLOUT (IN[8], hoy 1:20), no la de los cortes A/B (25/50): son la
    #     pareja de vistas del pedestal y van juntas en la lamina.
    #   - far clip / template / tipo de seccion / simbolos: identicos a los cortes A/B.
    # El calculo de laminas (02) y la colocacion (03) NO ven esta vista - ver el comentario
    # de SUFIJO_CORTE_PEDESTAL sobre el nombre y las whitelists.
    global created, skipped
    vname = tname + SUFIJO_CORTE_PEDESTAL + tipo
    v = None
    if vname in view_ids:
        if recreate:
            doc.Delete(view_ids[vname])
            del view_ids[vname]
            log.append('{}: corte de pedestal {} anterior eliminado.'.format(tname, tipo))
        else:
            v = doc.GetElement(view_ids[vname])
            log.append('{}: corte de pedestal {} ya existe, se salta.'.format(tname, tipo))
            skipped += 1
    if v is None:
        try:
            v = AssemblyViewUtils.CreateDetailSection(doc, ai.Id, AssemblyDetailViewOrientation.DetailSectionA)
        except Exception as e:
            log.append('ERROR {}: no se pudo crear el corte de pedestal {}: {}'.format(tname, tipo, e))
            return None
        set_name(v, vname)
        v.Scale = escala
        v.DetailLevel = ViewDetailLevel.Coarse
        view_ids[vname] = v.Id
        created += 1
        log.append('OK {}: corte de pedestal {} creado.'.format(tname, tipo))
    if v is None:
        return None
    try:
        if not v.CropBoxActive:
            v.CropBoxActive = True
        if v.CropBoxVisible:
            v.CropBoxVisible = False
    except Exception:
        pass
    # crop al pedestal: ajustar_crop_callout reproyecta un bbox de MUNDO al sistema local
    # del CropBox de cualquier vista, tambien sirve para una seccion. Corre SIEMPRE (tambien
    # en el retrofit de un corte existente), mismo criterio que el crop del callout.
    if bb_mundo is not None:
        try:
            ajustar_crop_callout(v, bb_mundo, callout_margin_mm, escala)
        except Exception as e:
            log.append('ERROR {} ajustando crop del corte de pedestal {}: {}'.format(tname, tipo, e))
    etiqueta = 'corte de pedestal ' + tipo
    orientar_burbuja_corte(v, tname, etiqueta)
    # Far clip 300 (el de cortes) pero con la secuencia Independent-primero de los Detail
    # Views (2026-07-31): con ajustar_far_clip_corte a secas quedaba en 500 -- este corte es
    # un Detail View como el callout, y en "Same as parent view" el offset no se guarda.
    ajustar_far_clip_callout(v, tname, etiqueta, far_clip_margin_corte)
    aplicar_template(v, tname, etiqueta, escala, view_template_corte)
    mostrar_armaduras(v, barras, tname, etiqueta)
    preparar_vista_armadura(v, tname, etiqueta)
    ocultar_simbolos_corte(v, tname, etiqueta)
    if sec_type is not None and v.GetTypeId() != sec_type.Id:
        try:
            v.ChangeTypeId(sec_type.Id)
        except Exception:
            pass
    return v

def ajustar_marcadores_callout_pedestal(tname):
    # Mitad "en el callout" de la visibilidad del marcador del CORTE DE PEDESTAL
    # (2026-07-31, Javier: el simbolo se ve SOLO en su callout). En cada callout de
    # pedestal: (a) se activa la categoria Sections - el template puede traerla oculta,
    # mismo problema que la planta, ver mostrar_categoria_secciones -; (b) se oculta ahi
    # cualquier OTRO marcador de seccion que cruce el pedestal: los cortes A/B del assembly
    # (los de ARMADURA y los de FORMAS) y los cortes de pedestal de OTROS tipos. La otra
    # mitad (ocultar el marcador nuevo en las dos plantas) vive en
    # ocultar_marcadores_cruzados.
    doc.Regenerate()
    pref_callout = tname + SUFIJO_ARMADURAS + ' - PEDESTAL '
    pref_corte_ped = tname + SUFIJO_CORTE_PEDESTAL
    ocultables = (tname + SUFIJO_CORTE, tname + SUFIJO_CORTE_B,
                  tname + ' - CORTE A', tname + ' - CORTE B')
    for vname in sorted(view_ids.keys()):
        if not vname.startswith(pref_callout):
            continue
        callout = doc.GetElement(view_ids[vname])
        if not isinstance(callout, View):
            continue
        tipo = vname[len(pref_callout):]
        mostrar_categoria_secciones(callout, tname, 'callout de ' + tipo)
        propio = pref_corte_ped + tipo
        for ve in FilteredElementCollector(doc).OfCategory(BuiltInCategory.OST_Viewers):
            nom = elem_name(ve)
            if nom == propio:
                continue
            if nom in ocultables or nom.startswith(pref_corte_ped):
                ocultar_marcador_en(callout, ve, nom, 'el callout de ' + tipo, tname)

callouts_creados = 0
callouts_saltados = 0
created = 0
skipped = 0
TransactionManager.Instance.EnsureInTransaction(doc)
try:
    for tname in targets:
        insts = by_type[tname]
        ai = insts[0]
        try:
            size = local_size(ai)
            scale = 50 if size is not None and (size[0] > 2.0 or size[1] > 2.0) else 25
            barras_ai = armaduras_del_assembly(ai)
            pedestales_ai = pedestales_del_assembly(ai)
            
            # 1. PLANTA FORMAS (Original sin sufijo)
            vplan_formas = None
            if tname in view_ids:
                vplan_formas = doc.GetElement(view_ids[tname])
                log.append('{}: planta formas ya existe.'.format(tname))
            else:
                vplan_formas = AssemblyViewUtils.CreateDetailSection(doc, ai.Id, AssemblyDetailViewOrientation.HorizontalDetail)
                set_name(vplan_formas, tname)
                vplan_formas.Scale = scale
                vplan_formas.DetailLevel = ViewDetailLevel.Fine
                view_ids[tname] = vplan_formas.Id
                created += 1
                log.append('OK {}: planta formas creada.'.format(tname))
                
            if vplan_formas is not None:
                if not vplan_formas.CropBoxActive:
                    vplan_formas.CropBoxActive = True
                ajustar_corte_planta(vplan_formas, ai, tname)
                ajustar_crop_planta(vplan_formas, ai, tname)

            # 2. PLANTA ARMADURAS (Duplicado)
            vplan_arm = None
            vname_arm = tname + SUFIJO_ARMADURAS
            if vname_arm in view_ids:
                if recreate:
                    doc.Delete(view_ids[vname_arm])
                    del view_ids[vname_arm]
                    log.append('{}: planta armaduras anterior eliminada para recrear.'.format(tname))
                    # Duplicar planta formas original
                    new_id = vplan_formas.Duplicate(ViewDuplicateOption.Duplicate)
                    vplan_arm = doc.GetElement(new_id)
                    set_name(vplan_arm, vname_arm)
                    view_ids[vname_arm] = vplan_arm.Id
                    created += 1
                    log.append('OK {}: planta armaduras creada (por duplicado).'.format(tname))
                else:
                    vplan_arm = doc.GetElement(view_ids[vname_arm])
                    log.append('{}: planta armaduras ya existe, se salta.'.format(tname))
                    skipped += 1
            else:
                # Duplicar planta formas original
                new_id = vplan_formas.Duplicate(ViewDuplicateOption.Duplicate)
                vplan_arm = doc.GetElement(new_id)
                set_name(vplan_arm, vname_arm)
                view_ids[vname_arm] = vplan_arm.Id
                created += 1
                log.append('OK {}: planta armaduras creada (por duplicado).'.format(tname))
                
            if vplan_arm is not None:
                if not vplan_arm.CropBoxActive:
                    vplan_arm.CropBoxActive = True
                ajustar_corte_planta(vplan_arm, ai, tname, cortar=True, altura_corte=altura_corte_zapata)
                ajustar_crop_planta(vplan_arm, ai, tname)
                ajustar_titulo_planta(vplan_arm, tname)
                set_cantidad(vplan_arm, len(insts), tname)
                aplicar_template(vplan_arm, tname, 'planta armaduras', scale, view_template_planta)
                barras_planta = ocultar_barras_pedestal(vplan_arm, barras_ai, tname, 'planta armaduras', pedestales_ai)
                barras_planta = ocultar_barras_viga(vplan_arm, barras_planta, tname, 'planta armaduras')
                mostrar_armaduras(vplan_arm, barras_planta, tname, 'planta armaduras')
                mostrar_primera_ultima(vplan_arm, barras_planta, tname, 'planta armaduras')
                preparar_vista_armadura(vplan_arm, tname, 'planta armaduras')
                mostrar_categoria_callouts(vplan_arm, tname, 'planta armaduras')
                mostrar_categoria_secciones(vplan_arm, tname, 'planta armaduras')

            # 3. CORTES (A y B)
            jobs_cortes = (
                (tname + SUFIJO_CORTE, AssemblyDetailViewOrientation.DetailSectionA, 'corte A'),
                (tname + SUFIJO_CORTE_B, AssemblyDetailViewOrientation.DetailSectionB, 'corte B')
            )
            for vname_corte, orient, label in jobs_cortes:
                v_corte = None
                if vname_corte in view_ids:
                    if recreate:
                        doc.Delete(view_ids[vname_corte])
                        del view_ids[vname_corte]
                        log.append('{}: {} anterior eliminada.'.format(tname, label))
                    else:
                        log.append('{}: {} ya existe, se salta.'.format(tname, label))
                        skipped += 1
                        v_corte = doc.GetElement(view_ids[vname_corte])
                if v_corte is None:
                    v_corte = AssemblyViewUtils.CreateDetailSection(doc, ai.Id, orient)
                    set_name(v_corte, vname_corte)
                    v_corte.Scale = scale
                    v_corte.DetailLevel = ViewDetailLevel.Coarse
                    view_ids[vname_corte] = v_corte.Id
                    created += 1
                    log.append('OK {}: {} creada.'.format(tname, label))
                
                if v_corte is not None:
                    if not v_corte.CropBoxActive:
                        v_corte.CropBoxActive = True
                    if v_corte.CropBoxVisible:
                        v_corte.CropBoxVisible = False
                    orientar_burbuja_corte(v_corte, tname, label)
                    ajustar_crop_corte(v_corte, ai, tname, label)
                    ajustar_far_clip_corte(v_corte, ai, tname, label)
                    aplicar_template(v_corte, tname, label, scale, view_template_corte)
                    mostrar_armaduras(v_corte, barras_ai, tname, label)
                    preparar_vista_armadura(v_corte, tname, label)
                    ocultar_simbolos_corte(v_corte, tname, label)
                    if sec_type is not None and v_corte.GetTypeId() != sec_type.Id:
                        try:
                            v_corte.ChangeTypeId(sec_type.Id)
                        except Exception:
                            pass

            # 4. CALLOUTS PEDESTALES
            if vplan_arm is not None and vftype_detail is not None:
                try:
                    grupos = tipos_pedestal(ai)
                except Exception:
                    grupos = {}
                if grupos:
                    for tipo in sorted(grupos):
                        elegido = elemento_mas_a_la_derecha(vplan_arm, grupos[tipo])
                        if elegido is not None:
                            el_ped, bb_ped = elegido
                            bb_barras_ped = crear_callout_pedestal(vplan_arm, tname, tipo, bb_ped, vftype_detail, callout_scale, callout_margin_mm, barras_ai, el_ped, pedestales_ai)
                            # CORTE DE PEDESTAL (2026-07-31): la seccion hermana del
                            # callout, con el mismo bbox de barras como crop.
                            try:
                                crear_corte_pedestal(tname, tipo, ai,
                                                     bb_barras_ped if bb_barras_ped is not None else bb_ped,
                                                     barras_ai, callout_scale)
                            except Exception as e:
                                log.append('ERROR {} corte de pedestal {}: {}'.format(tname, tipo, e))

            # 5. CRUZAR MARCADORES (OCULTARLOS)
            if vplan_arm is not None:
                try:
                    ocultar_marcadores_cruzados(tname, vplan_arm)
                except Exception:
                    pass
                # marcador del corte de pedestal visible SOLO en su callout (2026-07-31)
                try:
                    ajustar_marcadores_callout_pedestal(tname)
                except Exception as e:
                    log.append('ERROR {} marcadores de callout de pedestal: {}'.format(tname, e))

        except Exception as e:
            log.append('ERROR {}: {}'.format(tname, e))
finally:
    TransactionManager.Instance.TransactionTaskDone()

log.insert(0, 'Assemblies procesados: {} | vistas creadas: {} | saltadas: {} | callouts creados: {} | callouts saltados: {}'.format(len(targets), created, skipped, callouts_creados, callouts_saltados))
OUT = log
# ----------------------------------------
log = Watch(py_crear_planta_corte_por)  # graph output
