# Dynamo graph 02_Calcular y crear laminas.dyn (Dynamo 4.0.2.3852)
# PASO 3 de 6 - Cuenta las vistas de assembly que aun no estan colocadas, calcula cuantas laminas hacen falta y las crea numeradas. Requiere el paso 2 (vistas).

viã_eta_title_block_â_elegir_del = FamilyTypes("BIOS_E_VINE_A1_NOVANDINO:Formato-DETALLE")  # "ViÃ±eta (Title Block) â€” elegir del dropdown"; graph input
numero_del_primer_sheet = StringInput("A1")  # graph input
nombre_del_primer_sheet = StringInput("A1")  # graph input
procesar_todos_los_assemblies = BoolSelector(true)  # graph input
filtro_assemblies_si_todos_false = StringInput("")  # graph input
margen_y_separacion_mm = IntegerSlider(5, range=5..50 step 1)  # graph input
reserva_lado_derecho_mm = IntegerSlider(200, range=0..200 step 5)  # graph input
separacion_entre_vistas_mm = IntegerSlider(10, range=0..60 step 1)  # graph input
py_calcular_y_crear_laminas = Python(IN[0]=viã_eta_title_block_â_elegir_del, IN[1]=numero_del_primer_sheet, IN[2]=nombre_del_primer_sheet, IN[3]=procesar_todos_los_assemblies, IN[4]=filtro_assemblies_si_todos_false, IN[5]=margen_y_separacion_mm, IN[6]=reserva_lado_derecho_mm, IN[7]=separacion_entre_vistas_mm)  # PythonNet3
# ---------- py_calcular_y_crear_laminas.python (369 lines) ----------
# 02_Calcular y crear laminas - calcula cuantas laminas hacen falta para las
# vistas de assembly pendientes y crea esa cantidad, con la numeracion de siempre.
#
# EMPAQUETADO (reescrito 2026-07-23): se mide cada bloque por su CROP + titulo
# (View.CropBox/escala, ajustado al borde por el 01), NO por el contorno con lineas
# de seccion (esas cruzan las vistas vecinas, es normal; medir por ellas daba un
# assembly por pagina). El reparto es por COLUMNAS JUSTIFICADAS: los bloques se
# apilan en columnas verticales, las columnas llenan el ancho de la hoja y dentro de
# cada columna los bloques se reparten parejo para llenar el alto (justificado, sin
# montarse). El slider "Separacion entre vistas (mm)" fija el espacio minimo que
# reclama cada bloque -> cuantas caben por hoja -> cuantas laminas. 02_Colocar usa
# la MISMA medida y el MISMO reparto.
# Revit 2027 / Dynamo 4 / CPython3
# IN[0] = tipo de vineta (dropdown Family Types)
# IN[1] = numero del primer sheet
# IN[2] = nombre del primer sheet
# IN[3] = procesar todos los assemblies (bool)
# IN[4] = filtro de assemblies si IN[3] es False (parcial, comas)
# IN[5] = margen del borde de la lamina (mm) - debe coincidir con 02
# IN[6] = reserva en el lado derecho (mm) - idem, debe coincidir con 02
# IN[7] = separacion entre vistas (mm) - espacio minimo entre bloques; regula
#         cuantas vistas por lamina (mas mm = menos por hoja = mas laminas).
#         DEBE coincidir con 02 para que el calculo y la colocacion cuadren.

import clr
import re
clr.AddReference('RevitAPI')
clr.AddReference('RevitServices')
from Autodesk.Revit.DB import (FilteredElementCollector, AssemblyInstance, ViewSheet,
                               Viewport, View, BuiltInCategory, Element, ElementId, XYZ)
from RevitServices.Persistence import DocumentManager
from RevitServices.Transactions import TransactionManager

doc = DocumentManager.Instance.CurrentDBDocument

tb_type = UnwrapElement(IN[0])
first_number = (IN[1] or '').strip()
first_name = (IN[2] or '').strip()
process_all = bool(IN[3])
filter_text = (IN[4] or '').strip()
margin = float(IN[5]) / 304.8
right_reserve = float(IN[6]) / 304.8
# separacion minima entre bloques (mm -> pies). Regula la densidad: mas separacion
# = menos vistas por hoja = mas laminas. Si el input aun no existe, cae a 10 mm.
try:
    sep = float(IN[7]) / 304.8
except Exception:
    sep = 10.0 / 304.8
if sep < 0:
    sep = 0.0
# separacion REAL dentro de cada bloque (planta -> corte A -> corte B -> callouts):
# margen general + 10 mm fijos, igual que 02.
gap_bloque = margin + 10.0 / 304.8

log = []
SUFIJO_ARMADURAS = ' - ARMADURA'
SUFIJO_CORTE = SUFIJO_ARMADURAS + ' - CORTE A'
SUFIJO_CORTE_B = SUFIJO_ARMADURAS + ' - CORTE B'
SUFIJOS_CORTE = (SUFIJO_CORTE, SUFIJO_CORTE_B)
PREFIJO_PEDESTAL = SUFIJO_ARMADURAS + ' - PEDESTAL '
# CORTES DE PEDESTAL (2026-07-31): los crea el 01 desde cada callout y NO entran al calculo
# de laminas - MANDATORIO (Javier): esas vistas las coloca el modelador a mano, opcionalmente
# fuera de la lamina. Hoy quedan fuera solos (su nombre no empieza con PREFIJO_PEDESTAL, y
# esta recoleccion es una whitelist), pero el filtro explicito de mas abajo protege contra un
# rename futuro del sufijo.
SUFIJO_CORTE_PEDESTAL = SUFIJO_ARMADURAS + ' - CORTE PEDESTAL '

# reserva bajo cada vista para su titulo (planta y cortes/callouts)
label_h_planta = 12.0 / 304.8
label_h_corte = (12.0 + 14.0) / 304.8

def sufijo_corte(nombre):
    for a in SUFIJOS_CORTE:
        if nombre.endswith(a):
            return a
    return None

def es_callout_pedestal(nombre):
    return PREFIJO_PEDESTAL in nombre

def elem_name(e):
    try:
        return e.Name
    except Exception:
        return Element.Name.__get__(e)

def label_h_de(v):
    nombre = elem_name(v)
    return label_h_corte if (sufijo_corte(nombre) or es_callout_pedestal(nombre)) else label_h_planta

def tb_label(t):
    try:
        return '{} : {}'.format(t.FamilyName, elem_name(t))
    except Exception:
        return 'Id ' + str(t.Id)

def list_titleblocks():
    col = (FilteredElementCollector(doc)
           .OfCategory(BuiltInCategory.OST_TitleBlocks)
           .WhereElementIsElementType())
    return list(col)

def paper_size(v):
    # tamano en papel (pies) = crop del modelo / escala (crop ya ajustado por 00)
    cb = v.CropBox
    s = v.Scale if v.Scale > 0 else 1
    return ((cb.Max.X - cb.Min.X) / s, (cb.Max.Y - cb.Min.Y) / s)

def dims_bloque(grupo):
    # bloque vertical: planta arriba, cortes/callouts abajo. Ancho = crop mas ancho;
    # alto = suma de (crop + titulo) + gap_bloque entre vistas.
    ws = []
    hs = []
    for v in grupo:
        w, h = paper_size(v)
        ws.append(w)
        hs.append(h + label_h_de(v))
    bw = max(ws)
    bh = sum(hs) + gap_bloque * (len(grupo) - 1)
    return bw, bh

def usable_rect(sheet):
    # area util = bbox de la vineta menos margenes (y reserva derecha)
    col = FilteredElementCollector(doc, sheet.Id).OfCategory(BuiltInCategory.OST_TitleBlocks)
    tb = col.FirstElement()
    if tb is not None:
        bb = tb.get_BoundingBox(sheet)
        if bb is not None:
            return (bb.Min.X + margin, bb.Min.Y + margin,
                    bb.Max.X - margin - right_reserve, bb.Max.Y - margin)
    o = sheet.Outline
    return (o.Min.U + margin, o.Min.V + margin,
            o.Max.U - margin - right_reserve, o.Max.V - margin)

# ---------------- reparto por COLUMNAS JUSTIFICADAS ----------------
# Los bloques (en orden por nombre) se apilan en columnas verticales; cuando una
# columna se llena en alto, empieza otra a la derecha; cuando no cabe otra columna
# en el ancho, empieza otra lamina. Despues cada lamina se JUSTIFICA: las columnas
# se separan parejo para llenar el ancho y, dentro de cada columna, los bloques se
# separan parejo para llenar el alto (nunca se montan; la separacion resultante
# siempre es >= sep). Mantiene el orden por nombre entre y dentro de las laminas.
EPS = 1e-9

def pack_columns(dims, W, H):
    # dims: lista de (bw, bh) en orden. Devuelve lista de paginas; cada pagina es
    # lista de columnas; cada columna es lista de indices de bloque.
    pages = []
    page = []
    page_w = 0.0
    col = []
    col_h = 0.0
    col_w = 0.0

    for idx in range(len(dims)):
        bw, bh = dims[idx]
        if col and (col_h + sep + bh) > H + EPS:
            # cerrar columna actual
            w_need = (sep if page else 0.0) + col_w
            if page and (page_w + w_need) > W + EPS:
                pages.append(page)
                page = []
                page_w = 0.0
                w_need = col_w
            page.append(col)
            page_w += w_need
            col = []
            col_h = 0.0
            col_w = 0.0
        # agregar bloque a la columna actual
        if col:
            col_h += sep + bh
        else:
            col_h = bh
        col.append(idx)
        if bw > col_w:
            col_w = bw
    if col:
        w_need = (sep if page else 0.0) + col_w
        if page and (page_w + w_need) > W + EPS:
            pages.append(page)
            page = []
            w_need = col_w
        page.append(col)
    if page:
        pages.append(page)
    return pages

def layout(dims, x0, y0, x1, y1):
    # devuelve (asign, n_paginas, avisos) donde asign[i] = (pagina, cx, by_top)
    W = x1 - x0
    H = y1 - y0
    pages = pack_columns(dims, W, H)
    asign = [None] * len(dims)
    avisos = []
    for i, (bw, bh) in enumerate(dims):
        if bw > W + EPS or bh > H + EPS:
            avisos.append(i)
    for pi, page in enumerate(pages):
        ncols = len(page)
        widths = [max(dims[i][0] for i in colm) for colm in page]
        sum_w = sum(widths)
        gap_x = 0.0 if ncols <= 1 else (W - sum_w) / (ncols - 1)
        if gap_x < 0:
            gap_x = 0.0
        # centro x de cada columna
        cx_col = []
        if ncols == 1:
            left = x0 + max(0.0, (W - widths[0]) / 2.0)
            cx_col.append(left + widths[0] / 2.0)
        else:
            x = x0
            for w in widths:
                cx_col.append(x + w / 2.0)
                x += w + gap_x
        for ci, colm in enumerate(page):
            heights = [dims[i][1] for i in colm]
            sum_h = sum(heights)
            n = len(colm)
            if n == 1:
                top = y1 - max(0.0, (H - heights[0]) / 2.0)
                asign[colm[0]] = (pi, cx_col[ci], top)
            else:
                gap_y = (H - sum_h) / (n - 1)
                if gap_y < 0:
                    gap_y = 0.0
                y = y1
                for k, i in enumerate(colm):
                    asign[i] = (pi, cx_col[ci], y)
                    y -= heights[k] + gap_y
    return asign, len(pages), avisos

def bump(text, steps):
    last = None
    for m in re.finditer('\\d+', text):
        last = m
    if last is None:
        return '{} {:02d}'.format(text, steps + 1)
    width = len(last.group(0))
    val = int(last.group(0)) + steps
    return text[:last.start()] + str(val).zfill(width) + text[last.end():]

# --- validar la vineta seleccionada ---
tb_cat_id = ElementId(BuiltInCategory.OST_TitleBlocks)
is_tb = (tb_type is not None
         and tb_type.Category is not None
         and tb_type.Category.Id == tb_cat_id)

if not is_tb:
    log.append('ERROR: el tipo seleccionado en el dropdown NO es una vineta (Title Block).')
    log.append('Selecciona una de estas vinetas cargadas en el proyecto:')
    tbs = list_titleblocks()
    if not tbs:
        log.append('  (no hay vinetas cargadas en el proyecto)')
    for t in tbs:
        log.append('  - ' + tb_label(t))
    OUT = log
else:
    by_type = {}
    for ai in FilteredElementCollector(doc).OfClass(AssemblyInstance):
        by_type.setdefault(ai.AssemblyTypeName, []).append(ai)

    names = sorted(by_type.keys())
    if not process_all:
        tokens = [t.strip().lower() for t in filter_text.split(',') if t.strip()]
        if tokens:
            names = [n for n in names if any(tok in n.lower() for tok in tokens)]
        else:
            names = []
            log.append('ERROR: \"Todos\" esta en False y el filtro esta vacio.')

    view_by_name = {}
    for v in FilteredElementCollector(doc).OfClass(View):
        if not v.IsTemplate:
            view_by_name[elem_name(v)] = v

    placed_ids = set()
    for vp in FilteredElementCollector(doc).OfClass(Viewport):
        placed_ids.add(vp.ViewId.Value)

    bloques = []
    for n in names:
        grupo = []
        for vname in (n + SUFIJO_ARMADURAS, n + SUFIJO_CORTE, n + SUFIJO_CORTE_B):
            v = view_by_name.get(vname)
            if v is None:
                log.append('AVISO: no existe la vista \"{}\" (corre 01_Vistas de assembly).'.format(vname))
            elif v.Id.Value in placed_ids:
                pass  # ya colocada en una lamina, no cuenta como pendiente
            else:
                grupo.append(v)
        prefijo_ped = n + PREFIJO_PEDESTAL
        # el 'and not in' excluye los CORTES DE PEDESTAL, ver SUFIJO_CORTE_PEDESTAL arriba
        for vname_ped in sorted(nm for nm in view_by_name
                                if nm.startswith(prefijo_ped) and SUFIJO_CORTE_PEDESTAL not in nm):
            v_ped = view_by_name[vname_ped]
            if v_ped.Id.Value not in placed_ids:
                grupo.append(v_ped)
        if grupo:
            bloques.append(grupo)

    if not bloques:
        log.append('No hay vistas pendientes de colocar; no se creo ninguna lamina.')
        OUT = log
    else:
        created = 0
        sheets_needed = 0
        TransactionManager.Instance.EnsureInTransaction(doc)
        try:
            if hasattr(tb_type, 'IsActive') and not tb_type.IsActive:
                tb_type.Activate()

            # --- lamina de prueba solo para medir el area util de la vineta ---
            probe = ViewSheet.Create(doc, tb_type.Id)
            doc.Regenerate()
            x0, y0, x1, y1 = usable_rect(probe)
            doc.Delete(probe.Id)

            dims_bloques = [dims_bloque(g) for g in bloques]
            asign, sheets_needed, avisos = layout(dims_bloques, x0, y0, x1, y1)
            for idx in avisos:
                bw, bh = dims_bloques[idx]
                log.append('AVISO: \"{}\" ({:.0f} x {:.0f} mm en papel) es mas grande que el area util de una lamina.'.format(
                    elem_name(bloques[idx][0]), bw * 304.8, bh * 304.8))

            # --- crear esa cantidad de laminas, con la numeracion de siempre ---
            if not first_number:
                first_number = 'A-001'
                log.append('AVISO: numero inicial vacio, se usa A-001.')
            if not first_name:
                first_name = 'SIN NOMBRE 01'
                log.append('AVISO: nombre inicial vacio, se usa SIN NOMBRE 01.')

            existing = set()
            for vs in FilteredElementCollector(doc).OfClass(ViewSheet):
                existing.add(vs.SheetNumber)

            plan = []
            produced = 0
            offset = 0
            while produced < sheets_needed and offset < sheets_needed + 1000:
                num = first_number if offset == 0 else bump(first_number, offset)
                offset += 1
                if num in existing:
                    log.append('AVISO: el numero {} ya existe en el proyecto, se salta.'.format(num))
                    continue
                name = first_name if produced == 0 else bump(first_name, produced)
                plan.append((num, name))
                existing.add(num)
                produced += 1

            for num, name in plan:
                try:
                    sheet = ViewSheet.Create(doc, tb_type.Id)
                    sheet.SheetNumber = num
                    try:
                        sheet.Name = name
                    except Exception:
                        Element.Name.__set__(sheet, name)
                    created += 1
                    log.append('OK: {}  |  {}'.format(num, name))
                except Exception as e:
                    log.append('ERROR creando {}: {}'.format(num, e))
        finally:
            TransactionManager.Instance.TransactionTaskDone()

        log.insert(0, 'Vineta usada: ' + tb_label(tb_type))
        log.insert(1, 'Laminas necesarias calculadas: {} | creadas: {} (columnas justificadas)'.format(sheets_needed, created))
        log.append('Listo. Ahora corre 03_Colocar vistas en laminas para distribuir las vistas en estas laminas.')
        OUT = log
# ----------------------------------------
log = Watch(py_calcular_y_crear_laminas)  # graph output
