# Dynamo graph 02_Colocar vistas en laminas.dyn (Dynamo 4.0.2.3852)
# Coloca las vistas de assembly en los sheets destino: por cada assembly, planta arriba y corte abajo centrados en el mismo eje vertical; los bloques se reparten en grilla y pasan al siguiente sheet cuando uno se llena. Si el tipo de viewport con titulo no existe todavia en el proyecto, lo crea (duplicando uno existente, con Show Title y familia de View Title configuradas).

sheets_destino_numeros_con_coma = StringInput("test")  # "Sheets destino (numeros con coma, o prefijo)"; graph input
procesar_todos_los_assemblies = BoolSelector(true)  # graph input
filtro_assemblies_si_todos_false = StringInput("")  # graph input
margen_y_separacion_mm = IntegerSlider(5, range=5..50 step 1)  # graph input
reserva_lado_derecho_mm = IntegerSlider(200, range=0..200 step 5)  # graph input
tipo_de_viewport_para_plantas = StringInput("C_Titulo_General")  # graph input
tipo_de_viewport_para_cortes = StringInput("C_Titulo_Seccion")  # graph input
separacion_titulo_cortes_mm = IntegerSlider(19, range=5..40 step 1)  # graph input
py_colocar_viewports_en_grilla = Python(IN[0]=sheets_destino_numeros_con_coma, IN[1]=procesar_todos_los_assemblies, IN[2]=filtro_assemblies_si_todos_false, IN[3]=margen_y_separacion_mm, IN[4]=reserva_lado_derecho_mm, IN[5]=tipo_de_viewport_para_plantas, IN[6]=tipo_de_viewport_para_cortes, IN[7]=separacion_titulo_cortes_mm)  # PythonNet3
# ---------- py_colocar_viewports_en_grilla.python (655 lines) ----------
# 02_Colocar vistas en laminas - Por assembly: planta arriba + corte abajo (mismo eje),
# bloques repartidos en grilla por los sheets destino. Si el tipo de viewport
# con titulo no existe en el proyecto, lo crea (bootstrap: duplica uno existente,
# activa Show Title y asigna la familia de View Title).
#
# Leyendas (2026-07-10): ademas coloca, en la esquina INFERIOR DERECHA del area util
# de cada sheet destino (empacadas de derecha a izquierda y de abajo hacia arriba -
# direccion opuesta a la grilla principal de planta+cortes), las vistas de tipo
# Legend cuyo NOMBRE coincida exactamente (sin distinguir mayusculas) con el nombre
# de TIPO DE FAMILIA (Symbol.Name, ej. "G35" - NO el nombre de la familia, ej.
# "C-CapaCimiento") de algun miembro - a cualquier profundidad de anidamiento,
# cualquier categoria - de los assemblies YA COLOCADOS en ese sheet (sea de esta
# corrida o de una anterior). Si el mismo tipo aparece en varios assemblies del mismo
# sheet, su leyenda se coloca UNA sola vez. A diferencia de las vistas de planta/corte
# (que solo pueden estar en UN sheet), una Legend SI puede estar en varios sheets a la
# vez, asi que la idempotencia se chequea POR SHEET (no globalmente): se salta si ESE
# sheet ya tiene esa leyenda, aunque este puesta en otros sheets.
#
# Revit 2027 / Dynamo 4 / CPython3
# IN[0] = sheets destino: numeros separados por coma, o un prefijo comun
# IN[1] = procesar todos los assemblies (bool)
# IN[2] = filtro de assemblies si IN[1] es False (parcial, comas)
# IN[3] = margen y separacion entre vistas (mm)
# IN[4] = reserva en el lado derecho del sheet (mm), p/ cajetin lateral de la viñeta
# IN[5] = tipo de viewport para las PLANTAS (vacio = tipo por defecto)
# IN[6] = tipo de viewport para los CORTES (vacio = tipo por defecto)

import clr
clr.AddReference('RevitAPI')
clr.AddReference('RevitServices')
from Autodesk.Revit.DB import (FilteredElementCollector, AssemblyInstance, ViewSheet,
                               Viewport, View, ViewType, BuiltInCategory, XYZ, Element,
                               ElementType, BuiltInParameter, FamilySymbol, FamilyInstance,
                               ViewDuplicateOption, StorageType)
from RevitServices.Persistence import DocumentManager
from RevitServices.Transactions import TransactionManager

doc = DocumentManager.Instance.CurrentDBDocument

sheets_text = (IN[0] or '').strip()
process_all = bool(IN[1])
filter_text = (IN[2] or '').strip()
margin = float(IN[3]) / 304.8
right_reserve = float(IN[4]) / 304.8
vp_type_text = (IN[5] or '').strip()
vp_type_text_sec = (IN[6] or '').strip()
label_h_planta = 12.0 / 304.8  # reserva bajo la planta para su titulo
# los cortes muestran spot elevations por debajo del borde (04, annotation crop
# desactivado); sin este extra el titulo queda montado sobre esas anotaciones
gap_corte = float(IN[7]) / 304.8  # slider: distancia del titulo bajo el borde del corte
label_h_corte = gap_corte + 7.0 / 304.8  # misma relacion que la planta: label_h = gap + 7 mm de alto de texto
gap_planta = 5.0 / 304.8
# el margen general (input, min 5 mm) queda muy angosto ENTRE planta y cortes: ambos tienen el crop ajustado al borde del assembly, sin aire extra entre medio. gap_bloque suma 10 mm fijos solo para la separacion DENTRO del bloque (planta -> corte A -> corte B); no toca margenes del sheet, grilla entre bloques ni leyendas.
gap_bloque = margin + 10.0 / 304.8

log = []
# contrato de nombres de la rutina de ARMADURAS (ver 00): planta 'FN-1001 -
# ARMADURA', cortes 'FN-1001 - ARMADURA - CORTE A/B'. Este graph solo coloca
# vistas de ARMADURAS; las de Formas (FN-1001 a secas) nunca matchean.
SUFIJO_ARMADURAS = ' - ARMADURA'
SUFIJO_CORTE = SUFIJO_ARMADURAS + ' - CORTE A'
SUFIJO_CORTE_B = SUFIJO_ARMADURAS + ' - CORTE B'
SUFIJOS_CORTE = (SUFIJO_CORTE, SUFIJO_CORTE_B)
# callouts de pedestal (00): 'FN-1001 - ARMADURA - PEDESTAL PD-1003'. Cantidad variable
# por assembly (0, 1 o mas segun cuantos TIPOS de C-Pedestal tenga) - se agregan al
# bloque despues de los cortes, mismo eje vertical (2026-07-21, pedido de Javier: antes
# 00 los creaba pero nunca se colocaban en laminas).
PREFIJO_PEDESTAL = SUFIJO_ARMADURAS + ' - PEDESTAL '

def sufijo_corte(nombre):
    for a in SUFIJOS_CORTE:
        if nombre.endswith(a):
            return a
    return None

def es_callout_pedestal(nombre):
    return PREFIJO_PEDESTAL in nombre

def elem_name(e):
    try:
        return e.Name
    except Exception:
        return Element.Name.__get__(e)

# --- tipos de viewport (plantas y cortes) ---
vp_types = [t for t in FilteredElementCollector(doc).OfClass(ElementType)
            if t.FamilyName == 'Viewport']

def crear_tipo_viewport(nombre):
    # bootstrap: el tipo no existe todavia en el proyecto -> se crea duplicando
    # uno existente y se configura para que muestre titulo (Show Title + familia
    # de View Title). Asi el graph queda autosuficiente en un proyecto nuevo.
    base = vp_types[0]
    nuevo = base.Duplicate(nombre)
    vp_types.append(nuevo)
    log.append('Tipo de viewport {} creado (duplicado de {}).'.format(nombre, elem_name(base)))
    p = nuevo.get_Parameter(BuiltInParameter.VIEWPORT_ATTR_SHOW_LABEL)
    if p is not None and not p.IsReadOnly and p.AsInteger() != 1:
        p.Set(1)
    pt = nuevo.get_Parameter(BuiltInParameter.VIEWPORT_ATTR_LABEL_TAG)
    if pt is not None and (pt.AsElementId() is None or pt.AsElementId().Value < 0):
        labels = list(FilteredElementCollector(doc).OfClass(FamilySymbol)
                      .OfCategory(BuiltInCategory.OST_ViewportLabel))
        if labels:
            pt.Set(labels[0].Id)
        else:
            log.append('AVISO: no hay ninguna familia View Title cargada en el proyecto; el tipo {} mostrara la linea pero no el texto.'.format(nombre))
            log.append('Carga una (Insertar > Cargar familia > Anotaciones > titulo de vista) y re-corre.')
    return nuevo

def buscar_tipo_viewport(texto, uso):
    if not texto:
        return None
    low = texto.lower()
    for t in vp_types:
        if elem_name(t).lower() == low:
            return t
    cands = [t for t in vp_types if low in elem_name(t).lower()]
    if len(cands) == 1:
        return cands[0]
    if len(cands) > 1:
        log.append('AVISO: hay {} tipos de viewport que coinciden parcialmente con \"{}\" (para {}); se usa el tipo por defecto.'.format(len(cands), texto, uso))
        log.append('Tipos disponibles: ' + ', '.join(sorted(elem_name(t) for t in vp_types)))
        return None
    # ningun tipo coincide, ni exacto ni parcial: se crea desde cero
    return crear_tipo_viewport(texto)

# vp_type y vp_type_sec se resuelven mas abajo, DENTRO de la transaccion (crear
# un tipo nuevo via Duplicate requiere una transaccion activa).
vp_type = None
vp_type_sec = None

# --- sheets destino, ordenados por numero ---
all_sheets = {}
for s in FilteredElementCollector(doc).OfClass(ViewSheet):
    all_sheets[s.SheetNumber] = s

target_sheets = []
seen = set()
for tok in [t.strip() for t in sheets_text.split(',') if t.strip()]:
    if tok in all_sheets:
        matches = [all_sheets[tok]]
    else:
        matches = [s for n, s in all_sheets.items() if n.startswith(tok)]
    for s in matches:
        if s.SheetNumber not in seen:
            seen.add(s.SheetNumber)
            target_sheets.append(s)
target_sheets.sort(key=lambda s: s.SheetNumber)

if not target_sheets:
    log.append('ERROR: ningun sheet coincide con \"{}\".'.format(sheets_text))
    log.append('Sheets del proyecto: ' + ', '.join(sorted(all_sheets.keys())[:30]))
    OUT = log
else:
    # --- vistas a colocar, en orden por assembly: planta y luego corte ---
    # by_type: TODOS los tipos de assembly del proyecto (no solo los del filtro de
    # esta corrida) - hace falta para las leyendas, que deben matchear tambien
    # assemblies colocados por corridas anteriores con un filtro distinto.
    by_type = {}
    for ai in FilteredElementCollector(doc).OfClass(AssemblyInstance):
        by_type.setdefault(ai.AssemblyTypeName, []).append(ai)
    names = sorted(by_type.keys())
    if not process_all:
        tokens = [t.strip().lower() for t in filter_text.split(',') if t.strip()]
        if tokens:
            names = [n for n in names if any(tok in n.lower() for tok in tokens)]
        else:
            names = []
            log.append('ERROR: \"Todos\" esta en False y el filtro esta vacio.')

    view_by_name = {}
    for v in FilteredElementCollector(doc).OfClass(View):
        if not v.IsTemplate:
            view_by_name[elem_name(v)] = v

    placed_ids = set()
    vp_by_view = {}
    for vp in FilteredElementCollector(doc).OfClass(Viewport):
        placed_ids.add(vp.ViewId.Value)
        vp_by_view[vp.ViewId.Value] = vp

    def titulo_corte(v, vp):
        # titulo en lamina del corte = '{assembly} - {numero de detalle}', el mismo
        # numero que muestra el simbolo de corte en la planta. Se usa Title on Sheet
        # para no tocar el nombre interno de la vista (contrato de los otros graphs).
        try:
            num = vp.get_Parameter(BuiltInParameter.VIEWPORT_DETAIL_NUMBER).AsString()
            if not num:
                return
            base = elem_name(v)
            suf = sufijo_corte(base)
            if suf:
                base = base[:-len(suf)]
            p = v.get_Parameter(BuiltInParameter.VIEW_DESCRIPTION)
            if p is not None and not p.IsReadOnly:
                # titulo en lamina con la marca de la rutina: 'FN-1001 - ARMADURA - CORTE A'
                p.Set('{}{} - CORTE {}'.format(base, SUFIJO_ARMADURAS, num))
        except Exception:
            pass

    def letra(idx):
        # 0->A ... 25->Z, 26->AA, 27->AB ... (estilo columnas de Excel)
        s = ''
        n = idx + 1
        while n > 0:
            n, r = divmod(n - 1, 26)
            s = chr(65 + r) + s
        return s

    def asignar_letra(vp, sheet):
        # detail number del corte = siguiente letra libre en ese sheet
        usados = set()
        for vpid in sheet.GetAllViewports():
            ovp = doc.GetElement(vpid)
            try:
                dn = ovp.get_Parameter(BuiltInParameter.VIEWPORT_DETAIL_NUMBER).AsString()
                if dn:
                    usados.add(dn)
            except Exception:
                pass
        i = 0
        while letra(i) in usados:
            i += 1
        try:
            p = vp.get_Parameter(BuiltInParameter.VIEWPORT_DETAIL_NUMBER)
            if p is not None and not p.IsReadOnly:
                p.Set(letra(i))
        except Exception:
            pass

    # bloques por assembly: planta arriba + corte abajo, centrados en el mismo eje
    bloques = []
    retitular = []  # cortes ya colocados a los que actualizar el titulo en lamina
    for n in names:
        grupo = []
        for vname in (n + SUFIJO_ARMADURAS, n + SUFIJO_CORTE, n + SUFIJO_CORTE_B):
            v = view_by_name.get(vname)
            if v is None:
                log.append('AVISO: no existe la vista \"{}\" (corre 00_Vistas de assembly).'.format(vname))
            elif v.Id.Value in placed_ids:
                log.append('AVISO: \"{}\" ya esta en un sheet, se salta.'.format(vname))
                if sufijo_corte(vname) and v.Id.Value in vp_by_view:
                    retitular.append((v, vp_by_view[v.Id.Value]))
            else:
                grupo.append(v)
        prefijo_ped = n + PREFIJO_PEDESTAL
        for vname_ped in sorted(nm for nm in view_by_name if nm.startswith(prefijo_ped)):
            v_ped = view_by_name[vname_ped]
            if v_ped.Id.Value in placed_ids:
                pass
            else:
                grupo.append(v_ped)
        if grupo:
            bloques.append(grupo)

    def usable_rect(sheet):
        # area util = bbox de la viñeta menos margenes (y reserva derecha)
        col = FilteredElementCollector(doc, sheet.Id).OfCategory(BuiltInCategory.OST_TitleBlocks)
        tb = col.FirstElement()
        if tb is not None:
            bb = tb.get_BoundingBox(sheet)
            if bb is not None:
                return (bb.Min.X + margin, bb.Min.Y + margin,
                        bb.Max.X - margin - right_reserve, bb.Max.Y - margin)
        o = sheet.Outline
        return (o.Min.U + margin, o.Min.V + margin,
                o.Max.U - margin - right_reserve, o.Max.V - margin)

    def paper_size(v):
        # tamaño en papel (pies) = crop del modelo / escala
        cb = v.CropBox
        s = v.Scale if v.Scale > 0 else 1
        return ((cb.Max.X - cb.Min.X) / s, (cb.Max.Y - cb.Min.Y) / s)

    def label_h_de(v):
        nombre = elem_name(v)
        return label_h_corte if (sufijo_corte(nombre) or es_callout_pedestal(nombre)) else label_h_planta

    def medidas(grupo):
        # bloque vertical: planta arriba, corte abajo
        ws = []
        hs = []
        for v in grupo:
            w, h = paper_size(v)
            ws.append(w)
            hs.append(h + label_h_de(v))
        bw = max(ws)
        bh = sum(hs) + gap_bloque * (len(grupo) - 1)
        return bw, bh, hs

    def colocar_grupo(grupo, hs, x_izq, y_sup, bw, sheet):
        # coloca las vistas del bloque centradas en el mismo eje vertical. La
        # separacion ENTRE vistas del bloque (planta -> corte A -> corte B) se
        # ajusta con el tamaño REAL ya colocado (Viewport.GetBoxOutline(), que SI
        # incluye anotaciones que sobresalen del CropBox - cotas, spot elevations,
        # el multitag de capa de cimiento - porque el Annotation Crop esta
        # desactivado). paper_size()/View.CropBox solo mide la geometria recortada
        # y subestima el alto real cuando hay overhang, lo que antes hacia que la
        # separacion saliera inconsistente entre assemblies con distinta cantidad
        # de anotaciones fuera del crop.
        cx = x_izq + bw / 2.0
        y = y_sup
        n_ok = 0
        for v, hv in zip(grupo, hs):
            w_v = paper_size(v)[0]
            h_v = hv - label_h_de(v)
            centro = XYZ(cx, y - h_v / 2.0, 0.0)
            try:
                vp = Viewport.Create(doc, sheet.Id, v.Id, centro)
                if vp is None:
                    log.append('ERROR: Revit no permitio colocar \"{}\" en {}.'.format(elem_name(v), sheet.SheetNumber))
                    y -= hv + gap_bloque
                    continue
                es_corte = sufijo_corte(elem_name(v)) is not None
                es_callout = es_callout_pedestal(elem_name(v))
                es_seccional = es_corte or es_callout
                t_apl = vp_type_sec if es_seccional else vp_type
                if t_apl is not None:
                    if vp.GetTypeId() != t_apl.Id:
                        vp.ChangeTypeId(t_apl.Id)
                    try:
                        # titulo alineado bajo el borde inferior izquierdo de la vista;
                        # los cortes y callouts llevan mas separacion (ver gap_corte arriba)
                        gap = gap_corte if es_seccional else gap_planta
                        vp.LabelOffset = XYZ(0.0, -gap, 0.0)
                        vp.LabelLineLength = w_v
                    except Exception:
                        pass
                if es_corte:
                    asignar_letra(vp, sheet)
                    titulo_corte(v, vp)
                # reposicionar segun el tamaño REAL ya colocado: tope en "y",
                # centrado en "cx" (el centro real puede no coincidir exacto con
                # el estimado si hay anotaciones asimetricas fuera del crop)
                ob = vp.GetBoxOutline()
                h_real = ob.MaximumPoint.Y - ob.MinimumPoint.Y
                centro_x_real = (ob.MaximumPoint.X + ob.MinimumPoint.X) / 2.0
                centro_actual = vp.GetBoxCenter()
                dx = cx - centro_x_real
                dy = y - ob.MaximumPoint.Y
                vp.SetBoxCenter(XYZ(centro_actual.X + dx, centro_actual.Y + dy, 0.0))
                n_ok += 1
                log.append('OK: \"{}\" -> sheet {}'.format(elem_name(v), sheet.SheetNumber))
                y -= h_real + gap_bloque
            except Exception as e:
                log.append('ERROR colocando \"{}\": {}'.format(elem_name(v), e))
                y -= hv + gap_bloque
        return n_ok

    def familias_recursivas(ai):
        # nombres de TIPO (Symbol.Name, no Family.Name) de TODOS los miembros del
        # assembly (a cualquier profundidad de anidamiento, cualquier categoria) -
        # para matchear leyendas: las leyendas del usuario llevan el mismo nombre
        # que el TIPO de familia (ej. "G35"), no el de la familia (ej. "C-CapaCimiento").
        vistos = set()
        nombres = set()
        stack = list(ai.GetMemberIds())
        while stack:
            eid = stack.pop()
            if eid.Value in vistos:
                continue
            vistos.add(eid.Value)
            el = doc.GetElement(eid)
            if el is None or not isinstance(el, FamilyInstance):
                continue
            try:
                nombres.add(el.Symbol.Name)
            except Exception:
                pass
            try:
                stack.extend(el.GetSubComponentIds())
            except Exception:
                pass
        return nombres

    legend_by_name = {}
    for v in FilteredElementCollector(doc).OfClass(View):
        if not v.IsTemplate and v.ViewType == ViewType.Legend:
            legend_by_name[elem_name(v).lower()] = v

    def duplicado_leyenda(lv_orig, nombre_base, sheet):
        # una Legend colocada en varios sheets comparte UN solo Cantidad_Inserto
        # (es un parametro de la VISTA): si 07 escribiera la suma de cada lamina
        # en la misma vista, ganaria la ultima procesada y TODAS las laminas
        # mostrarian ese numero (visto 2026-07-13: una lamina cuya tabla sumaba 28
        # mostraba 42, la suma de otra lamina). Por eso cada sheet recibe su
        # PROPIO duplicado de la leyenda, nombrado "{tipo} - {sheet}"; el titulo
        # mostrado en lamina sigue siendo el nombre del tipo via Title on Sheet.
        # 07 reconoce el sufijo y escribe la cantidad de ESA lamina en el
        # duplicado correspondiente.
        dup_name = '{} - {}'.format(nombre_base, sheet.SheetNumber)
        dup = legend_by_name.get(dup_name.lower())
        if dup is not None:
            return dup
        dup = doc.GetElement(lv_orig.Duplicate(ViewDuplicateOption.WithDetailing))
        try:
            dup.Name = dup_name
        except Exception:
            Element.Name.__set__(dup, dup_name)
        p = dup.get_Parameter(BuiltInParameter.VIEW_DESCRIPTION)
        if p is not None and not p.IsReadOnly:
            p.Set(nombre_base)
        # Cantidad_Inserto parte en 0 en el duplicado recien creado: el duplicado
        # hereda el valor de la vista original (posiblemente viejo, de corridas
        # anteriores de 07) y ese numero colgado confunde. Escribir el valor real
        # es responsabilidad EXCLUSIVA de 07 (que siempre lo actualiza al correr).
        pc = dup.LookupParameter('Cantidad_Inserto')
        if pc is not None and not pc.IsReadOnly:
            try:
                if pc.StorageType == StorageType.Integer:
                    pc.Set(0)
                elif pc.StorageType == StorageType.Double:
                    pc.Set(0.0)
                else:
                    pc.Set('0')
            except Exception:
                pass
        legend_by_name[dup_name.lower()] = dup
        return dup

    def assemblies_en_sheet(sheet):
        # tipos de assembly ya colocados en el sheet (de esta corrida o de una
        # anterior), leyendo TODOS sus viewports actuales.
        tipos = set()
        for vpid in sheet.GetAllViewports():
            vp_s = doc.GetElement(vpid)
            v_s = doc.GetElement(vp_s.ViewId)
            if v_s is None:
                continue
            nombre = elem_name(v_s)
            suf = sufijo_corte(nombre)
            base = nombre[:-len(suf)] if suf else nombre
            # la planta de ARMADURAS conserva el sufijo despues del strip de corte
            if base.endswith(SUFIJO_ARMADURAS):
                base = base[:-len(SUFIJO_ARMADURAS)]
            if base in by_type:
                tipos.add(base)
        return tipos

    def colocar_leyendas(sheet, familias_vistas_global):
        # empaca las leyendas que correspondan en la esquina INFERIOR DERECHA del
        # area util, de derecha a izquierda y de abajo hacia arriba (direccion
        # opuesta a la grilla principal de planta+cortes, para no chocar con ella).
        tipos = assemblies_en_sheet(sheet)
        if not tipos:
            return 0
        familias = set()
        for tn in tipos:
            familias |= familias_recursivas(by_type[tn][0])
        familias_vistas_global |= familias
        nombres_match = sorted(n for n in familias if n.lower() in legend_by_name)
        if not nombres_match:
            return 0
        vp_por_vista = {}
        for vpid in sheet.GetAllViewports():
            vp_s2 = doc.GetElement(vpid)
            vp_por_vista[vp_s2.ViewId.Value] = vp_s2
        x0, y0, x1, y1 = usable_rect(sheet)
        cx, cy, row_h = x1, y0, 0.0
        n_ok = 0
        for nombre in nombres_match:
            lv_orig = legend_by_name[nombre.lower()]
            try:
                lv = duplicado_leyenda(lv_orig, nombre, sheet)
            except Exception as e:
                log.append('ERROR duplicando la leyenda \"{}\" para el sheet {}: {}'.format(nombre, sheet.SheetNumber, e))
                continue
            if lv.Id.Value in vp_por_vista:
                continue  # este sheet ya tiene SU duplicado colocado
            # migracion: si el sheet todavia tiene colocada la leyenda ORIGINAL
            # (de una corrida anterior a este esquema de duplicados), se reemplaza
            # por el duplicado manteniendo la posicion.
            centro_previo = None
            vp_viejo = vp_por_vista.get(lv_orig.Id.Value)
            if vp_viejo is not None:
                centro_previo = vp_viejo.GetBoxCenter()
                doc.Delete(vp_viejo.Id)
            try:
                # las leyendas no tienen un CropBox confiable (no muestran geometria
                # de modelo, paper_size()/View.CropBox puede devolver un valor por
                # defecto enorme) - se coloca primero en un punto provisorio y se mide
                # el tamaño REAL ya colocado via GetBoxOutline(), recien ahi se
                # reposiciona con SetBoxCenter a la posicion final correcta.
                vp = Viewport.Create(doc, sheet.Id, lv.Id,
                                     centro_previo if centro_previo is not None else XYZ(cx, cy, 0.0))
                if vp is None:
                    log.append('ERROR: Revit no permitio colocar la leyenda \"{}\" en {}.'.format(elem_name(lv), sheet.SheetNumber))
                    continue
                # el tipo se cambia ANTES de medir el outline: si agrega un titulo,
                # el tamaño real a empacar debe incluirlo.
                if vp_type_leyenda is not None and vp.GetTypeId() != vp_type_leyenda.Id:
                    vp.ChangeTypeId(vp_type_leyenda.Id)
                if centro_previo is not None:
                    # migracion: conserva la posicion del viewport reemplazado, sin
                    # consumir espacio nuevo en el empaquetado de esta corrida
                    vp.SetBoxCenter(centro_previo)
                    n_ok += 1
                    log.append('OK: leyenda \"{}\" migrada a duplicado propio en sheet {}.'.format(nombre, sheet.SheetNumber))
                    continue
                ob = vp.GetBoxOutline()
                w = ob.MaximumPoint.X - ob.MinimumPoint.X
                h = ob.MaximumPoint.Y - ob.MinimumPoint.Y
                if cx < x1 and cx - w < x0:
                    cx = x1
                    cy += row_h + margin
                    row_h = 0.0
                if cy + h > y1:
                    log.append('AVISO: leyenda \"{}\" no cabe en el area util del sheet {}; se coloca igual.'.format(elem_name(lv), sheet.SheetNumber))
                vp.SetBoxCenter(XYZ(cx - w / 2.0, cy + h / 2.0, 0.0))
                n_ok += 1
                log.append('OK: leyenda \"{}\" -> sheet {}'.format(elem_name(lv), sheet.SheetNumber))
            except Exception as e:
                log.append('ERROR colocando la leyenda \"{}\": {}'.format(elem_name(lv), e))
                continue
            cx -= w + margin
            if h > row_h:
                row_h = h
        return n_ok

    # names ya viene ordenado alfabeticamente mas arriba, asi que bloques tambien
    # queda en orden correlativo por nombre de assembly - no se reordena en ningun
    # punto (pedido explicito de Javier: el orden de salida tiene que ser siempre el
    # de los nombres). Ver mas abajo como se maneja un bloque mas alto que un sheet
    # completo sin sacarlo de su lugar en este orden. Debe coincidir con
    # 01_Calcular y crear laminas (mismo criterio, mismo orden) para que la
    # cantidad de laminas calculada ahi siga siendo la que 02 realmente necesita.

    total_vistas = sum(len(g) for g in bloques)
    placed = 0
    overflow = []
    si = 0
    state = None

    TransactionManager.Instance.EnsureInTransaction(doc)
    try:
        vp_type = buscar_tipo_viewport(vp_type_text, 'plantas')
        vp_type_sec = buscar_tipo_viewport(vp_type_text_sec, 'cortes')
        # tipo de viewport para leyendas: fijo (no es input de Player, es un estandar
        # de oficina), reusa la misma busqueda/bootstrap que plantas y cortes.
        vp_type_leyenda = buscar_tipo_viewport('C_Titulo_General', 'leyendas')
        # retrofit: cortes ya colocados -> letra (en orden visual por sheet) + titulo
        def orden_visual(par):
            v_r, vp_r = par
            sh_r = doc.GetElement(vp_r.SheetId)
            c = vp_r.GetBoxCenter()
            return (sh_r.SheetNumber if sh_r is not None else '', -c.Y, c.X)
        retitular.sort(key=orden_visual)
        for v_fix, vp_fix in retitular:
            dn = None
            try:
                dn = vp_fix.get_Parameter(BuiltInParameter.VIEWPORT_DETAIL_NUMBER).AsString()
            except Exception:
                pass
            if not (dn and dn.isalpha()):
                sh_fix = doc.GetElement(vp_fix.SheetId)
                if sh_fix is not None:
                    asignar_letra(vp_fix, sh_fix)
            if vp_type_sec is not None and vp_fix.GetTypeId() != vp_type_sec.Id:
                try:
                    vp_fix.ChangeTypeId(vp_type_sec.Id)
                except Exception:
                    pass
            try:
                # corregir el espaciado del titulo tambien en cortes ya colocados
                vp_fix.LabelOffset = XYZ(0.0, -gap_corte, 0.0)
                vp_fix.LabelLineLength = paper_size(v_fix)[0]
            except Exception:
                pass
            titulo_corte(v_fix, vp_fix)
        if retitular:
            log.append('Letra y titulo actualizados para {} cortes ya colocados.'.format(len(retitular)))
        # Orden correlativo estricto (2026-07-21, pedido explicito de Javier: los
        # assemblies tienen que salir en su orden original, sin reordenar ni
        # saltarse nada). Un assembly con varios pedestales puede seguir siendo mas
        # alto que el area util de un sheet completo (bloque de 5 vistas apiladas);
        # en ese caso YA NO se le reserva un sheet para el solo (eso desperdiciaba
        # el resto del sheet) - se coloca en su posicion normal dentro del orden,
        # comparte sheet con lo que le toque al lado, y se deja que sobrepase el
        # borde inferior sin problema (pedido explicito: "que se salga nomas, no
        # hay problema con eso"). Solo el ANCHO sigue siendo motivo para saltar de
        # fila o de sheet en el caso de estos bloques; el alto deja de serlo.
        for grupo in bloques:
            bw, bh, hs = medidas(grupo)
            done = False
            avisado_imposible = False
            while not done:
                if state is None:
                    while si < len(target_sheets):
                        sh = target_sheets[si]
                        if len(list(sh.GetAllViewports())) > 0:
                            log.append('AVISO: sheet {} ya tiene vistas colocadas, se omite.'.format(sh.SheetNumber))
                            si += 1
                            continue
                        x0, y0, x1, y1 = usable_rect(sh)
                        state = {'sh': sh, 'x0': x0, 'y0': y0, 'x1': x1, 'y1': y1,
                                 'cx': x0, 'cy': y1, 'row_h': 0.0}
                        break
                    if state is None:
                        for v in grupo:
                            overflow.append(elem_name(v))
                        done = True
                        continue
                imposible = bh > (state['y1'] - state['y0'])  # ni un sheet fresco completo lo contiene
                if imposible and not avisado_imposible:
                    log.append('AVISO: "{}" ({:.0f} x {:.0f} mm en papel) es mas alto que el area util de un sheet; se coloca igual y sobrepasa el borde inferior.'.format(
                        elem_name(grupo[0]), bw * 304.8, bh * 304.8))
                    avisado_imposible = True
                if state['cx'] > state['x0'] and state['cx'] + bw > state['x1']:
                    state['cx'] = state['x0']
                    state['cy'] -= state['row_h'] + margin
                    state['row_h'] = 0.0
                no_cabe_alto = (not imposible) and (state['cy'] - bh < state['y0'])
                no_cabe_ancho = state['cx'] + bw > state['x1']
                if no_cabe_alto or no_cabe_ancho:
                    fresh = (state['cx'] == state['x0'] and state['cy'] == state['y1'])
                    if not fresh:
                        si += 1
                        state = None
                        continue
                    if no_cabe_ancho:
                        log.append('AVISO: "{}" ({:.0f} x {:.0f} mm en papel) es mas ancho que el area util del sheet {}; se coloca igual.'.format(
                            elem_name(grupo[0]), bw * 304.8, bh * 304.8, state['sh'].SheetNumber))
                placed += colocar_grupo(grupo, hs, state['cx'], state['cy'], bw, state['sh'])
                state['cx'] += bw + margin
                if bh > state['row_h']:
                    state['row_h'] = bh
                done = True

        # --- leyendas: por cada sheet destino, independiente de si sus assemblies
        # se colocaron en esta corrida o en una anterior ---
        # doc.Regenerate() es necesario aca: los viewports recien colocados arriba
        # (misma transaccion) no aparecen todavia en sheet.GetAllViewports() sin
        # esto, asi que assemblies_en_sheet() los pasaria por alto en la MISMA
        # corrida en que se colocaron.
        doc.Regenerate()
        total_leyendas = 0
        familias_vistas_global = set()
        if not legend_by_name:
            log.append('AVISO: no hay ninguna vista de tipo Legend en el proyecto; no se colocan leyendas.')
        else:
            for sh in target_sheets:
                total_leyendas += colocar_leyendas(sh, familias_vistas_global)
            if total_leyendas == 0:
                log.append('AVISO: ninguna leyenda coincidio por nombre con un tipo de familia de los assemblies.')
                log.append('Leyendas cargadas en el proyecto: ' + (', '.join(sorted(elem_name(v) for v in legend_by_name.values())) if legend_by_name else '(ninguna)'))
                log.append('Nombres de tipo encontrados en los assemblies: ' + (', '.join(sorted(familias_vistas_global)) if familias_vistas_global else '(ninguno - revisa que los sheets ya tengan vistas de assembly colocadas)'))
    finally:
        TransactionManager.Instance.TransactionTaskDone()

    if overflow:
        log.append('SIN ESPACIO para {} vistas: {}'.format(len(overflow), ', '.join(overflow)))
        log.append('Corre 01_Calcular y crear laminas para agregar las que falten y vuelve a correr este graph (lo ya colocado se respeta).')
    log.insert(0, 'Vistas colocadas: {} de {} (planta arriba, corte abajo por assembly) | Leyendas colocadas: {}'.format(placed, total_vistas, total_leyendas))
    OUT = log
# ----------------------------------------
log = Watch(py_colocar_viewports_en_grilla)  # graph output
