# Dynamo graph 03_Colocar vistas en laminas.dyn (Dynamo 4.0.2.3852)
# PASO 4 de 6 - Coloca las vistas en las laminas: por cada assembly, planta arriba y cortes abajo, en columnas justificadas con su titulo. Pasa a la lamina siguiente cuando una se llena. Requiere los pasos 2 y 3.

sheets_destino_numeros_con_coma = StringInput("test")  # "Sheets destino (numeros con coma, o prefijo)"; graph input
procesar_todos_los_assemblies = BoolSelector(true)  # graph input
filtro_assemblies_si_todos_false = StringInput("")  # graph input
margen_y_separacion_mm = IntegerSlider(5, range=5..50 step 1)  # graph input
reserva_lado_derecho_mm = IntegerSlider(200, range=0..200 step 5)  # graph input
tipo_de_viewport_para_plantas = StringInput("C_Titulo_General")  # graph input
tipo_de_viewport_para_cortes = StringInput("C_Titulo_Seccion")  # graph input
separacion_titulo_cortes_mm = IntegerSlider(19, range=5..40 step 1)  # graph input
separacion_entre_vistas_mm = IntegerSlider(10, range=0..60 step 1)  # graph input
py_colocar_viewports_en_grilla = Python(IN[0]=sheets_destino_numeros_con_coma, IN[1]=procesar_todos_los_assemblies, IN[2]=filtro_assemblies_si_todos_false, IN[3]=margen_y_separacion_mm, IN[4]=reserva_lado_derecho_mm, IN[5]=tipo_de_viewport_para_plantas, IN[6]=tipo_de_viewport_para_cortes, IN[7]=separacion_titulo_cortes_mm, IN[8]=separacion_entre_vistas_mm)  # PythonNet3
# ---------- py_colocar_viewports_en_grilla.python (579 lines) ----------
# 03_Colocar vistas en laminas - Por assembly: planta arriba + cortes + callouts
# (mismo eje vertical), bloques repartidos en los sheets destino.
#
# EMPAQUETADO (reescrito 2026-07-23): se mide y se apila por el CROP + titulo
# (View.CropBox/escala, ajustado por el 01), NO por el contorno con lineas de
# seccion (esas cruzan las vistas vecinas, es normal). Reparto por COLUMNAS
# JUSTIFICADAS: los bloques se apilan en columnas verticales, las columnas llenan
# el ancho de la hoja y dentro de cada columna los bloques se reparten parejo para
# llenar el alto (justificado, SIN montarse). El slider "Separacion entre vistas
# (mm)" fija el espacio minimo que reclama cada bloque -> cuantas caben por hoja ->
# cuantas laminas. 01_Calcular usa la MISMA medida y el MISMO reparto, asi que la
# cantidad de laminas que crea 01 es la que 02 llena. 02 NO crea laminas.
#
# Leyendas: eliminado (2026-07-10 a 2026-07-21, pedido de Javier).
#
# Revit 2027 / Dynamo 4 / CPython3
# IN[0] = sheets destino: numeros separados por coma, o un prefijo comun
# IN[1] = procesar todos los assemblies (bool)
# IN[2] = filtro de assemblies si IN[1] es False (parcial, comas)
# IN[3] = margen del borde de la lamina (mm)
# IN[4] = reserva en el lado derecho del sheet (mm)
# IN[5] = tipo de viewport para las PLANTAS (vacio = tipo por defecto)
# IN[6] = tipo de viewport para los CORTES (vacio = tipo por defecto)
# IN[7] = separacion del titulo bajo el borde de los cortes (mm)
# IN[8] = separacion entre vistas (mm) - espacio minimo entre bloques; regula
#         cuantas vistas por lamina. DEBE coincidir con el mismo input de 02.

import clr
clr.AddReference('RevitAPI')
clr.AddReference('RevitServices')
from Autodesk.Revit.DB import (FilteredElementCollector, AssemblyInstance, ViewSheet,
                               Viewport, View, ViewType, BuiltInCategory, XYZ, Element,
                               ElementType, ElementId, BuiltInParameter, FamilySymbol,
                               FamilyInstance, ViewDuplicateOption, StorageType)
from RevitServices.Persistence import DocumentManager
from RevitServices.Transactions import TransactionManager

doc = DocumentManager.Instance.CurrentDBDocument

sheets_text = (IN[0] or '').strip()
process_all = bool(IN[1])
filter_text = (IN[2] or '').strip()
margin = float(IN[3]) / 304.8
right_reserve = float(IN[4]) / 304.8
vp_type_text = (IN[5] or '').strip()
vp_type_text_sec = (IN[6] or '').strip()
gap_corte = float(IN[7]) / 304.8   # slider: distancia del titulo bajo el borde del corte
# separacion minima entre bloques (mm -> pies). Regula la densidad. DEBE coincidir
# con 01. Si el input aun no existe (grafo sin re-abrir), cae a 10 mm.
try:
    sep = float(IN[8]) / 304.8
except Exception:
    sep = 10.0 / 304.8
if sep < 0:
    sep = 0.0
gap_planta = 5.0 / 304.8
# reserva bajo cada vista para su titulo, usada para apilar y para el reparto
label_h_planta = 12.0 / 304.8
label_h_corte = (12.0 + 14.0) / 304.8
# separacion REAL dentro de cada bloque (planta -> corte A -> corte B -> callouts):
# margen general + 10 mm fijos.
gap_bloque = margin + 10.0 / 304.8

log = []
SUFIJO_ARMADURAS = ' - ARMADURA'
SUFIJO_CORTE = SUFIJO_ARMADURAS + ' - CORTE A'
SUFIJO_CORTE_B = SUFIJO_ARMADURAS + ' - CORTE B'
SUFIJOS_CORTE = (SUFIJO_CORTE, SUFIJO_CORTE_B)
PREFIJO_PEDESTAL = SUFIJO_ARMADURAS + ' - PEDESTAL '
# CORTES DE PEDESTAL (2026-07-31, ajustado el mismo dia): los crea el 01 desde cada callout.
# NO entran a los BLOQUES del reparto (el 02 tampoco los cuenta al calcular cuantas laminas
# hacen falta - MANDATORIO, Javier), pero SI se colocan: aparcados FUERA de la lamina, a la
# IZQUIERDA del recuadro de la lamina de su assembly, apilados hacia abajo - la practica del
# modelador es tenerlos fuera del recuadro y arrastrarlos a mano. Ver el bloque "CORTES DE
# PEDESTAL" al final de la colocacion. El filtro explicito de la recoleccion de bloques
# protege contra un rename futuro (hoy quedan fuera solos: su nombre no empieza con
# PREFIJO_PEDESTAL y esa recoleccion es una whitelist).
SUFIJO_CORTE_PEDESTAL = SUFIJO_ARMADURAS + ' - CORTE PEDESTAL '
# separacion horizontal (mm de papel) entre el borde izquierdo del recuadro y los cortes de
# pedestal aparcados.
SEP_PARK_PEDESTAL = 10.0 / 304.8

def sufijo_corte(nombre):
    for a in SUFIJOS_CORTE:
        if nombre.endswith(a):
            return a
    return None

def es_callout_pedestal(nombre):
    return PREFIJO_PEDESTAL in nombre

def elem_name(e):
    try:
        return e.Name
    except Exception:
        return Element.Name.__get__(e)

def label_h_de(v):
    nombre = elem_name(v)
    return label_h_corte if (sufijo_corte(nombre) or es_callout_pedestal(nombre)) else label_h_planta

def paper_size(v):
    # tamano en papel (pies) = crop del modelo / escala (crop ya ajustado por 00)
    cb = v.CropBox
    s = v.Scale if v.Scale > 0 else 1
    return ((cb.Max.X - cb.Min.X) / s, (cb.Max.Y - cb.Min.Y) / s)

# --- tipos de viewport (plantas y cortes) ---
vp_types = [t for t in FilteredElementCollector(doc).OfClass(ElementType)
            if t.FamilyName == 'Viewport']

def crear_tipo_viewport(nombre):
    base = vp_types[0]
    nuevo = base.Duplicate(nombre)
    vp_types.append(nuevo)
    log.append('Tipo de viewport {} creado (duplicado de {}).'.format(nombre, elem_name(base)))
    p = nuevo.get_Parameter(BuiltInParameter.VIEWPORT_ATTR_SHOW_LABEL)
    if p is not None and not p.IsReadOnly and p.AsInteger() != 1:
        p.Set(1)
    pt = nuevo.get_Parameter(BuiltInParameter.VIEWPORT_ATTR_LABEL_TAG)
    if pt is not None and (pt.AsElementId() is None or pt.AsElementId().Value < 0):
        labels = list(FilteredElementCollector(doc).OfClass(FamilySymbol)
                      .OfCategory(BuiltInCategory.OST_ViewportLabel))
        if labels:
            pt.Set(labels[0].Id)
        else:
            log.append('AVISO: no hay ninguna familia View Title cargada en el proyecto; el tipo {} mostrara la linea pero no el texto.'.format(nombre))
            log.append('Carga una (Insertar > Cargar familia > Anotaciones > titulo de vista) y re-corre.')
    return nuevo

def buscar_tipo_viewport(texto, uso):
    if not texto:
        return None
    low = texto.lower()
    for t in vp_types:
        if elem_name(t).lower() == low:
            return t
    cands = [t for t in vp_types if low in elem_name(t).lower()]
    if len(cands) == 1:
        return cands[0]
    if len(cands) > 1:
        log.append('AVISO: hay {} tipos de viewport que coinciden parcialmente con \"{}\" (para {}); se usa el tipo por defecto.'.format(len(cands), texto, uso))
        log.append('Tipos disponibles: ' + ', '.join(sorted(elem_name(t) for t in vp_types)))
        return None
    return crear_tipo_viewport(texto)

vp_type = None
vp_type_sec = None
vp_type_callout = None
# Tipo de viewport de los callouts de pedestal: FIJO, no es un input de Player (pedido de
# Javier 2026-07-28, aplica SOLO a callouts -- las plantas y cortes siguen usando sus
# propios inputs IN[5]/IN[6]).
NOMBRE_TIPO_VIEWPORT_CALLOUT = 'C_Titulo_General'

# --- sheets destino, ordenados por numero ---
all_sheets = {}
for s in FilteredElementCollector(doc).OfClass(ViewSheet):
    all_sheets[s.SheetNumber] = s

target_sheets = []
seen = set()
for tok in [t.strip() for t in sheets_text.split(',') if t.strip()]:
    if tok in all_sheets:
        matches = [all_sheets[tok]]
    else:
        matches = [s for n, s in all_sheets.items() if n.startswith(tok)]
    for s in matches:
        if s.SheetNumber not in seen:
            seen.add(s.SheetNumber)
            target_sheets.append(s)
target_sheets.sort(key=lambda s: s.SheetNumber)

if not target_sheets:
    log.append('ERROR: ningun sheet coincide con \"{}\".'.format(sheets_text))
    log.append('Sheets del proyecto: ' + ', '.join(sorted(all_sheets.keys())[:30]))
    OUT = log
else:
    by_type = {}
    for ai in FilteredElementCollector(doc).OfClass(AssemblyInstance):
        by_type.setdefault(ai.AssemblyTypeName, []).append(ai)
    names = sorted(by_type.keys())
    if not process_all:
        tokens = [t.strip().lower() for t in filter_text.split(',') if t.strip()]
        if tokens:
            names = [n for n in names if any(tok in n.lower() for tok in tokens)]
        else:
            names = []
            log.append('ERROR: \"Todos\" esta en False y el filtro esta vacio.')

    view_by_name = {}
    for v in FilteredElementCollector(doc).OfClass(View):
        if not v.IsTemplate:
            view_by_name[elem_name(v)] = v

    placed_ids = set()
    vp_by_view = {}
    for vp in FilteredElementCollector(doc).OfClass(Viewport):
        placed_ids.add(vp.ViewId.Value)
        vp_by_view[vp.ViewId.Value] = vp

    def titulo_corte(v, vp):
        try:
            num = vp.get_Parameter(BuiltInParameter.VIEWPORT_DETAIL_NUMBER).AsString()
            if not num:
                return
            base = elem_name(v)
            suf = sufijo_corte(base)
            if suf:
                base = base[:-len(suf)]
            p = v.get_Parameter(BuiltInParameter.VIEW_DESCRIPTION)
            if p is not None and not p.IsReadOnly:
                p.Set('{}{} - CORTE {}'.format(base, SUFIJO_ARMADURAS, num))
        except Exception:
            pass

    def letra(idx):
        s = ''
        n = idx + 1
        while n > 0:
            n, r = divmod(n - 1, 26)
            s = chr(65 + r) + s
        return s

    def asignar_letra(vp, sheet):
        usados = set()
        for vpid in sheet.GetAllViewports():
            ovp = doc.GetElement(vpid)
            try:
                dn = ovp.get_Parameter(BuiltInParameter.VIEWPORT_DETAIL_NUMBER).AsString()
                if dn:
                    usados.add(dn)
            except Exception:
                pass
        i = 0
        while letra(i) in usados:
            i += 1
        try:
            p = vp.get_Parameter(BuiltInParameter.VIEWPORT_DETAIL_NUMBER)
            if p is not None and not p.IsReadOnly:
                p.Set(letra(i))
        except Exception:
            pass

    # bloques por assembly: planta arriba + cortes + callouts, mismo eje vertical
    bloques = []
    bloques_nombres = []  # assembly de cada bloque, para saber en que lamina cayo (cortes de pedestal)
    retitular = []  # cortes ya colocados a los que actualizar el titulo en lamina
    for n in names:
        grupo = []
        for vname in (n + SUFIJO_ARMADURAS, n + SUFIJO_CORTE, n + SUFIJO_CORTE_B):
            v = view_by_name.get(vname)
            if v is None:
                log.append('AVISO: no existe la vista \"{}\" (corre 01_Vistas de assembly).'.format(vname))
            elif v.Id.Value in placed_ids:
                log.append('AVISO: \"{}\" ya esta en un sheet, se salta.'.format(vname))
                if (sufijo_corte(vname) or es_callout_pedestal(vname)) and v.Id.Value in vp_by_view:
                    retitular.append((v, vp_by_view[v.Id.Value]))
            else:
                grupo.append(v)
        prefijo_ped = n + PREFIJO_PEDESTAL
        # el 'and not in' excluye los CORTES DE PEDESTAL, ver SUFIJO_CORTE_PEDESTAL arriba
        for vname_ped in sorted(nm for nm in view_by_name
                                if nm.startswith(prefijo_ped) and SUFIJO_CORTE_PEDESTAL not in nm):
            v_ped = view_by_name[vname_ped]
            if v_ped.Id.Value in placed_ids:
                pass
            else:
                grupo.append(v_ped)
        if grupo:
            bloques.append(grupo)
            bloques_nombres.append(n)

    def usable_rect(sheet):
        col = FilteredElementCollector(doc, sheet.Id).OfCategory(BuiltInCategory.OST_TitleBlocks)
        tb = col.FirstElement()
        if tb is not None:
            bb = tb.get_BoundingBox(sheet)
            if bb is not None:
                return (bb.Min.X + margin, bb.Min.Y + margin,
                        bb.Max.X - margin - right_reserve, bb.Max.Y - margin)
        o = sheet.Outline
        return (o.Min.U + margin, o.Min.V + margin,
                o.Max.U - margin - right_reserve, o.Max.V - margin)

    def dims_bloque(grupo):
        ws = []
        hs = []
        for v in grupo:
            w, h = paper_size(v)
            ws.append(w)
            hs.append(h + label_h_de(v))
        bw = max(ws)
        bh = sum(hs) + gap_bloque * (len(grupo) - 1)
        return bw, bh

    # ---------------- reparto por COLUMNAS JUSTIFICADAS (identico a 01) ----------------
    EPS = 1e-9

    def pack_columns(dims, W, H):
        pages = []
        page = []
        page_w = 0.0
        col = []
        col_h = 0.0
        col_w = 0.0
        for idx in range(len(dims)):
            bw, bh = dims[idx]
            if col and (col_h + sep + bh) > H + EPS:
                w_need = (sep if page else 0.0) + col_w
                if page and (page_w + w_need) > W + EPS:
                    pages.append(page)
                    page = []
                    page_w = 0.0
                    w_need = col_w
                page.append(col)
                page_w += w_need
                col = []
                col_h = 0.0
                col_w = 0.0
            if col:
                col_h += sep + bh
            else:
                col_h = bh
            col.append(idx)
            if bw > col_w:
                col_w = bw
        if col:
            w_need = (sep if page else 0.0) + col_w
            if page and (page_w + w_need) > W + EPS:
                pages.append(page)
                page = []
                w_need = col_w
            page.append(col)
        if page:
            pages.append(page)
        return pages

    def layout(dims, x0, y0, x1, y1):
        W = x1 - x0
        H = y1 - y0
        pages = pack_columns(dims, W, H)
        asign = [None] * len(dims)
        avisos = []
        for i, (bw, bh) in enumerate(dims):
            if bw > W + EPS or bh > H + EPS:
                avisos.append(i)
        for pi, page in enumerate(pages):
            ncols = len(page)
            widths = [max(dims[i][0] for i in colm) for colm in page]
            sum_w = sum(widths)
            gap_x = 0.0 if ncols <= 1 else (W - sum_w) / (ncols - 1)
            if gap_x < 0:
                gap_x = 0.0
            cx_col = []
            if ncols == 1:
                left = x0 + max(0.0, (W - widths[0]) / 2.0)
                cx_col.append(left + widths[0] / 2.0)
            else:
                x = x0
                for w in widths:
                    cx_col.append(x + w / 2.0)
                    x += w + gap_x
            for ci, colm in enumerate(page):
                heights = [dims[i][1] for i in colm]
                sum_h = sum(heights)
                n = len(colm)
                if n == 1:
                    top = y1 - max(0.0, (H - heights[0]) / 2.0)
                    asign[colm[0]] = (pi, cx_col[ci], top)
                else:
                    gap_y = (H - sum_h) / (n - 1)
                    if gap_y < 0:
                        gap_y = 0.0
                    y = y1
                    for k, i in enumerate(colm):
                        asign[i] = (pi, cx_col[ci], y)
                        y -= heights[k] + gap_y
        return asign, len(pages), avisos

    def colocar_grupo(grupo, cx, y_sup, sheet):
        # apila las vistas del bloque por su tamano de CROP (compacto): cada vista
        # ocupa crop + titulo verticalmente, centrada en el eje cx de su columna. Las
        # lineas de seccion que salen del crop cruzan las vistas vecinas (normal en
        # estos planos). El centrado horizontal se ajusta con el contorno real en X.
        y = y_sup
        n_ok = 0
        for v in grupo:
            cw, ch = paper_size(v)
            lh = label_h_de(v)
            centro = XYZ(cx, y - ch / 2.0, 0.0)
            try:
                vp = Viewport.Create(doc, sheet.Id, v.Id, centro)
                if vp is None:
                    log.append('ERROR: Revit no permitio colocar \"{}\" en {}.'.format(elem_name(v), sheet.SheetNumber))
                    y -= ch + lh + gap_bloque
                    continue
                es_corte = sufijo_corte(elem_name(v)) is not None
                es_callout_v = es_callout_pedestal(elem_name(v))
                es_seccional_v = es_corte or es_callout_v
                if es_callout_v:
                    t_apl = vp_type_callout
                elif es_corte:
                    t_apl = vp_type_sec
                else:
                    t_apl = vp_type
                if t_apl is not None:
                    if vp.GetTypeId() != t_apl.Id:
                        vp.ChangeTypeId(t_apl.Id)
                    try:
                        gap = gap_corte if es_seccional_v else gap_planta
                        vp.LabelOffset = XYZ(0.0, -gap, 0.0)
                        vp.LabelLineLength = cw
                    except Exception:
                        pass
                if es_corte:
                    asignar_letra(vp, sheet)
                    titulo_corte(v, vp)
                # centrar la columna en X con el contorno real (no toca la Y, para
                # no inflar la separacion vertical con las lineas de seccion)
                try:
                    ob = vp.GetBoxOutline()
                    cxr = (ob.MaximumPoint.X + ob.MinimumPoint.X) / 2.0
                    c = vp.GetBoxCenter()
                    vp.SetBoxCenter(XYZ(c.X + (cx - cxr), c.Y, 0.0))
                except Exception:
                    pass
                n_ok += 1
                log.append('OK: \"{}\" -> sheet {}'.format(elem_name(v), sheet.SheetNumber))
                y -= ch + lh + gap_bloque
            except Exception as e:
                log.append('ERROR colocando \"{}\": {}'.format(elem_name(v), e))
                y -= ch + lh + gap_bloque
        return n_ok

    total_vistas = sum(len(g) for g in bloques)
    placed = 0
    placed_ped = 0  # cortes de pedestal aparcados fuera de la lamina (no cuentan en total_vistas)
    overflow = []

    TransactionManager.Instance.EnsureInTransaction(doc)
    try:
        vp_type = buscar_tipo_viewport(vp_type_text, 'plantas')
        vp_type_sec = buscar_tipo_viewport(vp_type_text_sec, 'cortes')
        vp_type_callout = buscar_tipo_viewport(NOMBRE_TIPO_VIEWPORT_CALLOUT, 'callouts')

        # --- retrofit: cortes ya colocados -> letra + titulo ---
        def orden_visual(par):
            v_r, vp_r = par
            sh_r = doc.GetElement(vp_r.SheetId)
            c = vp_r.GetBoxCenter()
            return (sh_r.SheetNumber if sh_r is not None else '', -c.Y, c.X)
        retitular.sort(key=orden_visual)
        for v_fix, vp_fix in retitular:
            if es_callout_pedestal(elem_name(v_fix)):
                if vp_type_callout is not None and vp_fix.GetTypeId() != vp_type_callout.Id:
                    try:
                        vp_fix.ChangeTypeId(vp_type_callout.Id)
                    except Exception:
                        pass
                try:
                    vp_fix.LabelOffset = XYZ(0.0, -gap_corte, 0.0)
                    vp_fix.LabelLineLength = paper_size(v_fix)[0]
                except Exception:
                    pass
                continue
            dn = None
            try:
                dn = vp_fix.get_Parameter(BuiltInParameter.VIEWPORT_DETAIL_NUMBER).AsString()
            except Exception:
                pass
            if not (dn and dn.isalpha()):
                sh_fix = doc.GetElement(vp_fix.SheetId)
                if sh_fix is not None:
                    asignar_letra(vp_fix, sh_fix)
            if vp_type_sec is not None and vp_fix.GetTypeId() != vp_type_sec.Id:
                try:
                    vp_fix.ChangeTypeId(vp_type_sec.Id)
                except Exception:
                    pass
            try:
                vp_fix.LabelOffset = XYZ(0.0, -gap_corte, 0.0)
                vp_fix.LabelLineLength = paper_size(v_fix)[0]
            except Exception:
                pass
            titulo_corte(v_fix, vp_fix)
        if retitular:
            log.append('Letra y titulo actualizados para {} cortes/callouts ya colocados.'.format(len(retitular)))

        bloque_de = {}  # assembly -> sheet donde cayo su bloque en ESTA corrida
        if bloques:
            x0, y0, x1, y1 = usable_rect(target_sheets[0])
            dims_bloques = [dims_bloque(g) for g in bloques]
            asign, n_pages, avisos = layout(dims_bloques, x0, y0, x1, y1)
            for idx in avisos:
                bw, bh = dims_bloques[idx]
                log.append('AVISO: \"{}\" ({:.0f} x {:.0f} mm en papel) es mas grande que el area util de una lamina.'.format(
                    elem_name(bloques[idx][0]), bw * 304.8, bh * 304.8))

            # sheets destino vacios (los que ya tienen viewports se omiten)
            usable_sheets = []
            for s in target_sheets:
                if len(list(s.GetAllViewports())) > 0:
                    log.append('AVISO: sheet {} ya tiene vistas colocadas, se omite.'.format(s.SheetNumber))
                else:
                    usable_sheets.append(s)

            for idx, grupo in enumerate(bloques):
                pi, cx, by_top = asign[idx]
                if pi < len(usable_sheets):
                    placed += colocar_grupo(grupo, cx, by_top, usable_sheets[pi])
                    bloque_de[bloques_nombres[idx]] = usable_sheets[pi]
                else:
                    for v in grupo:
                        overflow.append(elem_name(v))

            if n_pages > len(usable_sheets):
                log.append('AVISO: se necesitan {} laminas pero hay {} destino disponibles; corre 01 con el MISMO valor del slider "Separacion entre vistas (mm)" para crear las que faltan y vuelve a correr 02.'.format(n_pages, len(usable_sheets)))

        # --- CORTES DE PEDESTAL: aparcados FUERA de la lamina (2026-07-31, Javier) ---
        # No entran a los bloques ni al calculo del 02 (mandatorio), pero SI se colocan:
        # a la IZQUIERDA del recuadro de la lamina de su assembly, apilados hacia abajo,
        # con el tipo de viewport de cortes y su letra - asi la burbuja del marcador en el
        # callout muestra numero de detalle y lamina reales. El modelador los arrastra a
        # mano a su posicion final (su practica habitual: quedan fuera del recuadro).
        # Corre TAMBIEN cuando no hay bloques pendientes (retrofit de una corrida
        # anterior): la lamina de referencia es entonces la que ya tiene la PLANTA del
        # assembly. Idempotente: un corte ya colocado (placed_ids) no se toca.
        park_cursor = {}
        for n in names:
            pend = [view_by_name[nm] for nm in sorted(view_by_name)
                    if nm.startswith(n + SUFIJO_CORTE_PEDESTAL)
                    and view_by_name[nm].Id.Value not in placed_ids]
            if not pend:
                continue
            sheet_dest = bloque_de.get(n)
            if sheet_dest is None:
                v_planta = view_by_name.get(n + SUFIJO_ARMADURAS)
                if v_planta is not None and v_planta.Id.Value in vp_by_view:
                    sheet_dest = doc.GetElement(vp_by_view[v_planta.Id.Value].SheetId)
            if sheet_dest is None:
                log.append('AVISO: {} tiene {} corte(s) de pedestal pendientes pero su planta no esta en ninguna lamina; se saltan (vuelve a correr despues de colocar el bloque).'.format(n, len(pend)))
                continue
            x0s, y0s, x1s, y1s = usable_rect(sheet_dest)
            borde_izq = x0s - margin  # borde REAL del recuadro (usable_rect ya sumo el margen)
            key = sheet_dest.Id.Value
            if key not in park_cursor:
                park_cursor[key] = y1s
            for v_cp in pend:
                w_cp, h_cp = paper_size(v_cp)
                centro_cp = XYZ(borde_izq - SEP_PARK_PEDESTAL - w_cp / 2.0,
                                park_cursor[key] - h_cp / 2.0, 0.0)
                try:
                    vp_cp = Viewport.Create(doc, sheet_dest.Id, v_cp.Id, centro_cp)
                    if vp_cp is None:
                        log.append('ERROR: Revit no permitio colocar "{}" en {}.'.format(elem_name(v_cp), sheet_dest.SheetNumber))
                        continue
                    if vp_type_sec is not None and vp_cp.GetTypeId() != vp_type_sec.Id:
                        vp_cp.ChangeTypeId(vp_type_sec.Id)
                    try:
                        vp_cp.LabelOffset = XYZ(0.0, -gap_corte, 0.0)
                        vp_cp.LabelLineLength = w_cp
                    except Exception:
                        pass
                    asignar_letra(vp_cp, sheet_dest)
                    placed_ped += 1
                    park_cursor[key] -= h_cp + label_h_corte + gap_bloque
                    log.append('OK: "{}" -> sheet {} (aparcado FUERA de la lamina, a la izquierda).'.format(elem_name(v_cp), sheet_dest.SheetNumber))
                except Exception as e:
                    log.append('ERROR colocando "{}": {}'.format(elem_name(v_cp), e))
    finally:
        TransactionManager.Instance.TransactionTaskDone()

    if overflow:
        log.append('SIN COLOCAR {} vistas (faltaron laminas): {}'.format(len(overflow), ', '.join(overflow)))
    resumen = 'Vistas colocadas: {} de {} (columnas justificadas)'.format(placed, total_vistas)
    if placed_ped:
        resumen += ' | cortes de pedestal aparcados fuera de la lamina: {}'.format(placed_ped)
    log.insert(0, resumen)
    OUT = log
# ----------------------------------------
log = Watch(py_colocar_viewports_en_grilla)  # graph output
