# Dynamo graph 04_Cotas de ejes.dyn (Dynamo 4.0.2.3852)
# Fase 2: cadena de cotas en la planta de cada assembly - borde del assembly, eje de cada elemento (planos de referencia centrales de la familia) y borde opuesto.

procesar_todos_los_assemblies = BoolSelector(true)  # graph input
filtro_por_nombre_si_todos_false = StringInput("")  # graph input
distancia_de_la_cadena_mm_pegada = IntegerSlider(10, range=5..40 step 1)  # "Distancia de la cadena (mm) - PEGADA al objeto"; graph input
cadena_horizontal_ancho = BoolSelector(true)  # graph input
cadena_vertical_largo = BoolSelector(false)  # graph input
py_cadena_de_ejes_por_assembly = Python(IN[0]=procesar_todos_los_assemblies, IN[1]=filtro_por_nombre_si_todos_false, IN[2]=distancia_de_la_cadena_mm_pegada, IN[3]=cadena_horizontal_ancho, IN[4]=cadena_vertical_largo)  # PythonNet3
# ---------- py_cadena_de_ejes_por_assembly.python (298 lines) ----------
# 04_Cotas de ejes - Cadena de cotas de ejes de elementos (fase 2)
# En la planta de cada assembly: borde - eje de cada elemento - borde opuesto.
# El eje de cada elemento sale de los planos de referencia centrales de su familia
# (FamilyInstance.GetReferences CenterLeftRight / CenterFrontBack).
# Revit 2027 / Dynamo 4 / CPython3
# IN[0] = procesar todos los assemblies (bool)
# IN[1] = filtro por nombre si IN[0] es False (parcial, comas)
# IN[2] = distancia de la cadena al assembly, en mm de papel
# IN[3] = cadena horizontal (a lo ancho de la vista) (bool)
# IN[4] = cadena vertical (a lo largo de la vista) (bool)

import clr
clr.AddReference('RevitAPI')
clr.AddReference('RevitServices')
from Autodesk.Revit.DB import (FilteredElementCollector, AssemblyInstance, View,
                               Options, ViewDetailLevel, Solid, GeometryInstance,
                               PlanarFace, ReferenceArray, Line, XYZ, UV,
                               Dimension, Element, FamilyInstance,
                               FamilyInstanceReferenceType, ElementId,
                               FailureProcessingResult, FailureSeverity)
from System.Collections.Generic import List
from RevitServices.Persistence import DocumentManager
from RevitServices.Transactions import TransactionManager

doc = DocumentManager.Instance.CurrentDBDocument

process_all = bool(IN[0])
filter_text = (IN[1] or '').strip()
offset_mm = float(IN[2])
chain_h = bool(IN[3])
chain_v = bool(IN[4])

log = []
PARALELO = 0.99
MIN_DIST = 0.01    # pies
TOL_EJE = 0.016    # pies (~5 mm): ejes a menos de esto se consideran el mismo

def elem_name(e):
    try:
        return e.Name
    except Exception:
        return Element.Name.__get__(e)

# contrato de nombres de la rutina de ARMADURAS (ver 00): la cadena de ejes va
# en la planta 'FN-1001 - ARMADURA'; la planta de Formas nunca matchea.
SUFIJO_ARMADURAS = ' - ARMADURA'

by_type = {}
for ai in FilteredElementCollector(doc).OfClass(AssemblyInstance):
    by_type.setdefault(ai.AssemblyTypeName, []).append(ai)

if process_all:
    targets = sorted(by_type.keys())
else:
    tokens = [t.strip().lower() for t in filter_text.split(',') if t.strip()]
    if tokens:
        targets = [n for n in sorted(by_type.keys())
                   if any(tok in n.lower() for tok in tokens)]
    else:
        targets = []
        log.append('ERROR: \"Todos\" esta en False y el filtro esta vacio.')

views = {}
for v in FilteredElementCollector(doc).OfClass(View):
    if not v.IsTemplate:
        views[elem_name(v)] = v

def add_solid_faces(out, s, trf):
    for f in s.Faces:
        if isinstance(f, PlanarFace) and f.Reference is not None:
            n = f.FaceNormal
            buv = f.GetBoundingBox()
            uv = UV((buv.Min.U + buv.Max.U) / 2.0, (buv.Min.V + buv.Max.V) / 2.0)
            p = f.Evaluate(uv)
            if trf is not None:
                n = trf.OfVector(n)
                p = trf.OfPoint(p)
            out.append((f.Reference, n, p))

def collect_faces(ai):
    out = []
    opt = Options()
    opt.ComputeReferences = True
    opt.DetailLevel = ViewDetailLevel.Fine
    for mid in ai.GetMemberIds():
        el = doc.GetElement(mid)
        geo = el.get_Geometry(opt)
        if geo is None:
            continue
        for g in geo:
            if isinstance(g, Solid) and g.Volume > 1e-9:
                add_solid_faces(out, g, None)
            elif isinstance(g, GeometryInstance):
                trf = g.Transform
                for sg in g.GetSymbolGeometry():
                    if isinstance(sg, Solid) and sg.Volume > 1e-9:
                        add_solid_faces(out, sg, trf)
    return out

def extremes(faces, d):
    cands = [(ref, p) for ref, n, p in faces if abs(n.DotProduct(d)) > PARALELO]
    if len(cands) < 2:
        return None
    lo = min(cands, key=lambda c: c[1].DotProduct(d))
    hi = max(cands, key=lambda c: c[1].DotProduct(d))
    if hi[1].DotProduct(d) - lo[1].DotProduct(d) < MIN_DIST:
        return None
    return lo, hi

def dim_line(d, perp, perp_value, p_lo, p_hi):
    c = p_lo.Add(p_hi).Multiply(0.5)
    base = c.Add(perp.Multiply(perp_value - c.DotProduct(perp)))
    q1 = base.Add(d.Multiply(p_lo.DotProduct(d) - base.DotProduct(d)))
    q2 = base.Add(d.Multiply(p_hi.DotProduct(d) - base.DotProduct(d)))
    return Line.CreateBound(q1, q2)

def proj_range(faces, d):
    vals = [p.DotProduct(d) for ref, n, p in faces]
    return (min(vals), max(vals))

def has_chain(v):
    # ya existe una cota de mas de un segmento -> este graph ya corrio aqui
    for dim in FilteredElementCollector(doc, v.Id).OfClass(Dimension):
        try:
            if dim.NumberOfSegments > 1:
                return True
        except Exception:
            pass
    return False

def center_ref(el, d):
    # referencia al plano central de la familia perpendicular a la direccion d
    if not isinstance(el, FamilyInstance):
        return None
    pares = ((el.HandOrientation, FamilyInstanceReferenceType.CenterLeftRight),
             (el.FacingOrientation, FamilyInstanceReferenceType.CenterFrontBack))
    for eje, rtipo in pares:
        try:
            if abs(eje.DotProduct(d)) > PARALELO:
                refs = list(el.GetReferences(rtipo))
                if refs:
                    r = refs[0]
                    try:
                        # descartar referencias rotas (elemento -1 / invalido)
                        if r.ElementId is None or r.ElementId.Value < 0:
                            return None
                    except Exception:
                        return None
                    return r
        except Exception:
            pass
    return None

def build_chain(view, ai, faces, d, perp, perp_value, tname, etiqueta):
    ext = extremes(faces, d)
    if ext is None:
        log.append('AVISO {}: sin bordes perpendiculares para la cadena {}.'.format(tname, etiqueta))
        return 0
    (lo_ref, p_lo), (hi_ref, p_hi) = ext
    items = []
    sin_eje = 0
    anidadas = 0
    for mid in ai.GetMemberIds():
        el = doc.GetElement(mid)
        bb = el.get_BoundingBox(None)
        if bb is None:
            continue
        # familias anidadas dentro de otra familia: fuera de la cadena
        if isinstance(el, FamilyInstance):
            sup = None
            try:
                sup = el.SuperComponent
            except Exception:
                pass
            if sup is not None:
                anidadas += 1
                continue
        r = center_ref(el, d)
        if r is None:
            sin_eje += 1
            continue
        st = XYZ((bb.Min.X + bb.Max.X) / 2.0,
                 (bb.Min.Y + bb.Max.Y) / 2.0,
                 (bb.Min.Z + bb.Max.Z) / 2.0).DotProduct(d)
        items.append((st, r))
    if sin_eje:
        log.append('AVISO {}: {} elementos sin plano de referencia central en la familia, quedan fuera de la cadena {}.'.format(tname, sin_eje, etiqueta))
    if anidadas:
        log.append('{}: {} familias anidadas omitidas de la cadena {}.'.format(tname, anidadas, etiqueta))
    if not items:
        log.append('AVISO {}: ningun elemento con eje referenciable para la cadena {}.'.format(tname, etiqueta))
        return 0
    items.sort(key=lambda it: it[0])
    filtrados = []
    ultimo = None
    for st, r in items:
        if ultimo is None or st - ultimo > TOL_EJE:
            filtrados.append((st, r))
            ultimo = st
    ra = ReferenceArray()
    ra.Append(lo_ref)
    for st, r in filtrados:
        ra.Append(r)
    ra.Append(hi_ref)
    line = dim_line(d, perp, perp_value, p_lo, p_hi)
    dim = doc.Create.NewDimension(view, line, ra)
    creadas.append((tname, etiqueta, dim.Id))
    log.append('OK {}: cadena {} con {} ejes.'.format(tname, etiqueta, len(filtrados)))
    return 1

total = 0
creadas = []  # (assembly, etiqueta, id de la cota) para verificar tras el commit

def _resolver_fallas(sender, args):
    # al confirmar la transaccion, elimina automaticamente las cotas que Revit
    # rechaza por referencias invalidas, en vez de mostrar el dialogo bloqueante
    try:
        fa = args.GetFailuresAccessor()
        resultado = FailureProcessingResult.Continue
        for f in fa.GetFailureMessages():
            try:
                if f.GetSeverity() == FailureSeverity.Warning:
                    fa.DeleteWarning(f)
                    continue
                ids = list(f.GetFailingElementIds())
                if ids:
                    fa.DeleteElements(List[ElementId](ids))
                    resultado = FailureProcessingResult.ProceedWithCommit
                elif f.HasResolutions():
                    fa.ResolveFailure(f)
                    resultado = FailureProcessingResult.ProceedWithCommit
            except Exception:
                pass
        args.SetProcessingResult(resultado)
    except Exception:
        pass

app = doc.Application
app.FailuresProcessing += _resolver_fallas
TransactionManager.Instance.EnsureInTransaction(doc)
try:
    for tname in targets:
        ai = by_type[tname][0]
        try:
            vplan = views.get(tname + SUFIJO_ARMADURAS)
            if vplan is None:
                log.append('AVISO {}: no existe la vista de planta (corre 00_Vistas de assembly).'.format(tname))
                continue
            if has_chain(vplan):
                log.append('{}: la planta ya tiene cadena, se salta.'.format(tname))
                continue
            faces = collect_faces(ai)
            if not faces:
                log.append('ERROR {}: los miembros no exponen geometria con referencias.'.format(tname))
                continue
            rd = vplan.RightDirection
            ud = vplan.UpDirection
            off = offset_mm / 304.8 * vplan.Scale
            u0, u1 = proj_range(faces, ud)
            r0, r1 = proj_range(faces, rd)
            if chain_h:
                try:
                    # cadena horizontal ARRIBA de la planta
                    total += build_chain(vplan, ai, faces, rd, ud, u1 + off, tname, 'horizontal')
                except Exception as e:
                    log.append('ERROR {} cadena horizontal: {}'.format(tname, e))
            if chain_v:
                try:
                    total += build_chain(vplan, ai, faces, ud, rd, r0 - off, tname, 'vertical')
                except Exception as e:
                    log.append('ERROR {} cadena vertical: {}'.format(tname, e))
        except Exception as e:
            log.append('ERROR {}: {}'.format(tname, e))
finally:
    try:
        TransactionManager.Instance.TransactionTaskDone()
        # Dynamo confirma su transaccion al final del run, cuando este script ya
        # termino y el manejador de fallas se des-suscribio. Forzamos el commit
        # AQUI para que el manejador intercepte las referencias invalidas.
        TransactionManager.Instance.ForceCloseTransaction()
    finally:
        app.FailuresProcessing -= _resolver_fallas

# verificar cuales cadenas sobrevivieron al commit
descartadas = []
for tname_c, etiqueta_c, did in creadas:
    try:
        if doc.GetElement(did) is None:
            descartadas.append('{} ({})'.format(tname_c, etiqueta_c))
    except Exception:
        pass
if descartadas:
    total -= len(descartadas)
    log.append('AVISO: cadenas eliminadas por referencias invalidas: ' + ', '.join(descartadas))
    log.append('Solucion de fondo: en las familias de esos assemblies, definir el plano central con Is Reference = Center (Front/Back) y recargarlas.')

log.insert(0, 'Cadenas creadas: {} | assemblies procesados: {}'.format(total, len(targets)))
OUT = log
# ----------------------------------------
log = Watch(py_cadena_de_ejes_por_assembly)  # graph output
