# Dynamo graph 05_Tabla de assemblies.dyn (Dynamo 4.0.2.3852)
# PASO 6 de 6 - Crea en cada lamina la tabla de despiece de armaduras: una fila por marca, agrupada por fundacion, con diametro, cantidad, largos y pesos. Requiere los pasos 2 a 4.

sheets_destino_numeros_con_coma = StringInput("")  # "Sheets destino (numeros con coma, o prefijo)"; graph input
margen_mm = IntegerSlider(20, range=5..50 step 1)  # graph input
reserva_lado_derecho_mm = IntegerSlider(150, range=0..200 step 5)  # graph input
estilo_de_linea_grid_outline = StringInput("LÃƒÆ’Ã†â€™Ãƒâ€šÃ‚Â­neas Tablas Finas")  # graph input
tipo_de_texto_encabezados = StringInput("C_TXT_RomanD2.3mm")  # graph input
tipo_de_texto_cuerpo = StringInput("C_TXT_RomanD2.3mm_Negrita")  # graph input
titulo_de_la_tabla = StringInput("")  # graph input
view_template_para_las_tablas = StringInput("TABLA_TIPO")  # graph input
py_tabla_de_assemblies_por_sheet = Python(IN[0]=sheets_destino_numeros_con_coma, IN[1]=margen_mm, IN[2]=reserva_lado_derecho_mm, IN[3]=estilo_de_linea_grid_outline, IN[4]=tipo_de_texto_encabezados, IN[5]=tipo_de_texto_cuerpo, IN[6]=titulo_de_la_tabla, IN[7]=view_template_para_las_tablas)  # PythonNet3
# ---------- py_tabla_de_assemblies_por_sheet.python (861 lines) ----------
# 06_Tabla de assemblies - Crea, por cada sheet destino, un schedule nativo de Revit
# de categoria STRUCTURAL REBAR con la tabla de despiece de armaduras de los assemblies
# documentados en ESE sheet. Estructura (igual que la planilla a mano de referencia):
#   Encabezado nivel 1 = nombre del assembly ("FUNDACION FN-1001", de ELEMENTO_TBL)
#   Encabezado nivel 2 = "CANT=N" (cantidad de instancias de ese tipo de fundacion)
#   Una fila por MARCA (ITEM_TBL) con: TIPO / Diametro / CANTIDAD TOTAL BARRAS /
#   A..F (mm) / UNIT (m) / TOTAL (m) / PESO UNITARIO (Kg) / PESO TOTAL (Kg) / OBSERVACION.
#
# Reglas de negocio (definidas por el usuario, confirmadas contra el modelo real):
# - Solo se consideran BARRAS (elementos nativos Structural Rebar). Nada de hormigones ni
#   pernos (eso era la version anterior de esta tabla, multi-categoria).
# - Las barras se agrupan por ASSEMBLY (una tabla por sheet, un bloque por tipo de
#   fundacion documentado en ese sheet) y dentro por MARCA = ITEM_TBL.
# - MARCA = ITEM_TBL ; TIPO = nombre de la RebarShape (ej. "TIPO-3") ; Diametro (mm) =
#   Bar Diameter ; A..F (mm) = parametros compartidos A..F de la barra.
# - CANTIDAD TOTAL BARRAS = suma de 'Quantity' (nro de barras del set) de todas las barras
#   que colapsan en la fila (misma marca Y misma geometria) dentro del assembly. La suma
#   la hace Revit, no este script (campo nativo con DisplayType=Totals).
# - UNIT (m) = largo desarrollado de UNA barra = A+B+C+D+E+F (LONG_TOTAL_UNITARIA).
# - TOTAL (m) = suma sobre las barras de la marca de (UNIT_barra x Quantity_barra).
# - PESO UNITARIO (Kg) = Diam_mm^2 * (0.617/100) * UNIT (peso de UNA barra).
# - PESO TOTAL (Kg) = suma sobre las barras de la marca de (peso_unit_barra x Quantity).
# - OBSERVACION = parametro Comments de la barra.
# - Cuando dos barras de una misma marca NO son identicas en lo que se muestra (ej. la
#   marca 1609, que agrupa a proposito la barra SUP. y la INF. con tramos distintos), la
#   marca sale en una fila por variante. Antes esas celdas decian "<varies>"; con campos
#   nativos no se pueden homogeneizar sin romper el colapso del schedule.
#
# Mecanica (reescrita 2026-08-05, ver nota de columnas vivas mas abajo):
# - MARCA, TIPO, Diametro, CANTIDAD, A..F y OBSERVACION son campos NATIVOS de la barra:
#   se actualizan solos cuando el modelador edita la armadura, SIN correr este graph.
#   A..F son los parametros compartidos reales de la RebarShape (GUID_A..GUID_F), los
#   mismos que este graph antes copiaba a ARM_A..ARM_F; esa copia se elimino.
#   CANTIDAD es 'Quantity' con DisplayType=Totals: el schedule (IsItemized=False) suma
#   las barras que colapsan en la fila en vez de partirla.
# - Solo UNIT / TOTAL / PESO UNIT. / PESO TOTAL se siguen PRECALCULANDO en Python y
#   escribiendo como parametros compartidos ARM_*, porque dependen de la regla de negocio
#   UNIT = A+B+C+D+E+F, que NO es el 'Bar Length' nativo de Revit (ese descuenta el
#   desarrollo de los dobleces, ~2,6% menos) y la API de Revit no permite crear valores
#   calculados de schedule. Esas 4 columnas siguen siendo una foto: para actualizarlas
#   hay que re-correr el 05.
# - Revit colapsa dos filas solo si coinciden TODOS los campos visibles, asi que los
#   valores precalculados se escriben por GRUPO (marca + tipo + diametro + A..F + obs),
#   no por marca: asi las barras que colapsan en una fila llevan el mismo texto y los
#   totales de la fila cuadran con las barras que realmente la componen.
# - Se REUSAN los compartidos ya existentes: ITEM_TBL (MARCA), A..F, ELEMENTO_TBL (texto
#   del encabezado de assembly) y SHEET_ARMADURAS (filtro PROPIO de ARMADURAS - NO se usa
#   Comments, que es el filtro de las tablas de la rutina de Formas sobre los MISMOS
#   elementos fisicos). Se CREAN los compartidos de despiece ARM_* (grupo ARMADURAS_TABLA,
#   enlazados a la categoria Structural Rebar) para las columnas calculadas.
# - Asociacion barra -> assembly: se recorren los miembros (recursivo) de la PRIMERA
#   instancia de cada tipo que TENGA barras, y se toma toda barra que sea miembro directo
#   o este alojada (GetHostId) en un miembro. Asi se documenta un solo representante por
#   tipo (misma convencion del resto del pipeline) y el CANT=N multiplica aparte.
#
# LIMITACION CONOCIDA: las filas de SUBTOTAL por fundacion de la planilla a mano (suma de
# cantidad / TOTAL(m) / peso) NO se generan: un campo de schedule nativo no puede a la vez
# mostrar el valor por-marca colapsado y sumarse en un pie de grupo. Queda pendiente.
#
# Revit 2027 / Dynamo 4 / CPython3
# IN[0] = sheets destino: numeros separados por coma, o un prefijo comun
# IN[1] = margen (mm), misma convencion que 01/02
# IN[2] = reserva lado derecho (mm) - debe coincidir con 01 y 02
# IN[3] = nombre del estilo de linea para grid/outline del schedule (vacio = no tocar)
# IN[4] = nombre del tipo de texto para encabezados (vacio = no tocar)
# IN[5] = nombre del tipo de texto para el cuerpo (vacio = no tocar)
# IN[6] = titulo de la tabla (se aplica a TODAS las tablas creadas; vacio = titulo en blanco)
# IN[7] = nombre del view template para las tablas (default "TABLA_TIPO"; vacio = no aplicar)

import clr
clr.AddReference('RevitAPI')
clr.AddReference('RevitServices')
from Autodesk.Revit.DB import (FilteredElementCollector, AssemblyInstance, ViewSheet,
                               ScheduleSheetInstance, ViewSchedule, ScheduleFilter,
                               ScheduleFilterType, ScheduleSortGroupField, BuiltInCategory,
                               BuiltInParameter, ElementId, XYZ, Element, TextNoteType,
                               GraphicsStyle, StorageType, FamilyInstance, SharedParameterElement,
                               ParameterFilterRuleFactory, ElementParameterFilter,
                               ExternalDefinitionCreationOptions, SpecTypeId, CategoryType, GroupTypeId,
                               FormatOptions, UnitTypeId, ForgeTypeId, ScheduleFieldDisplayType)
from Autodesk.Revit.DB.Structure import Rebar
from RevitServices.Persistence import DocumentManager
from RevitServices.Transactions import TransactionManager
from System import Guid
import os
import tempfile

doc = DocumentManager.Instance.CurrentDBDocument

sheets_text = (IN[0] or '').strip()
margin = float(IN[1]) / 304.8
right_reserve = float(IN[2]) / 304.8
grid_style_name = (IN[3] or '').strip()
header_text_name = (IN[4] or '').strip()
body_text_name = (IN[5] or '').strip()
titulo_tabla = (IN[6] or '').strip()
template_nombre = (IN[7] or '').strip()

# --- GUIDs de parametros compartidos YA EXISTENTES en el proyecto ---
GUID_ITEM = Guid('48cfe67b-4544-4f71-bd75-e46767622ddd')      # ITEM_TBL  -> MARCA
GUID_ELEMENTO_TBL = Guid('433e7c25-aa15-4380-9474-c6dffa787fa2')  # ELEMENTO_TBL -> "FUNDACION FN-xxxx"
GUID_A = Guid('834200b7-07e9-4677-a81a-44dc862ff50b')
GUID_B = Guid('e0d9703a-2ca6-44f8-8ca6-ce70571458d7')
GUID_C = Guid('4aad6aab-b0e9-4528-bfa3-eeb96adaead0')
GUID_D = Guid('e70a9408-6d69-44f5-848d-f5ba4cb037e5')
GUID_E = Guid('74e389d7-fb43-471a-8f8d-830bf717db8e')
GUID_F = Guid('60bd0376-836e-484f-89d4-d8fb8d985f34')
GUIDS_AF = [GUID_A, GUID_B, GUID_C, GUID_D, GUID_E, GUID_F]

SUFIJO_ARMADURAS = ' - ARMADURA'
NOMBRE_PARAM_SHEET_ARM = 'SHEET_ARMADURAS'
PREFIJO_SCHEDULE = 'TBL_ARMADURAS_'
REBAR_CAT_ID = ElementId(BuiltInCategory.OST_Rebar)
PESO_K = 0.617 / 100.0  # kg/m = Diam_mm^2 * K  (formula del usuario)

# parametros ARM_* que se crean (grupo ARMADURAS_TABLA, texto, instancia, categoria Rebar).
# El orden aca no importa; el orden de columnas se define mas abajo.
# OJO: ARM_TIPO, ARM_DIAM, ARM_CANT, ARM_A..ARM_F y ARM_OBS ya NO se usan (esas columnas
# pasaron a leer el campo nativo). Si el proyecto viene de una corrida vieja, esos
# parametros siguen existiendo con su ultimo valor escrito, pero ninguna tabla los mira.
NOMBRES_ARM = ['ARM_L1', 'ARM_L2', 'ARM_UNIT', 'ARM_TOTAL', 'ARM_PESO_U', 'ARM_PESO_T']

# ancho de columna: mismo enfoque que la version anterior (ancho fijo generoso por
# caracter del texto mas largo de cada columna; se escala si la suma pasa la reserva).
ANCHO_POR_CARACTER_MM = 2.5
ANCHO_COL_MINIMO = 10.0 / 304.8

log = []


def elem_name(e):
    try:
        return e.Name
    except Exception:
        return Element.Name.__get__(e)


def formato_2dec(n):
    # 2 decimales fijos con coma (convencion chilena), ej. 5,30 / 120,00
    return ('{:.2f}'.format(n)).replace('.', ',')


def as_str(p):
    if p is None:
        return ''
    try:
        return p.AsString() or ''
    except Exception:
        return ''


def as_dbl(p):
    if p is None:
        return 0.0
    try:
        return p.AsDouble()
    except Exception:
        return 0.0


# --- lectura de datos de una barra ---
def rebar_marca(r):
    return as_str(r.get_Parameter(GUID_ITEM)).strip()


def rebar_elemento(r):
    return as_str(r.get_Parameter(GUID_ELEMENTO_TBL)).strip()


def rebar_tipo(r):
    # nombre de la RebarShape (ej. "TIPO-3"); fallback al parametro 'Shape Name'
    try:
        sh = doc.GetElement(r.GetShapeId())
        if sh is not None:
            return elem_name(sh)
    except Exception:
        pass
    p = r.LookupParameter('Shape Name')
    return as_str(p)


def rebar_diam_mm(r):
    p = r.get_Parameter(BuiltInParameter.REBAR_BAR_DIAMETER)
    if p is None:
        p = r.LookupParameter('Bar Diameter')
    return as_dbl(p) * 304.8


def rebar_quantity(r):
    try:
        return int(r.Quantity)
    except Exception:
        p = r.LookupParameter('Quantity')
        try:
            return int(p.AsInteger()) if p is not None else 0
        except Exception:
            return 0


def rebar_af_mm(r):
    # los 6 tramos A..F en mm (0 si el parametro no aplica a esa forma)
    return [as_dbl(r.get_Parameter(g)) * 304.8 for g in GUIDS_AF]


def rebar_obs(r):
    return as_str(r.get_Parameter(BuiltInParameter.ALL_MODEL_INSTANCE_COMMENTS)).strip()


# --- sheets destino (misma logica que 03_Colocar vistas en laminas) ---
all_sheets = {}
for s in FilteredElementCollector(doc).OfClass(ViewSheet):
    all_sheets[s.SheetNumber] = s

target_sheets = []
seen = set()
for tok in [t.strip() for t in sheets_text.split(',') if t.strip()]:
    if tok in all_sheets:
        matches = [all_sheets[tok]]
    else:
        matches = [s for n, s in all_sheets.items() if n.startswith(tok)]
    for s in matches:
        if s.SheetNumber not in seen:
            seen.add(s.SheetNumber)
            target_sheets.append(s)
target_sheets.sort(key=lambda s: s.SheetNumber)

if not target_sheets:
    log.append('ERROR: ningun sheet coincide con "{}".'.format(sheets_text))
    log.append('Sheets del proyecto: ' + ', '.join(sorted(all_sheets.keys())[:30]))
    OUT = log
else:
    by_type = {}
    for ai in FilteredElementCollector(doc).OfClass(AssemblyInstance):
        by_type.setdefault(ai.AssemblyTypeName, []).append(ai)

    # cache de todas las barras del modelo con su host, para asociarlas a assemblies
    todas_barras = list(FilteredElementCollector(doc).OfCategory(BuiltInCategory.OST_Rebar)
                        .WhereElementIsNotElementType().ToElements())
    host_de_barra = {}
    for r in todas_barras:
        try:
            hid = r.GetHostId()
            host_de_barra[r.Id.Value] = hid.Value if hid is not None else None
        except Exception:
            host_de_barra[r.Id.Value] = None

    def member_ids_recursivos(ai):
        ids = set()
        stack = list(ai.GetMemberIds())
        while stack:
            eid = stack.pop()
            if eid.Value in ids:
                continue
            ids.add(eid.Value)
            el = doc.GetElement(eid)
            if isinstance(el, FamilyInstance):
                try:
                    for s in el.GetSubComponentIds():
                        stack.append(s)
                except Exception:
                    pass
        return ids

    def barras_de_assembly(ai):
        ids = member_ids_recursivos(ai)
        res = []
        for r in todas_barras:
            if r.Id.Value in ids or host_de_barra.get(r.Id.Value) in ids:
                res.append(r)
        return res

    def representante_con_barras(tname):
        # primera instancia del tipo que tenga barras asociadas (si ninguna, la primera)
        for cand in by_type.get(tname, []):
            bs = barras_de_assembly(cand)
            if bs:
                return cand, bs
        insts = by_type.get(tname, [])
        return (insts[0], []) if insts else (None, [])

    def usable_rect(sheet):
        col = FilteredElementCollector(doc, sheet.Id).OfCategory(BuiltInCategory.OST_TitleBlocks)
        tb = col.FirstElement()
        if tb is not None:
            bb = tb.get_BoundingBox(sheet)
            if bb is not None:
                return (bb.Min.X + margin, bb.Min.Y + margin,
                        bb.Max.X - margin - right_reserve, bb.Max.Y - margin)
        o = sheet.Outline
        return (o.Min.U + margin, o.Min.V + margin,
                o.Max.U - margin - right_reserve, o.Max.V - margin)

    # --- que tipos de assembly hay colocados en cada sheet destino (solo plantas ARMADURA) ---
    tipos_por_sheet = {}
    for sh in target_sheets:
        tipos = set()
        for vpid in sh.GetAllViewports():
            vp = doc.GetElement(vpid)
            v = doc.GetElement(vp.ViewId)
            n = elem_name(v)
            if not n.endswith(SUFIJO_ARMADURAS):
                continue
            base = n[:-len(SUFIJO_ARMADURAS)]
            if base in by_type:
                tipos.add(base)
        if tipos:
            tipos_por_sheet[sh.SheetNumber] = (sh, tipos)

    if not tipos_por_sheet:
        log.append('Ningun sheet destino tiene plantas de assembly (ARMADURA) colocadas todavia.')
        log.append('Corre 00 / 01 / 02 primero.')
        OUT = log
    else:
        estilos_linea = list(FilteredElementCollector(doc).OfClass(GraphicsStyle))
        tipos_texto = list(FilteredElementCollector(doc).OfClass(TextNoteType))

        def buscar_por_nombre(coleccion, nombre, etiqueta):
            if not nombre:
                return None
            low = nombre.lower()
            for e in coleccion:
                if elem_name(e).lower() == low:
                    return e
            log.append('AVISO: no se encontro {} "{}"; se deja el valor por defecto.'.format(etiqueta, nombre))
            return None

        estilo_grid = buscar_por_nombre(estilos_linea, grid_style_name, 'el estilo de linea')
        tipo_header = buscar_por_nombre(tipos_texto, header_text_name, 'el tipo de texto de encabezados')
        tipo_body = buscar_por_nombre(tipos_texto, body_text_name, 'el tipo de texto de cuerpo')

        templates_schedule = [v for v in FilteredElementCollector(doc).OfClass(ViewSchedule) if v.IsTemplate]
        template_tabla = None
        if template_nombre:
            low_t = template_nombre.lower()
            template_tabla = next((v for v in templates_schedule if elem_name(v).lower() == low_t), None)
            if template_tabla is None:
                log.append('AVISO: no se encontro el view template de schedule "{}".'.format(template_nombre))

        def buscar_parametro_fuzzy(el, nombre):
            low = nombre.lower().strip()
            try:
                for p in el.Parameters:
                    try:
                        if p.Definition.Name.lower().strip() == low:
                            return p
                    except Exception:
                        continue
            except Exception:
                pass
            return None

        def set_param_by_name(el, nombre, valor):
            try:
                p = buscar_parametro_fuzzy(el, nombre)
                if p is None or p.IsReadOnly:
                    return False
                if p.StorageType == StorageType.ElementId:
                    p.Set(valor.Id if hasattr(valor, 'Id') else valor)
                elif p.StorageType == StorageType.Integer:
                    p.Set(int(valor))
                elif p.StorageType == StorageType.String:
                    p.Set(str(valor))
                else:
                    return False
                return True
            except Exception:
                return False

        # --- bootstrap de parametros compartidos (SHEET_ARMADURAS + ARM_*) ---
        guids_arm = {}   # nombre -> Guid
        guid_sheet_arm = [None]  # lista para poder mutar desde funcion anidada

        def cat_rebar():
            try:
                return doc.Settings.Categories.get_Item(BuiltInCategory.OST_Rebar)
            except Exception:
                return None

        def asegurar_binding_rebar(definition):
            # asegura que 'definition' este enlazada (instancia) a la categoria Rebar,
            # preservando las categorias que ya tuviera (para SHEET_ARMADURAS, que ya
            # existe enlazada a otras categorias de la corrida vieja).
            app = doc.Application
            rebar_c = cat_rebar()
            if rebar_c is None:
                return
            bmap = doc.ParameterBindings
            it = bmap.ForwardIterator()
            it.Reset()
            binding_existente = None
            while it.MoveNext():
                d = it.Key
                if d is not None and d.Name == definition.Name:
                    binding_existente = it.Current
                    break
            cats = app.Create.NewCategorySet()
            ya = False
            if binding_existente is not None:
                for c in binding_existente.Categories:
                    cats.Insert(c)
                    if c.Id.Value == rebar_c.Id.Value:
                        ya = True
            if ya:
                return
            cats.Insert(rebar_c)
            binding = app.Create.NewInstanceBinding(cats)
            if binding_existente is not None:
                bmap.ReInsert(definition, binding, GroupTypeId.Data)
            else:
                bmap.Insert(definition, binding, GroupTypeId.Data)

        def asegurar_params():
            # crea/ubica SHEET_ARMADURAS y los ARM_*; enlaza todos a la categoria Rebar.
            app = doc.Application
            old_file = app.SharedParametersFilename
            tmp = os.path.join(tempfile.gettempdir(), 'bios_params_armaduras.txt')
            if not os.path.exists(tmp):
                f = open(tmp, 'w')
                f.close()
            app.SharedParametersFilename = tmp
            try:
                deffile = app.OpenSharedParameterFile()
                grupo = None
                for g in deffile.Groups:
                    if g.Name == 'ARMADURAS':
                        grupo = g
                        break
                if grupo is None:
                    grupo = deffile.Groups.Create('ARMADURAS')

                nombres = [NOMBRE_PARAM_SHEET_ARM] + NOMBRES_ARM
                spe_por_nombre = {}
                for spe in FilteredElementCollector(doc).OfClass(SharedParameterElement):
                    spe_por_nombre[elem_name(spe)] = spe

                for nombre in nombres:
                    spe = spe_por_nombre.get(nombre)
                    if spe is None:
                        # aun no existe en el proyecto: definir en el archivo compartido y bindear
                        definicion = grupo.Definitions.get_Item(nombre)
                        if definicion is None:
                            opts = ExternalDefinitionCreationOptions(nombre, SpecTypeId.String.Text)
                            definicion = grupo.Definitions.Create(opts)
                        rebar_c = cat_rebar()
                        cats = app.Create.NewCategorySet()
                        if rebar_c is not None:
                            cats.Insert(rebar_c)
                        binding = app.Create.NewInstanceBinding(cats)
                        doc.ParameterBindings.Insert(definicion, binding, GroupTypeId.Data)
                    else:
                        # ya existe: solo asegurar que llegue a la categoria Rebar
                        idef = None
                        try:
                            idef = spe.GetDefinition()
                        except Exception:
                            idef = None
                        if idef is not None:
                            asegurar_binding_rebar(idef)
            finally:
                app.SharedParametersFilename = old_file
            doc.Regenerate()

            # recolectar guids finales
            for spe in FilteredElementCollector(doc).OfClass(SharedParameterElement):
                nombre = elem_name(spe)
                if nombre == NOMBRE_PARAM_SHEET_ARM:
                    guid_sheet_arm[0] = spe.GuidValue
                elif nombre in NOMBRES_ARM:
                    guids_arm[nombre] = spe.GuidValue

        # --- definicion de columnas: (clave, referencia, encabezado) ---
        # La referencia dice de donde sale el valor de la columna:
        #   Guid            -> parametro compartido de la barra, VIVO (MARCA = ITEM_TBL y
        #                      los tramos A..F = los parametros reales de la RebarShape)
        #   ('nat', [...])  -> campo nativo de Revit, VIVO; se busca por nombre de campo y
        #                      se toma el primero de la lista que exista
        #   'ARM_xxx'       -> parametro compartido que escribe este graph, FOTO
        COLS = [
            ('marca', GUID_ITEM, 'MARCA'),
            ('tipo', ('nat', ['Shape', 'Shape Name']), 'TIPO'),
            ('diam', ('nat', ['Bar Diameter']), 'Diam (mm)'),
            ('cant', ('nat', ['Quantity']), 'CANTIDAD TOTAL BARRAS'),
            ('a', GUID_A, 'A (mm)'),
            ('b', GUID_B, 'B (mm)'),
            ('c', GUID_C, 'C (mm)'),
            ('d', GUID_D, 'D (mm)'),
            ('e', GUID_E, 'E (mm)'),
            ('f', GUID_F, 'F (mm)'),
            ('unit', 'ARM_UNIT', 'UNIT. (m)'),
            ('total', 'ARM_TOTAL', 'TOTAL (m)'),
            ('peso_u', 'ARM_PESO_U', 'PESO UNIT. (Kg)'),
            ('peso_t', 'ARM_PESO_T', 'PESO TOTAL (Kg)'),
            ('obs', ('nat', ['Comments']), 'OBSERVACION'),
        ]
        # columnas de longitud a forzar a mm enteros: el campo nativo trae el formato de
        # unidades del proyecto, que puede venir con decimales o con el sufijo "mm".
        COLS_MM = set(['diam', 'a', 'b', 'c', 'd', 'e', 'f'])
        # columnas numericas que deben SUMARSE al colapsar la fila en vez de partirla
        COLS_TOTALIZADAS = set(['cant'])

        def guid_de_col(ref):
            return ref if isinstance(ref, Guid) else guids_arm.get(ref)

        def campo_por_guid(schedulable, guid):
            if guid is None:
                return None
            spe = SharedParameterElement.Lookup(doc, guid)
            if spe is None:
                return None
            for f in schedulable:
                if f.ParameterId == spe.Id:
                    return f
            return None

        def campo_por_nombre(schedulable, nombres):
            for n in nombres:
                for f in schedulable:
                    try:
                        if f.GetName(doc) == n:
                            return f
                    except Exception:
                        continue
            return None

        def campo_de_col(schedulable, ref):
            if isinstance(ref, tuple):
                return campo_por_nombre(schedulable, ref[1])
            return campo_por_guid(schedulable, guid_de_col(ref))

        def aplicar_formato_mm(field, sheet_number, clave):
            try:
                fo = FormatOptions(UnitTypeId.Millimeters)
                try:
                    fo.Accuracy = 1.0
                except Exception:
                    pass
                try:
                    fo.SetSymbolTypeId(ForgeTypeId())
                except Exception:
                    pass
                field.SetFormatOptions(fo)
            except Exception as e:
                log.append('AVISO {}: no se pudo forzar mm en la columna {}: {}'.format(
                    sheet_number, clave, e))

        existing_schedules = {elem_name(v): v for v in FilteredElementCollector(doc).OfClass(ViewSchedule)}
        existing_sheet_instances = {}
        for ssi in FilteredElementCollector(doc).OfClass(ScheduleSheetInstance):
            existing_sheet_instances.setdefault(ssi.OwnerViewId.Value, []).append(ssi)

        def limpiar_definicion(definition):
            while definition.GetSortGroupFieldCount() > 0:
                definition.RemoveSortGroupField(0)
            while definition.GetFilterCount() > 0:
                definition.RemoveFilter(0)
            for i in range(definition.GetFieldCount() - 1, -1, -1):
                definition.RemoveField(definition.GetField(i).FieldId)

        def texto_ancho_columna(textos):
            candidatos = [t for t in textos if t]
            if not candidatos:
                return ANCHO_COL_MINIMO
            max_texto = max(candidatos, key=len)
            ancho = len(max_texto) * ANCHO_POR_CARACTER_MM / 304.8
            return max(ancho, ANCHO_COL_MINIMO)

        def anchos_desde_textos(textos_col):
            ideal = {clave: texto_ancho_columna(textos) for clave, textos in textos_col.items()}
            suma = sum(ideal.values())
            if suma > right_reserve and suma > 0:
                escala = right_reserve / suma
                return {clave: v * escala for clave, v in ideal.items()}
            return ideal

        def configurar_schedule(sched, sheet_number, textos_col):
            definition = sched.Definition
            definition.IsItemized = False
            limpiar_definicion(definition)
            schedulable = list(definition.GetSchedulableFields())

            # campos de agrupacion ocultos: ARM_L1 (assembly) y ARM_L2 (CANT), y filtro
            campo_l1 = campo_por_guid(schedulable, guids_arm.get('ARM_L1'))
            campo_l2 = campo_por_guid(schedulable, guids_arm.get('ARM_L2'))
            campo_filtro = campo_por_guid(schedulable, guid_sheet_arm[0])

            faltantes = []
            if campo_l1 is None:
                faltantes.append('ARM_L1')
            if campo_l2 is None:
                faltantes.append('ARM_L2')
            if campo_filtro is None:
                faltantes.append(NOMBRE_PARAM_SHEET_ARM)

            campos_col = {}
            for clave, ref, _hdr in COLS:
                c = campo_de_col(schedulable, ref)
                campos_col[clave] = c
                if c is None:
                    faltantes.append(clave)

            if faltantes:
                log.append('ERROR sheet {}: faltan campos en el schedule de barras: {}'.format(sheet_number, faltantes))
                nombres = sorted(set(f.GetName(doc) for f in schedulable))
                log.append('Campos disponibles (primeros 50): ' + ', '.join(nombres[:50]))
                return False

            # ARM_L1 y ARM_L2 primero, ocultos
            f_l1 = definition.AddField(campo_l1)
            f_l1.IsHidden = True
            f_l2 = definition.AddField(campo_l2)
            f_l2.IsHidden = True

            # columnas visibles en el orden de COLS
            idx_visibles = {}
            f_marca = None
            for clave, ref, hdr in COLS:
                f = definition.AddField(campos_col[clave])
                f.IsHidden = False
                f.ColumnHeading = hdr
                if clave in COLS_MM:
                    aplicar_formato_mm(f, sheet_number, clave)
                if clave in COLS_TOTALIZADAS:
                    # sin esto, dos barras del mismo grupo con distinta cantidad partirian
                    # la fila en vez de sumarse
                    try:
                        f.DisplayType = ScheduleFieldDisplayType.Totals
                    except Exception as e:
                        log.append('AVISO {}: no se pudo totalizar la columna {}: {}'.format(
                            sheet_number, clave, e))
                idx_visibles[clave] = definition.GetFieldCount() - 1
                if clave == 'marca':
                    f_marca = f

            # filtro oculto
            f_filtro = definition.AddField(campo_filtro)
            f_filtro.IsHidden = True

            # agrupacion: L1 (con encabezado) -> L2 (con encabezado) -> MARCA (sin encabezado,
            # colapsa una fila por marca)
            sg1 = ScheduleSortGroupField(f_l1.FieldId)
            sg1.ShowHeader = True
            definition.AddSortGroupField(sg1)
            sg2 = ScheduleSortGroupField(f_l2.FieldId)
            sg2.ShowHeader = True
            definition.AddSortGroupField(sg2)
            sg3 = ScheduleSortGroupField(f_marca.FieldId)
            sg3.ShowHeader = False
            definition.AddSortGroupField(sg3)

            definition.AddFilter(ScheduleFilter(f_filtro.FieldId, ScheduleFilterType.Equal, sheet_number))
            doc.Regenerate()

            if template_tabla is not None and sched.ViewTemplateId != template_tabla.Id:
                sched.ViewTemplateId = template_tabla.Id
                doc.Regenerate()

            if estilo_grid is not None:
                set_param_by_name(sched, 'Grid lines', estilo_grid)
                set_param_by_name(sched, 'Outline', estilo_grid)
            if tipo_header is not None:
                set_param_by_name(sched, 'Header text', tipo_header)
            if tipo_body is not None:
                set_param_by_name(sched, 'Body text', tipo_body)
            set_param_by_name(sched, 'Show Title', 1)
            set_param_by_name(sched, 'Show Headers', 1)

            anchos = anchos_desde_textos(textos_col)
            d = sched.Definition
            for clave, idx in idx_visibles.items():
                try:
                    d.GetField(idx).Width = anchos[clave]
                except Exception as e:
                    log.append('ERROR {} ancho {}: {}'.format(sheet_number, clave, e))

            p_titulo = sched.get_Parameter(BuiltInParameter.VIEW_DESCRIPTION)
            if p_titulo is not None and not p_titulo.IsReadOnly and p_titulo.AsString() != titulo_tabla:
                p_titulo.Set(titulo_tabla)
            return True

        creados = 0
        ya_estaban = 0
        limpiados = 0

        TransactionManager.Instance.EnsureInTransaction(doc)
        try:
            asegurar_params()
            if guid_sheet_arm[0] is None or any(n not in guids_arm for n in NOMBRES_ARM):
                log.append('ERROR: no se pudieron crear/enlazar los parametros compartidos de la tabla. No se creo nada.')
                faltan = [n for n in NOMBRES_ARM if n not in guids_arm]
                if guid_sheet_arm[0] is None:
                    faltan.append(NOMBRE_PARAM_SHEET_ARM)
                log.append('Faltantes: ' + ', '.join(faltan))
                tipos_por_sheet = {}

            def escribir(el, guid, valor):
                p = el.get_Parameter(guid)
                if p is not None and not p.IsReadOnly and p.AsString() != valor:
                    p.Set(valor)

            for sheet_number, (sh, tipos) in tipos_por_sheet.items():
                textos_col = dict((clave, [hdr]) for clave, _ref, hdr in COLS)

                # barras legitimas de este sheet (representante de cada tipo)
                barras_por_tipo = {}
                barras_legitimas = set()
                for tname in tipos:
                    ai, barras = representante_con_barras(tname)
                    barras_por_tipo[tname] = (ai, barras)
                    for r in barras:
                        barras_legitimas.add(r.Id.Value)

                # limpieza GLOBAL: cualquier elemento con SHEET_ARMADURAS = este sheet que
                # ya no sea legitimo (barras de corridas viejas, o fundaciones marcadas por
                # la version anterior de esta tabla) se limpia para que no filtre filas.
                regla = ParameterFilterRuleFactory.CreateEqualsRule(
                    SharedParameterElement.Lookup(doc, guid_sheet_arm[0]).Id, sheet_number)
                filtro_global = ElementParameterFilter(regla)
                for el in FilteredElementCollector(doc).WherePasses(filtro_global).WhereElementIsNotElementType().ToElements():
                    if el.Id.Value in barras_legitimas:
                        continue
                    pc_o = el.get_Parameter(guid_sheet_arm[0])
                    if pc_o is not None and not pc_o.IsReadOnly and pc_o.AsString():
                        pc_o.Set('')
                        limpiados += 1

                for tname in tipos:
                    ai, barras = barras_por_tipo[tname]
                    cant_assembly = len(by_type.get(tname, []))
                    cant_str = 'CANT={}'.format(cant_assembly)
                    if not barras:
                        log.append('AVISO: el tipo {} no tiene barras asociadas (sheet {}).'.format(tname, sheet_number))
                        continue

                    # Encabezado nivel 1: tiene que ser UNICO por TIPO de assembly. OJO:
                    # ELEMENTO_TBL es texto que cargan A MANO los modeladores y NO es unico
                    # por tipo - verificado por MCP sobre el modelo real: 132 barras de tipos
                    # de fundacion DISTINTOS comparten "FUNDACION FN-1002". Usarlo tal cual
                    # hacia que dos tipos cayeran bajo el MISMO encabezado y el segundo
                    # apareciera huerfano, mostrando solo su "CANT=N" sin nombre de assembly
                    # (bug reportado por Javier, 2026-07-21). Ahora ELEMENTO_TBL se usa solo
                    # si de verdad corresponde a ESTE tipo (contiene tname); si no, se
                    # reconstruye con su prefijo descriptivo (ej. "FUNDACION") + el nombre
                    # REAL del tipo, que es el unico dato autoritativo.
                    elems = [rebar_elemento(r) for r in barras if rebar_elemento(r)]
                    elem_txt = elems[0] if elems else ''
                    if elem_txt and tname in elem_txt:
                        header_l1 = elem_txt
                    else:
                        prefijo = ''
                        if elem_txt and ' ' in elem_txt:
                            prefijo = elem_txt.rsplit(' ', 1)[0].strip()
                        header_l1 = ('{} {}'.format(prefijo, tname)).strip() if prefijo else tname
                        if elem_txt:
                            log.append('AVISO {}: las barras traen ELEMENTO_TBL "{}", que no corresponde a este assembly; se usa "{}" como encabezado.'.format(tname, elem_txt, header_l1))

                    # Agrupar por la MISMA clave con que Revit va a colapsar las filas:
                    # todos los campos visibles que no se totalizan. Si se agrupara solo
                    # por MARCA, una marca con dos geometrias (ej. 1609 SUP.-INF.) saldria
                    # en dos filas y ambas mostrarian el TOTAL de la marca completa.
                    def clave_colapso(r):
                        return (rebar_marca(r), rebar_tipo(r), int(round(rebar_diam_mm(r))),
                                tuple([int(round(v)) for v in rebar_af_mm(r)]), rebar_obs(r))

                    por_grupo = {}
                    for r in barras:
                        por_grupo.setdefault(clave_colapso(r), []).append(r)

                    for clave, rs in por_grupo.items():
                        marca = clave[0]
                        # dentro del grupo las barras son identicas en lo que se muestra,
                        # asi que los valores unitarios salen de cualquiera de ellas
                        r0 = rs[0]
                        af = rebar_af_mm(r0)
                        diam = rebar_diam_mm(r0)
                        unit_m = sum(af) / 1000.0
                        peso_u = (diam * diam) * PESO_K * unit_m
                        cant_total = 0
                        for r in rs:
                            cant_total += rebar_quantity(r)
                        total_m = unit_m * cant_total
                        peso_total = peso_u * cant_total

                        # los valores calculados (foto) que se escriben a las barras
                        valores = {
                            'unit': formato_2dec(unit_m),
                            'total': formato_2dec(total_m),
                            'peso_u': formato_2dec(peso_u),
                            'peso_t': formato_2dec(peso_total),
                        }
                        # los nativos no se escriben: solo se leen aca para estimar el
                        # ancho de columna con el texto que Revit va a terminar mostrando
                        nativos = {
                            'tipo': rebar_tipo(r0), 'diam': str(int(round(diam))),
                            'cant': str(cant_total), 'obs': rebar_obs(r0),
                            'a': str(int(round(af[0]))), 'b': str(int(round(af[1]))),
                            'c': str(int(round(af[2]))), 'd': str(int(round(af[3]))),
                            'e': str(int(round(af[4]))), 'f': str(int(round(af[5]))),
                        }

                        # textos para calculo de ancho de columna
                        textos_col['marca'].append(marca)
                        for k, val in valores.items():
                            textos_col[k].append(val)
                        for k, val in nativos.items():
                            textos_col[k].append(val)

                        # escribir a cada barra del grupo (mismos valores -> colapsan)
                        for r in rs:
                            escribir(r, guid_sheet_arm[0], sheet_number)
                            escribir(r, guids_arm['ARM_L1'], header_l1)
                            escribir(r, guids_arm['ARM_L2'], cant_str)
                            escribir(r, guids_arm['ARM_UNIT'], valores['unit'])
                            escribir(r, guids_arm['ARM_TOTAL'], valores['total'])
                            escribir(r, guids_arm['ARM_PESO_U'], valores['peso_u'])
                            escribir(r, guids_arm['ARM_PESO_T'], valores['peso_t'])

                # --- crear / reconfigurar la tabla del sheet ---
                nombre_schedule = PREFIJO_SCHEDULE + sheet_number
                sched_existente = next(
                    (doc.GetElement(ssi.ScheduleId) for ssi in existing_sheet_instances.get(sh.Id.Value, [])
                     if doc.GetElement(ssi.ScheduleId) is not None
                     and elem_name(doc.GetElement(ssi.ScheduleId)) == nombre_schedule),
                    None)

                # si existe con este nombre pero de otra categoria (version anterior:
                # multi-categoria), borrarla: la categoria de un schedule no se cambia.
                candidato = sched_existente or existing_schedules.get(nombre_schedule)
                if candidato is not None and candidato.Definition.CategoryId != REBAR_CAT_ID:
                    doc.Delete(candidato.Id)
                    existing_schedules.pop(nombre_schedule, None)
                    sched_existente = None
                    candidato = None
                    log.append('AVISO: se recreo la tabla del sheet {} (era de otra categoria).'.format(sheet_number))

                if sched_existente is not None:
                    configurar_schedule(sched_existente, sheet_number, textos_col)
                    ya_estaban += 1
                    continue

                sched = existing_schedules.get(nombre_schedule)
                if sched is None:
                    sched = ViewSchedule.CreateSchedule(doc, REBAR_CAT_ID)
                    sched.Name = nombre_schedule
                    existing_schedules[nombre_schedule] = sched
                if not configurar_schedule(sched, sheet_number, textos_col):
                    continue

                x0, y0, x1, y1 = usable_rect(sh)
                punto = XYZ(x1, y1, 0.0)
                try:
                    ScheduleSheetInstance.Create(doc, sh.Id, sched.Id, punto)
                    creados += 1
                    log.append('OK: tabla de armaduras creada en sheet {} ({} tipos).'.format(sheet_number, len(tipos)))
                except Exception as e:
                    log.append('ERROR colocando la tabla en sheet {}: {}'.format(sheet_number, e))
        finally:
            TransactionManager.Instance.TransactionTaskDone()

        log.insert(0, 'Tablas creadas: {} | ya existian: {} | SHEET_ARMADURAS limpiados: {}'.format(
            creados, ya_estaban, limpiados))
        OUT = log
# ----------------------------------------
log = Watch(py_tabla_de_assemblies_por_sheet)  # graph output
