# Dynamo graph 05_Tags en plantas.dyn (Dynamo 4.0.2.3852)
# Coloca un Multi-Category Tag sobre las FAMILIAS (FamilyInstance) de cada assembly en las plantas que el usuario seleccione con click (viewports en la lamina, vistas o assemblies en el modelo). No etiqueta el assembly ni elementos de sistema.

tipo_de_tag_multi_category_tag = FamilyTypes("C-MultiCat:Modelo")  # graph input
plantas_a_etiquetar_click = DSModelElementsSelection()  # "Plantas a etiquetar (click: viewports, vistas o assemblies)"; nothing selected; graph input
tags_con_leader = BoolSelector(false)  # graph input
py_tag_multicategoria_solo_a = Python(IN[0]=tipo_de_tag_multi_category_tag, IN[1]=plantas_a_etiquetar_click, IN[2]=tags_con_leader)  # "PY | Tag multicategoria solo a familias"; PythonNet3
# ---------- py_tag_multicategoria_solo_a.python (165 lines) ----------
# 05_Tags en plantas - Multi-Category Tag SOLO a las familias, SOLO en plantas seleccionadas
# El usuario selecciona con click: viewports en la lamina, vistas de planta o assemblies
# en el modelo. Se etiquetan unicamente FamilyInstance (familias cargables), nunca el
# assembly ni elementos de sistema.
# Revit 2027 / Dynamo 4 / CPython3
# IN[0] = tipo de tag (dropdown Family Types; debe ser Multi-Category Tag)
# IN[1] = seleccion (Select Model Elements)
# IN[2] = tags con leader (bool)

import clr
clr.AddReference('RevitAPI')
clr.AddReference('RevitServices')
from Autodesk.Revit.DB import (FilteredElementCollector, AssemblyInstance, View,
                               Viewport, IndependentTag, Reference, TagOrientation,
                               BuiltInCategory, ElementId, XYZ, Element, FamilyInstance)
from RevitServices.Persistence import DocumentManager
from RevitServices.Transactions import TransactionManager

doc = DocumentManager.Instance.CurrentDBDocument

tag_type = UnwrapElement(IN[0])
sel = UnwrapElement(IN[1])
leader = bool(IN[2])

if sel is None:
    sel = []
elif not isinstance(sel, list):
    sel = [sel]

log = []

def elem_name(e):
    try:
        return e.Name
    except Exception:
        return Element.Name.__get__(e)

def tag_label(t):
    try:
        return '{} : {}'.format(t.FamilyName, elem_name(t))
    except Exception:
        return 'Id ' + str(t.Id)

# --- validar que lo elegido sea un Multi-Category Tag ---
mc_cat = ElementId(BuiltInCategory.OST_MultiCategoryTags)
valido = (tag_type is not None and tag_type.Category is not None
          and tag_type.Category.Id == mc_cat)

if not valido:
    log.append('ERROR: el tipo seleccionado NO es un Multi-Category Tag.')
    log.append('Tags multicategoria cargados en el proyecto:')
    tt = list(FilteredElementCollector(doc)
              .OfCategory(BuiltInCategory.OST_MultiCategoryTags)
              .WhereElementIsElementType())
    if not tt:
        log.append('  (ninguno - carga una familia de Multi-Category Tag al proyecto)')
    for t in tt:
        log.append('  - ' + tag_label(t))
    OUT = log
elif not sel:
    log.append('ERROR: no hay nada seleccionado.')
    log.append('Selecciona con click las plantas a etiquetar (viewports en la lamina,')
    log.append('vistas de planta o assemblies en el modelo) y vuelve a correr.')
    OUT = log
else:
    # contrato de nombres de la rutina de ARMADURAS (ver 00): solo se taguean
    # las plantas 'FN-1001 - ARMADURA'; una planta de Formas seleccionada por
    # error se ignora con aviso (no se ensucia).
    SUFIJO_ARMADURAS = ' - ARMADURA'
    by_type = {}
    for ai in FilteredElementCollector(doc).OfClass(AssemblyInstance):
        by_type.setdefault(ai.AssemblyTypeName, []).append(ai)

    views = {}
    for v in FilteredElementCollector(doc).OfClass(View):
        if not v.IsTemplate:
            views[elem_name(v)] = v

    # --- resolver la seleccion a plantas de assembly ---
    objetivo = {}
    for s in sel:
        v = None
        if isinstance(s, Viewport):
            v = doc.GetElement(s.ViewId)
        elif isinstance(s, View):
            v = s
        elif isinstance(s, AssemblyInstance):
            tn = s.AssemblyTypeName
            if tn + SUFIJO_ARMADURAS in views:
                objetivo[tn] = (views[tn + SUFIJO_ARMADURAS], s)
            else:
                log.append('AVISO: el assembly {} no tiene planta de ARMADURAS (corre 00_Vistas de assembly).'.format(tn))
            continue
        else:
            log.append('AVISO: seleccion ignorada ({}, no es viewport, vista ni assembly).'.format(s.GetType().Name))
            continue
        tn = elem_name(v)
        base = tn[:-len(SUFIJO_ARMADURAS)] if tn.endswith(SUFIJO_ARMADURAS) else None
        if base and base in by_type:
            objetivo[base] = (v, by_type[base][0])
        else:
            log.append('AVISO: la vista \"{}\" no es una planta de ARMADURAS de assembly, se ignora.'.format(tn))

    if not objetivo:
        log.append('ERROR: la seleccion no contiene ninguna planta de assembly valida.')
        OUT = log
    else:
        total = 0
        TransactionManager.Instance.EnsureInTransaction(doc)
        try:
            if hasattr(tag_type, 'IsActive') and not tag_type.IsActive:
                tag_type.Activate()
            for tname in sorted(objetivo.keys()):
                vplan, ai = objetivo[tname]
                existentes = FilteredElementCollector(doc, vplan.Id).OfClass(IndependentTag).GetElementCount()
                if existentes > 0:
                    log.append('{}: la planta ya tiene {} tags, se salta.'.format(tname, existentes))
                    continue
                n = 0
                no_familia = 0
                anidadas = 0
                no_tageables = 0
                for mid in ai.GetMemberIds():
                    el = doc.GetElement(mid)
                    if el is None or el.Category is None:
                        continue
                    if not isinstance(el, FamilyInstance):
                        no_familia += 1
                        continue
                    # familias anidadas dentro de otra familia: tienen SuperComponent
                    sup = None
                    try:
                        sup = el.SuperComponent
                    except Exception:
                        pass
                    if sup is not None:
                        anidadas += 1
                        continue
                    try:
                        bb = el.get_BoundingBox(None)
                        if bb is None:
                            continue
                        centro = XYZ((bb.Min.X + bb.Max.X) / 2.0,
                                     (bb.Min.Y + bb.Max.Y) / 2.0,
                                     (bb.Min.Z + bb.Max.Z) / 2.0)
                        IndependentTag.Create(doc, tag_type.Id, vplan.Id, Reference(el),
                                              leader, TagOrientation.Horizontal, centro)
                        n += 1
                    except Exception:
                        no_tageables += 1
                total += n
                msg = 'OK {}: {} tags (solo familias).'.format(tname, n)
                if no_familia:
                    msg += ' {} elementos de sistema omitidos.'.format(no_familia)
                if anidadas:
                    msg += ' {} familias anidadas omitidas.'.format(anidadas)
                if no_tageables:
                    msg += ' {} familias no admiten este tag.'.format(no_tageables)
                log.append(msg)
        finally:
            TransactionManager.Instance.TransactionTaskDone()

        log.insert(0, 'Tags creados: {} | plantas procesadas: {} | tag: {}'.format(
            total, len(objetivo), tag_label(tag_type)))
        OUT = log
# ----------------------------------------
log = Watch(py_tag_multicategoria_solo_a)  # graph output
