# Dynamo graph 06_Tabla de assemblies.dyn (Dynamo 4.0.2.3852)
# ARMADURAS - Crea, por cada sheet destino de la rutina de armaduras, la tabla de cantidades de los assemblies documentados en ESE sheet (plantas con sufijo ' - ARMADURA'). Filtra por el parametro compartido SHEET_ARMADURAS (se crea y bindea solo si falta) - NO usa Comments, que es el filtro de las tablas de la rutina de Formas y no debe pisarse. Nombre de schedule TBL_ARMADURAS_{sheet}. Se coloca en la esquina superior derecha, en la franja reservada por 01/02.

sheets_destino_numeros_con_coma = StringInput("")  # "Sheets destino (numeros con coma, o prefijo)"; graph input
margen_mm = IntegerSlider(20, range=5..50 step 1)  # graph input
reserva_lado_derecho_mm = IntegerSlider(150, range=0..200 step 5)  # graph input
estilo_de_linea_grid_outline = StringInput("Líneas Tablas Finas")  # graph input
tipo_de_texto_encabezados = StringInput("C_TXT_RomanD2.3mm")  # graph input
tipo_de_texto_cuerpo = StringInput("C_TXT_RomanD2.3mm_Negrita")  # graph input
titulo_de_la_tabla = StringInput("")  # graph input
view_template_para_las_tablas = StringInput("TABLA_TIPO")  # graph input
py_tabla_de_assemblies_por_sheet = Python(IN[0]=sheets_destino_numeros_con_coma, IN[1]=margen_mm, IN[2]=reserva_lado_derecho_mm, IN[3]=estilo_de_linea_grid_outline, IN[4]=tipo_de_texto_encabezados, IN[5]=tipo_de_texto_cuerpo, IN[6]=titulo_de_la_tabla, IN[7]=view_template_para_las_tablas)  # PythonNet3
# ---------- py_tabla_de_assemblies_por_sheet.python (773 lines) ----------
# 06_Tabla de assemblies - Crea, por cada sheet destino, un schedule nativo de Revit
# (Multi-Categoria) con la tabla de cantidades completa de los assemblies documentados
# en ESE sheet: encabezado con el nombre del assembly y su "CANT=N", y debajo una fila
# por cada TIPO DE FAMILIA miembro (recursivo, incluye anidadas) con columnas
# DESCRIPCION / UNIDAD / UNITARIO / TOTAL / MATERIAL / COMENTARIO.
#
# Reglas de negocio (definidas por el usuario):
# - Structural Foundation: UNIDAD = m3, UNITARIO = suma del VOLUMEN DE LA GEOMETRIA
#   (solidos reales del elemento, no el parametro VOLUMEN_TBL que llenan a mano los
#   modeladores) de todas las instancias de ese tipo dentro del assembly.
# - Structural Framing y Generic Models: se ignoran completamente (no generan fila) -
#   Generic Models por filtro de trabajo propio de la oficina.
# - Cualquier otra categoria: UNIDAD = un, UNITARIO = cantidad de instancias de ese tipo.
# - TOTAL = UNITARIO x CANT (cantidad de instancias del assembly en el proyecto) -
#   precalculado en Python y escrito como texto (Status Vendor); se abandono el campo
#   calculado nativo del schedule por poca confiabilidad.
# - MATERIAL = se lee tal cual del parametro compartido MATERIAL (no se calcula).
# - COMENTARIO = queda vacio, lo completa el modelador despues.
#
# Mecanica: no existe un campo nativo confiable que diga "a que assembly pertenezco" (se
# probo "Assembly Name"/"Assembly Description"/"Assembly Code": ninguno trae un valor
# real por elemento, con lo que todo colapsaba en un solo grupo sin nombre). Tampoco sirve
# escribir en el esquema _TBL (Mark, ZONA_TBL, etc.): en las familias anidadas mas
# profundas (la geometria real, ej. la pieza de hormigon) esos campos quedan BLOQUEADOS
# por formula de familia (heredan su valor del contenedor que las aloja), aunque el MISMO
# campo si sea editable en el elemento contenedor. Se reutiliza en cambio el parametro
# compartido `TAG` (fuera del esquema _TBL, sin formula asociada, confirmado editable
# tanto en hojas como en contenedores) para guardar el nombre del assembly (encabezado
# nivel 1). El "CANT=N" (encabezado nivel 2) tampoco se pudo escribir en
# ELEMENTO_CANT_STR_TBL (mismo problema: bloqueado por formula en algunas familias, con
# valores viejos filtrando) - se reutiliza `Part Number` para esto. Ademas: UNIDAD_TBL,
# RECUENTO_TBL, ELEMENTO_CANT_TBL (numerico, solo para el campo calculado TOTAL), y
# SHEET_ARMADURAS = numero de sheet (filtro PROPIO de la rutina de ARMADURAS - NO se usa
# Comments como en la rutina de Formas: Comments ya guarda el numero de sheet de FORMAS
# y es el filtro de ESAS tablas, pisarlo las vaciaria; los miembros son los MISMOS
# elementos fisicos en ambas rutinas). Los parametros compartidos se acceden por GUID (no
# por nombre) para evitar ambiguedad con el parametro built-in "Material" que coexiste
# con el compartido "MATERIAL".
#
# Solo se recorren los miembros de la PRIMERA instancia de cada tipo de assembly (misma
# convencion del resto del pipeline: se documenta un solo representante por tipo).
#
# Revit 2027 / Dynamo 4 / CPython3
# IN[0] = sheets destino: numeros separados por coma, o un prefijo comun
# IN[1] = margen (mm), misma convencion que 01/02
# IN[2] = reserva lado derecho (mm) - debe coincidir con 01 y 02
# IN[3] = nombre del estilo de linea para grid/outline del schedule (vacio = no tocar)
# IN[4] = nombre del tipo de texto para encabezados (vacio = no tocar)
# IN[5] = nombre del tipo de texto para el cuerpo (vacio = no tocar)
# IN[6] = titulo de la tabla (se aplica a TODAS las tablas creadas; vacio = titulo en blanco)
# IN[7] = nombre del view template para las tablas (default "TABLA_TIPO"; vacio = no aplicar)

import clr
clr.AddReference('RevitAPI')
clr.AddReference('RevitServices')
from Autodesk.Revit.DB import (FilteredElementCollector, AssemblyInstance, ViewSheet,
                               ScheduleSheetInstance, ViewSchedule, ScheduleFilter,
                               ScheduleFilterType, ScheduleSortGroupField, BuiltInCategory,
                               BuiltInParameter, ElementId, XYZ, Element, TextNoteType,
                               GraphicsStyle, StorageType, FamilyInstance, SharedParameterElement,
                               UnitUtils, UnitTypeId, ParameterFilterRuleFactory, ElementParameterFilter,
                               ScheduleFieldType, Options, ViewDetailLevel, Solid, GeometryInstance,
                               ExternalDefinitionCreationOptions, SpecTypeId, CategoryType, GroupTypeId)
from RevitServices.Persistence import DocumentManager
from RevitServices.Transactions import TransactionManager
from System import Guid
import os
import tempfile

doc = DocumentManager.Instance.CurrentDBDocument

sheets_text = (IN[0] or '').strip()
margin = float(IN[1]) / 304.8
right_reserve = float(IN[2]) / 304.8
grid_style_name = (IN[3] or '').strip()
header_text_name = (IN[4] or '').strip()
body_text_name = (IN[5] or '').strip()
titulo_tabla = (IN[6] or '').strip()
template_nombre = (IN[7] or '').strip()

# GUIDs de parametros compartidos del proyecto (esquema _TBL ya existente en la oficina)
GUID_UNIDAD = Guid('d1cc7ce1-6e2e-4ca7-8804-89ae0d757d42')
GUID_RECUENTO = Guid('60cfbf4b-feb5-4fb7-95fe-339d3211ac18')
GUID_ELEMENTO_CANT = Guid('6cd0bb60-c7a5-430b-9dc8-2d6c70dcf41f')
GUID_ELEMENTO_CANT_STR = Guid('a0d6fa5c-9625-4e99-ac1e-b6330d86ba25')
GUID_MATERIAL = Guid('28f7af94-3948-4837-8d3a-f84a69791961')
GUID_TAG = Guid('7e3a03e3-1771-478b-ad2e-edd00325f602')  # TAG (fuera del esquema _TBL, sin formula), reusado para el nombre del assembly
GUID_PART_NUMBER = Guid('d74d29ed-8dd8-404b-b16d-6d5c110b7f67')  # Part Number (fuera del esquema _TBL, sin formula), reusado para "CANT=N"
GUID_TOTAL_PLACEHOLDER = Guid('8c16c90e-4802-4747-96dc-73e116d7e3ed')  # Status Vendor, columna TOTAL provisional (vacia mientras no se calcula)

# contrato de la rutina de ARMADURAS (ver 00): solo cuentan las plantas con
# sufijo ' - ARMADURA'. Prefijo de schedule PROPIO para no reconfigurar jamas
# una tabla TBL_ASSEMBLIES_* de la rutina de Formas (configurar_schedule
# retrofitea todo lo que matchee por nombre).
SUFIJO_ARMADURAS = ' - ARMADURA'
NOMBRE_PARAM_SHEET_ARM = 'SHEET_ARMADURAS'
PREFIJO_SCHEDULE = 'TBL_ARMADURAS_'
MULTI_CAT_ID = ElementId.InvalidElementId
CAT_FOUNDATION = ElementId(BuiltInCategory.OST_StructuralFoundation)
CAT_FRAMING = ElementId(BuiltInCategory.OST_StructuralFraming)
CAT_GENERIC_MODEL = ElementId(BuiltInCategory.OST_GenericModel)  # filtro de oficina: nunca aparecen en la tabla

# el ancho de cada columna se calcula del texto mas largo que va a mostrar ESA
# tabla (ver texto_ancho_columna mas abajo), no de una fraccion fija del ancho
# reservado - evita que un valor largo pase a una segunda linea (o quede
# cortado) dentro de la celda e infle el alto de toda esa fila (2026-07-13).
# Se probaron dos formas de estimarlo: fraccion fija del ancho reservado, y
# medir el ancho REAL con un TextNote temporal (TextNote.Width) - ninguna
# funciono de forma confiable (la medicion con TextNote no reproducia fielmente
# como Revit dibuja el texto DENTRO de una celda de schedule: el texto seguia
# quedando cortado pese a que el ancho fijado coincidia con lo medido). Se opto
# por un ancho fijo y generoso por caracter (2.5 mm, incluye espacios) en vez
# de perseguir precision que la API no permite verificar - mejor una columna
# un poco mas ancha de lo necesario que texto cortado.
ANCHO_POR_CARACTER_MM = 2.5
ANCHO_COL_MINIMO = 10.0 / 304.8  # piso absoluto por columna (10 mm)

log = []

def elem_name(e):
    try:
        return e.Name
    except Exception:
        return Element.Name.__get__(e)

def set_double_smart(p, valor_real):
    try:
        spec = p.GetUnitTypeId()
        if spec is not None and not spec.Empty():
            p.Set(UnitUtils.ConvertToInternalUnits(valor_real, spec))
            return
    except Exception:
        pass
    p.Set(valor_real)

def volumen_geometria(el):
    # volumen real (m3) sumando los solidos de la geometria propia del elemento
    # (incluye simbolos anidados via GeometryInstance) - no depende de ningun
    # parametro, ni built-in ni compartido, por eso es inmune a que un modelador
    # deje VOLUMEN_TBL sin llenar o desactualizado.
    total_ft3 = 0.0
    opt = Options()
    opt.DetailLevel = ViewDetailLevel.Fine
    geo = el.get_Geometry(opt)
    if geo is None:
        return 0.0
    for g in geo:
        if isinstance(g, Solid) and g.Volume > 1e-9:
            total_ft3 += g.Volume
        elif isinstance(g, GeometryInstance):
            for sg in g.GetSymbolGeometry():
                if isinstance(sg, Solid) and sg.Volume > 1e-9:
                    total_ft3 += sg.Volume
    return UnitUtils.ConvertFromInternalUnits(total_ft3, UnitTypeId.CubicMeters)

def formatear_numero(n):
    # coma decimal (convencion chilena) igual a como Revit muestra RECUENTO_TBL;
    # enteros sin decimales, el resto hasta 3 decimales sin ceros de mas al final.
    if abs(n - round(n)) < 1e-9:
        return str(int(round(n)))
    texto = '{:.3f}'.format(n).rstrip('0').rstrip('.')
    return texto.replace('.', ',')

# --- sheets destino (misma logica que 02_Colocar vistas en laminas) ---
all_sheets = {}
for s in FilteredElementCollector(doc).OfClass(ViewSheet):
    all_sheets[s.SheetNumber] = s

target_sheets = []
seen = set()
for tok in [t.strip() for t in sheets_text.split(',') if t.strip()]:
    if tok in all_sheets:
        matches = [all_sheets[tok]]
    else:
        matches = [s for n, s in all_sheets.items() if n.startswith(tok)]
    for s in matches:
        if s.SheetNumber not in seen:
            seen.add(s.SheetNumber)
            target_sheets.append(s)
target_sheets.sort(key=lambda s: s.SheetNumber)

if not target_sheets:
    log.append('ERROR: ningun sheet coincide con "{}".'.format(sheets_text))
    log.append('Sheets del proyecto: ' + ', '.join(sorted(all_sheets.keys())[:30]))
    OUT = log
else:
    by_type = {}
    for ai in FilteredElementCollector(doc).OfClass(AssemblyInstance):
        by_type.setdefault(ai.AssemblyTypeName, []).append(ai)

    def usable_rect(sheet):
        # misma funcion que 01/02: area util = bbox de la viñeta menos margenes
        # (y reserva derecha); la tabla se ancla justo a la derecha de x1.
        col = FilteredElementCollector(doc, sheet.Id).OfCategory(BuiltInCategory.OST_TitleBlocks)
        tb = col.FirstElement()
        if tb is not None:
            bb = tb.get_BoundingBox(sheet)
            if bb is not None:
                return (bb.Min.X + margin, bb.Min.Y + margin,
                        bb.Max.X - margin - right_reserve, bb.Max.Y - margin)
        o = sheet.Outline
        return (o.Min.U + margin, o.Min.V + margin,
                o.Max.U - margin - right_reserve, o.Max.V - margin)

    # --- que tipos de assembly (plantas) hay colocados en cada sheet destino ---
    tipos_por_sheet = {}
    for sh in target_sheets:
        tipos = set()
        for vpid in sh.GetAllViewports():
            vp = doc.GetElement(vpid)
            v = doc.GetElement(vp.ViewId)
            n = elem_name(v)
            # solo cuentan las plantas de ARMADURAS ('FN-1001 - ARMADURA'); las
            # plantas de Formas (nombre = assembly a secas) se ignoran, asi apuntar
            # por error a un sheet de Formas no hace nada en este graph.
            if not n.endswith(SUFIJO_ARMADURAS):
                continue
            base = n[:-len(SUFIJO_ARMADURAS)]
            if base in by_type:
                tipos.add(base)
        if tipos:
            tipos_por_sheet[sh.SheetNumber] = (sh, tipos)

    if not tipos_por_sheet:
        log.append('Ningun sheet destino tiene plantas de assembly colocadas todavia.')
        log.append('Corre 00_Vistas de assembly, 01_Calcular y crear laminas y 02_Colocar vistas en laminas primero.')
        OUT = log
    else:
        estilos_linea = list(FilteredElementCollector(doc).OfClass(GraphicsStyle))
        tipos_texto = list(FilteredElementCollector(doc).OfClass(TextNoteType))

        def buscar_por_nombre(coleccion, nombre, etiqueta):
            if not nombre:
                return None
            low = nombre.lower()
            for e in coleccion:
                if elem_name(e).lower() == low:
                    return e
            log.append('AVISO: no se encontro {} "{}"; se deja el valor por defecto del schedule.'.format(etiqueta, nombre))
            return None

        estilo_grid = buscar_por_nombre(estilos_linea, grid_style_name, 'el estilo de linea')
        tipo_header = buscar_por_nombre(tipos_texto, header_text_name, 'el tipo de texto de encabezados')
        tipo_body = buscar_por_nombre(tipos_texto, body_text_name, 'el tipo de texto de cuerpo')

        templates_schedule = [v for v in FilteredElementCollector(doc).OfClass(ViewSchedule) if v.IsTemplate]
        template_tabla = None
        if template_nombre:
            low_t = template_nombre.lower()
            template_tabla = next((v for v in templates_schedule if elem_name(v).lower() == low_t), None)
            if template_tabla is None:
                log.append('AVISO: no se encontro el view template de schedule "{}"; las tablas quedan sin template.'.format(template_nombre))
                if templates_schedule:
                    log.append('Templates de schedule disponibles: ' + ', '.join(sorted(elem_name(v) for v in templates_schedule)))

        def buscar_parametro_fuzzy(el, nombre):
            # LookupParameter exige coincidencia EXACTA de mayusculas/formato; los
            # parametros de Appearance del schedule (Grid lines, Show Title, etc.) no
            # siempre calzan asi. Se recorre la lista real de parametros del elemento
            # comparando en minusculas.
            low = nombre.lower().strip()
            try:
                for p in el.Parameters:
                    try:
                        if p.Definition.Name.lower().strip() == low:
                            return p
                    except Exception:
                        continue
            except Exception:
                pass
            return None

        def set_param_by_name(el, nombre, valor):
            try:
                p = buscar_parametro_fuzzy(el, nombre)
                if p is None or p.IsReadOnly:
                    return False
                if p.StorageType == StorageType.ElementId:
                    p.Set(valor.Id if hasattr(valor, 'Id') else valor)
                elif p.StorageType == StorageType.Integer:
                    p.Set(int(valor))
                elif p.StorageType == StorageType.String:
                    p.Set(str(valor))
                else:
                    return False
                return True
            except Exception:
                return False

        def miembros_recursivos(ai):
            # miembros del assembly + sus sub-componentes anidados (cualquier profundidad).
            # Un elemento que a su vez CONTIENE sub-componentes es un contenedor/anfitrion
            # (ej. la familia "envoltorio" nombrada igual que el assembly, sin geometria
            # propia): no se cuenta el mismo como fila, solo se recorren sus hijos. Solo
            # las hojas (elementos sin sub-componentes propios) generan filas. Devuelve
            # tambien los contenedores encontrados, para poder limpiarles el Comments si
            # una corrida anterior (con el bug de contar el contenedor) los dejo marcados.
            vistos = set()
            hojas = []
            contenedores = []
            stack = list(ai.GetMemberIds())
            while stack:
                eid = stack.pop()
                if eid.Value in vistos:
                    continue
                vistos.add(eid.Value)
                el = doc.GetElement(eid)
                if el is None or not isinstance(el, FamilyInstance):
                    continue
                subs = []
                try:
                    subs = list(el.GetSubComponentIds())
                except Exception:
                    pass
                if subs:
                    contenedores.append(el)
                    stack.extend(subs)
                else:
                    hojas.append(el)
            return hojas, contenedores

        def campo_por_guid(schedulable, guid):
            spe = SharedParameterElement.Lookup(doc, guid)
            if spe is None:
                return None
            for f in schedulable:
                if f.ParameterId == spe.Id:
                    return f
            return None

        spe_sheet_arm = None
        guid_sheet_arm = None

        def asegurar_param_sheet_arm():
            # parametro compartido de FILTRO de las tablas de ARMADURAS. NO se usa
            # Comments (como hace la rutina de Formas): Comments ya guarda el numero
            # de sheet de FORMAS y es el filtro de esas tablas ya emitidas - pisarlo
            # con el numero de la lamina de armaduras las vaciaria (los miembros son
            # los MISMOS elementos fisicos). Un parametro propio evita el conflicto.
            # Si no existe en el proyecto, se crea y bindea aca mismo (instancia,
            # texto, todas las categorias de modelo que admiten parametros) - mismo
            # espiritu bootstrap que los tipos de viewport de 02. Requiere
            # transaccion activa. Los multi-category schedules solo aceptan campos
            # de parametros COMPARTIDOS, por eso no sirve un project parameter comun.
            for spe in FilteredElementCollector(doc).OfClass(SharedParameterElement):
                if elem_name(spe) == NOMBRE_PARAM_SHEET_ARM:
                    return spe
            app = doc.Application
            old_file = app.SharedParametersFilename
            tmp = os.path.join(tempfile.gettempdir(), 'bios_params_armaduras.txt')
            if not os.path.exists(tmp):
                f = open(tmp, 'w')
                f.close()
            app.SharedParametersFilename = tmp
            try:
                deffile = app.OpenSharedParameterFile()
                grupo = None
                for g in deffile.Groups:
                    if g.Name == 'ARMADURAS':
                        grupo = g
                        break
                if grupo is None:
                    grupo = deffile.Groups.Create('ARMADURAS')
                definicion = grupo.Definitions.get_Item(NOMBRE_PARAM_SHEET_ARM)
                if definicion is None:
                    opts = ExternalDefinitionCreationOptions(NOMBRE_PARAM_SHEET_ARM, SpecTypeId.String.Text)
                    definicion = grupo.Definitions.Create(opts)
                cats = app.Create.NewCategorySet()
                for c in doc.Settings.Categories:
                    try:
                        if c.AllowsBoundParameters and c.CategoryType == CategoryType.Model:
                            cats.Insert(c)
                    except Exception:
                        pass
                binding = app.Create.NewInstanceBinding(cats)
                doc.ParameterBindings.Insert(definicion, binding, GroupTypeId.IdentityData)
                doc.Regenerate()
            finally:
                app.SharedParametersFilename = old_file
            for spe in FilteredElementCollector(doc).OfClass(SharedParameterElement):
                if elem_name(spe) == NOMBRE_PARAM_SHEET_ARM:
                    log.append('Parametro compartido {} creado y bindeado a las categorias de modelo (filtro de las tablas de ARMADURAS).'.format(NOMBRE_PARAM_SHEET_ARM))
                    return spe
            return None

        existing_schedules = {elem_name(v): v for v in FilteredElementCollector(doc).OfClass(ViewSchedule)}
        existing_sheet_instances = {}
        for ssi in FilteredElementCollector(doc).OfClass(ScheduleSheetInstance):
            existing_sheet_instances.setdefault(ssi.OwnerViewId.Value, []).append(ssi)

        def limpiar_definicion(definition):
            # retrofit: deja la definicion en blanco para reconfigurarla desde cero,
            # sin importar como haya quedado en una corrida anterior.
            while definition.GetSortGroupFieldCount() > 0:
                definition.RemoveSortGroupField(0)
            while definition.GetFilterCount() > 0:
                definition.RemoveFilter(0)
            for i in range(definition.GetFieldCount() - 1, -1, -1):
                definition.RemoveField(definition.GetField(i).FieldId)

        def texto_ancho_columna(textos):
            # ancho (pies) necesario para que el texto MAS LARGO de 'textos' entre en
            # una sola linea: cantidad de caracteres x ancho fijo por caracter (ver
            # ANCHO_POR_CARACTER_MM arriba).
            candidatos = [t for t in textos if t]
            if not candidatos:
                return ANCHO_COL_MINIMO
            max_texto = max(candidatos, key=len)
            ancho = len(max_texto) * ANCHO_POR_CARACTER_MM / 304.8
            return max(ancho, ANCHO_COL_MINIMO)

        def anchos_desde_textos(textos_col):
            # ancho ideal por columna segun su propio contenido; si la suma excede el
            # ancho reservado, se escala TODO proporcionalmente para no invadir la
            # grilla de planta/cortes (mismo right_reserve que usan 01/02).
            ideal = {clave: texto_ancho_columna(textos) for clave, textos in textos_col.items()}
            suma = sum(ideal.values())
            if suma > right_reserve and suma > 0:
                escala = right_reserve / suma
                return {clave: v * escala for clave, v in ideal.items()}
            return ideal

        def fijar_anchos(sched, indices, anchos, sheet_number):
            # DEBUG (2026-07-14): dos intentos anteriores (orden del template, ancho
            # medido vs aproximado) no cambiaron nada visible en pantalla, asi que en
            # vez de seguir adivinando esto deja constancia en el log de que ancho se
            # PIDIO y que ancho QUEDO realmente leido de vuelta - para saber si el
            # problema es el calculo, el Set(), o algo que lo resetea despues.
            d = sched.Definition
            for clave, idx in indices.items():
                if idx is None:
                    continue
                try:
                    campo = d.GetField(idx)
                    campo.Width = anchos[clave]
                    log.append('DEBUG {} ancho {}: pedido {:.1f}mm, leido de vuelta {:.1f}mm'.format(
                        sheet_number, clave, anchos[clave] * 304.8, campo.Width * 304.8))
                except Exception as e:
                    log.append('ERROR {} fijando ancho de {}: {}'.format(sheet_number, clave, e))

        def configurar_schedule(sched, sheet_number, textos_col):
            # (re)configura campos, agrupacion, filtro, anchos y grafismo de un schedule
            # ya existente (nuevo o reusado de una corrida anterior). Se llama SIEMPRE,
            # para que re-correr el graph tambien retrofitee tablas ya colocadas.
            definition = sched.Definition
            definition.IsItemized = False
            limpiar_definicion(definition)

            schedulable = list(definition.GetSchedulableFields())

            def buscar_campo(nombre_exacto):
                for f in schedulable:
                    if f.GetName(doc) == nombre_exacto:
                        return f
                return None

            def buscar_campo_multi(nombres):
                for n in nombres:
                    f = buscar_campo(n)
                    if f is not None:
                        return f, n
                return None, None

            campo_assembly = campo_por_guid(schedulable, GUID_TAG)
            campo_filtro_arm = campo_por_guid(schedulable, guid_sheet_arm)
            campo_desc, usado_desc = buscar_campo_multi(['Type', 'Family and Type', 'Family'])
            campo_cant_str = campo_por_guid(schedulable, GUID_PART_NUMBER)
            campo_unidad = campo_por_guid(schedulable, GUID_UNIDAD)
            campo_recuento = campo_por_guid(schedulable, GUID_RECUENTO)
            campo_total = campo_por_guid(schedulable, GUID_TOTAL_PLACEHOLDER)
            campo_material = campo_por_guid(schedulable, GUID_MATERIAL)
            campo_comentario = buscar_campo('Type Comments')

            requeridos = (
                ('TAG', campo_assembly), (NOMBRE_PARAM_SHEET_ARM, campo_filtro_arm),
                ('Descripcion (Type/Family and Type/Family)', campo_desc),
                ('Part Number (CANT=N)', campo_cant_str), ('UNIDAD_TBL', campo_unidad),
                ('RECUENTO_TBL', campo_recuento), ('Status Vendor (TOTAL provisional)', campo_total),
                ('MATERIAL (compartido)', campo_material), ('Type Comments', campo_comentario))
            faltantes = [n for n, c in requeridos if c is None]
            if faltantes:
                log.append('ERROR: no se encontraron los campos {} en el schedule multi-categoria.'.format(faltantes))
                todos_nombres = sorted(set(f.GetName(doc) for f in schedulable))
                log.append('Campos disponibles (primeros 40): ' + ', '.join(todos_nombres[:40]))
                return False

            f_assembly = definition.AddField(campo_assembly)
            f_assembly.IsHidden = True
            f_cant_str = definition.AddField(campo_cant_str)
            f_cant_str.IsHidden = True
            idx_desc = definition.GetFieldCount()
            f_desc = definition.AddField(campo_desc)
            f_desc.IsHidden = False
            f_desc.ColumnHeading = 'DESCRIPCION'
            idx_unidad = definition.GetFieldCount()
            f_unidad = definition.AddField(campo_unidad)
            f_unidad.IsHidden = False
            f_unidad.ColumnHeading = 'UNIDAD'
            idx_unitario = definition.GetFieldCount()
            f_recuento = definition.AddField(campo_recuento)
            f_recuento.IsHidden = False
            f_recuento.ColumnHeading = 'UNITARIO'
            idx_total = definition.GetFieldCount()
            f_total = definition.AddField(campo_total)
            f_total.IsHidden = False
            f_total.ColumnHeading = 'TOTAL'
            idx_material = definition.GetFieldCount()
            f_material = definition.AddField(campo_material)
            f_material.IsHidden = False
            f_material.ColumnHeading = 'MATERIAL'
            idx_comentario = definition.GetFieldCount()
            f_comentario = definition.AddField(campo_comentario)
            f_comentario.IsHidden = False
            f_comentario.ColumnHeading = 'COMENTARIO'
            f_filtro = definition.AddField(campo_filtro_arm)
            f_filtro.IsHidden = True

            sg_assembly = ScheduleSortGroupField(f_assembly.FieldId)
            sg_assembly.ShowHeader = True
            definition.AddSortGroupField(sg_assembly)
            sg_cant = ScheduleSortGroupField(f_cant_str.FieldId)
            sg_cant.ShowHeader = True
            definition.AddSortGroupField(sg_cant)
            sg_desc = ScheduleSortGroupField(f_desc.FieldId)
            sg_desc.ShowHeader = False
            definition.AddSortGroupField(sg_desc)

            definition.AddFilter(ScheduleFilter(f_filtro.FieldId, ScheduleFilterType.Equal, sheet_number))

            doc.Regenerate()

            # el template se aplica ANTES de fijar_anchos() y de las siguientes lineas:
            # si controla algun ajuste (grid lines, textos, etc.) el template gana
            # primero, y lo que fijamos explicitamente despues es lo que queda en
            # pantalla. 2026-07-14: fijar_anchos() estaba ANTES de esto (bug de orden
            # que ya traia el graph) - el template pisaba los anchos apenas se
            # aplicaba, y por eso ningun calculo de ancho (fraccion fija, aproximacion
            # por caracteres, medicion real) cambiaba nada en pantalla.
            if template_tabla is not None and sched.ViewTemplateId != template_tabla.Id:
                sched.ViewTemplateId = template_tabla.Id
                doc.Regenerate()

            if estilo_grid is not None:
                if not set_param_by_name(sched, 'Grid lines', estilo_grid):
                    log.append('AVISO: no se pudo asignar el estilo de linea de grilla al schedule {}.'.format(elem_name(sched)))
                set_param_by_name(sched, 'Outline', estilo_grid)
            if tipo_header is not None:
                set_param_by_name(sched, 'Header text', tipo_header)
            if tipo_body is not None:
                set_param_by_name(sched, 'Body text', tipo_body)
            set_param_by_name(sched, 'Show Title', 1)
            set_param_by_name(sched, 'Show Headers', 1)

            anchos = anchos_desde_textos(textos_col)
            fijar_anchos(sched, {'desc': idx_desc, 'unidad': idx_unidad, 'unitario': idx_unitario,
                                  'material': idx_material, 'comentario': idx_comentario,
                                  'total': idx_total}, anchos, sheet_number)
            # el titulo mostrado es "Title on Sheet" (VIEW_DESCRIPTION), no el nombre
            # interno del schedule (que es tecnico, ej. "TBL_ARMADURAS_006"); si el
            # usuario deja el input vacio, el titulo queda en blanco.
            p_titulo = sched.get_Parameter(BuiltInParameter.VIEW_DESCRIPTION)
            if p_titulo is not None and not p_titulo.IsReadOnly and p_titulo.AsString() != titulo_tabla:
                p_titulo.Set(titulo_tabla)
            return True

        creados = 0
        ya_estaban = 0

        limpiados = 0

        TransactionManager.Instance.EnsureInTransaction(doc)
        try:
            spe_sheet_arm = asegurar_param_sheet_arm()
            if spe_sheet_arm is None:
                log.append('ERROR: no se pudo crear/encontrar el parametro compartido {}; sin el no se pueden filtrar las tablas de ARMADURAS. No se creo ninguna tabla.'.format(NOMBRE_PARAM_SHEET_ARM))
                tipos_por_sheet = {}
            else:
                guid_sheet_arm = spe_sheet_arm.GuidValue
            # cual campo se usa para DESCRIPCION (Type / Family and Type / Family) hace
            # falta ANTES de recorrer los sheets, para poder armar el texto real que va
            # a mostrar cada tabla y medir el ancho de columna necesario. Se prueba con
            # un schedule descartable, mismo patron que 01 mide el area util con una
            # lamina de prueba.
            _probe = ViewSchedule.CreateSchedule(doc, MULTI_CAT_ID)
            _probe_fields = list(_probe.Definition.GetSchedulableFields())
            usado_desc_global = None
            for _n in ('Type', 'Family and Type', 'Family'):
                if any(f.GetName(doc) == _n for f in _probe_fields):
                    usado_desc_global = _n
                    break
            doc.Delete(_probe.Id)

            for sheet_number, (sh, tipos) in tipos_por_sheet.items():
                # texto real que va a mostrar cada columna en ESTE sheet - se junta
                # mientras se recorren los grupos mas abajo, y se usa al final para
                # calcular el ancho de columna (ver texto_ancho_columna).
                textos_col = {'desc': ['DESCRIPCION'], 'unidad': ['UNIDAD'],
                              'unitario': ['UNITARIO'], 'total': ['TOTAL'],
                              'material': ['MATERIAL'], 'comentario': ['COMENTARIO']}
                # elementos "legitimos" para este sheet: las hojas de la PRIMERA instancia
                # de cada tipo que SI esta en este sheet (son las que recibiran
                # SHEET_ARMADURAS fresco mas abajo).
                hojas_legitimas = set()
                for tname_legit in tipos:
                    hojas_l, _ = miembros_recursivos(by_type[tname_legit][0])
                    for el in hojas_l:
                        cat_id_l = el.Category.Id if el.Category is not None else None
                        if cat_id_l == CAT_FRAMING or cat_id_l == CAT_GENERIC_MODEL:
                            continue  # excluidas de la tabla: no son "legitimas" tampoco
                        hojas_legitimas.add(el.Id.Value)

                # limpieza GLOBAL: cualquier elemento del PROYECTO (sin importar si sigue
                # siendo miembro de un assembly - al borrar un assembly sus miembros quedan
                # sueltos en el modelo pero conservan el SHEET_ARMADURAS que se les puso)
                # con SHEET_ARMADURAS = este numero de sheet que NO sea uno de los
                # legitimos de arriba, se borra para que no aparezca como fila fantasma.
                # (Comments NO se toca: es el filtro de las tablas de la rutina de Formas.)
                regla = ParameterFilterRuleFactory.CreateEqualsRule(
                    spe_sheet_arm.Id, sheet_number)
                filtro_global = ElementParameterFilter(regla)
                for el in FilteredElementCollector(doc).WherePasses(filtro_global).WhereElementIsNotElementType().ToElements():
                    if el.Id.Value in hojas_legitimas:
                        continue
                    pc_o = el.get_Parameter(guid_sheet_arm)
                    if pc_o is not None and not pc_o.IsReadOnly:
                        pc_o.Set('')
                        limpiados += 1

                for tname in tipos:
                    ai = by_type[tname][0]
                    cant_assembly = len(by_type[tname])
                    cant_str = 'CANT={}'.format(cant_assembly)

                    hojas, contenedores = miembros_recursivos(ai)

                    # limpieza: si una corrida anterior (con el bug de contar el
                    # contenedor como si fuera una hoja) dejo SHEET_ARMADURAS puesto en el
                    # elemento "envoltorio", hay que borrarlo para que deje de aparecer
                    # como fila espuria en el schedule (el filtro es por SHEET_ARMADURAS).
                    for cont in contenedores:
                        pc_cont = cont.get_Parameter(guid_sheet_arm)
                        if pc_cont is not None and not pc_cont.IsReadOnly and pc_cont.AsString():
                            pc_cont.Set('')

                    grupos = {}
                    for el in hojas:
                        cat_id = el.Category.Id if el.Category is not None else None
                        if cat_id == CAT_FRAMING or cat_id == CAT_GENERIC_MODEL:
                            continue  # Regla 3 + filtro de oficina: se ignoran completamente
                        try:
                            sym_id = el.Symbol.Id.Value
                        except Exception:
                            continue
                        grupos.setdefault(sym_id, []).append(el)

                    for sym_id, els in grupos.items():
                        cat_id = els[0].Category.Id
                        es_foundation = (cat_id == CAT_FOUNDATION)
                        if es_foundation:
                            unidad = 'm3'
                            recuento = 0.0
                            for el in els:
                                recuento += volumen_geometria(el)
                            log.append('DEBUG {} / {}: volumen geometria = {} m3 ({} instancia(s))'.format(
                                tname, elem_name(els[0].Symbol), formatear_numero(recuento), len(els)))
                        else:
                            unidad = 'un'
                            recuento = float(len(els))

                        # TOTAL = UNITARIO x CANT (cantidad de instancias del assembly,
                        # el mismo numero que muestra el encabezado "CANT=N")
                        total_val = recuento * cant_assembly
                        total_str = formatear_numero(total_val)

                        material_val = ''
                        pm_mat = els[0].get_Parameter(GUID_MATERIAL)
                        if pm_mat is not None:
                            material_val = pm_mat.AsString() or ''

                        # texto real de DESCRIPCION segun que campo matcheo (Type /
                        # Family and Type / Family - ver usado_desc_global) y de
                        # COMENTARIO (Type Comments), para medir el ancho de columna
                        # necesario mas abajo.
                        sym = els[0].Symbol
                        if usado_desc_global == 'Family and Type':
                            try:
                                texto_desc = '{}: {}'.format(sym.Family.Name, elem_name(sym))
                            except Exception:
                                texto_desc = elem_name(sym)
                        elif usado_desc_global == 'Family':
                            try:
                                texto_desc = sym.Family.Name
                            except Exception:
                                texto_desc = elem_name(sym)
                        else:
                            texto_desc = elem_name(sym)
                        pc_tc = sym.get_Parameter(BuiltInParameter.ALL_MODEL_TYPE_COMMENTS)
                        texto_comentario = (pc_tc.AsString() or '') if pc_tc is not None else ''
                        textos_col['desc'].append(texto_desc)
                        textos_col['unidad'].append(unidad)
                        textos_col['unitario'].append(formatear_numero(recuento))
                        textos_col['total'].append(total_str)
                        textos_col['material'].append(material_val)
                        textos_col['comentario'].append(texto_comentario)

                        for el in els:
                            p_zona = el.get_Parameter(GUID_TAG)
                            if p_zona is not None and not p_zona.IsReadOnly and p_zona.AsString() != tname:
                                p_zona.Set(tname)
                            p_com = el.get_Parameter(guid_sheet_arm)
                            if p_com is not None and not p_com.IsReadOnly and p_com.AsString() != sheet_number:
                                p_com.Set(sheet_number)
                            p_cs = el.get_Parameter(GUID_PART_NUMBER)
                            if p_cs is not None and not p_cs.IsReadOnly and p_cs.AsString() != cant_str:
                                p_cs.Set(cant_str)
                            p_cn = el.get_Parameter(GUID_ELEMENTO_CANT)
                            if p_cn is not None and not p_cn.IsReadOnly and p_cn.AsInteger() != cant_assembly:
                                p_cn.Set(cant_assembly)
                            p_u = el.get_Parameter(GUID_UNIDAD)
                            if p_u is not None and not p_u.IsReadOnly and p_u.AsString() != unidad:
                                p_u.Set(unidad)
                            p_r = el.get_Parameter(GUID_RECUENTO)
                            if p_r is not None and not p_r.IsReadOnly:
                                set_double_smart(p_r, recuento)
                            p_t = el.get_Parameter(GUID_TOTAL_PLACEHOLDER)
                            if p_t is not None and not p_t.IsReadOnly and p_t.AsString() != total_str:
                                p_t.Set(total_str)

                nombre_schedule = PREFIJO_SCHEDULE + sheet_number
                sched_existente = next(
                    (doc.GetElement(ssi.ScheduleId) for ssi in existing_sheet_instances.get(sh.Id.Value, [])
                     if doc.GetElement(ssi.ScheduleId) is not None
                     and elem_name(doc.GetElement(ssi.ScheduleId)) == nombre_schedule),
                    None)

                # si ya existe un schedule con este nombre pero de la categoria vieja
                # (Assemblies, de versiones anteriores de este graph), hay que borrarlo:
                # la categoria de un ViewSchedule no se puede cambiar una vez creado.
                candidato = sched_existente or existing_schedules.get(nombre_schedule)
                if candidato is not None and candidato.Definition.CategoryId != MULTI_CAT_ID:
                    doc.Delete(candidato.Id)
                    existing_schedules.pop(nombre_schedule, None)
                    sched_existente = None
                    candidato = None
                    log.append('AVISO: se recreo la tabla del sheet {} (era de una version anterior).'.format(sheet_number))

                if sched_existente is not None:
                    configurar_schedule(sched_existente, sheet_number, textos_col)
                    ya_estaban += 1
                    continue

                sched = existing_schedules.get(nombre_schedule)
                if sched is None:
                    sched = ViewSchedule.CreateSchedule(doc, MULTI_CAT_ID)
                    sched.Name = nombre_schedule
                    existing_schedules[nombre_schedule] = sched
                if not configurar_schedule(sched, sheet_number, textos_col):
                    continue

                x0, y0, x1, y1 = usable_rect(sh)
                punto = XYZ(x1, y1, 0.0)
                try:
                    ScheduleSheetInstance.Create(doc, sh.Id, sched.Id, punto)
                    creados += 1
                    log.append('OK: tabla de assemblies creada en sheet {} ({} tipos).'.format(sheet_number, len(tipos)))
                except Exception as e:
                    log.append('ERROR colocando la tabla en sheet {}: {}'.format(sheet_number, e))
        finally:
            TransactionManager.Instance.TransactionTaskDone()

        log.insert(0, 'Tablas creadas: {} | ya existian: {} | SHEET_ARMADURAS limpiados de elementos ya no vigentes: {}'.format(
            creados, ya_estaban, limpiados))
        OUT = log
# ----------------------------------------
log = Watch(py_tabla_de_assemblies_por_sheet)  # graph output
