# Dynamo graph 07_Cantidad en leyendas.dyn (Dynamo 4.0.2.3852)
# Escribe en el parametro de vista Cantidad_Inserto de cada leyenda ya colocada (02) la suma del TOTAL (de la tabla de 06) de ese tipo, sumada entre los assemblies colocados en el mismo sheet. Correr despues de 06.

sheets_destino_numeros_con_coma = StringInput("")  # "Sheets destino (numeros con coma, o prefijo)"; graph input
py_cantidad_en_leyendas = Python(IN[0]=sheets_destino_numeros_con_coma)  # PythonNet3
# ---------- py_cantidad_en_leyendas.python (226 lines) ----------
# 07_Cantidad en leyendas - Escribe, en el parametro de vista "Cantidad_Inserto" de
# cada leyenda ya colocada por 02 en un sheet, la suma del TOTAL (columna TOTAL de la
# tabla de 06_Tabla de assemblies, precalculado en el parametro compartido "Status
# Vendor") de ese TIPO de familia, sumado SOLO entre los assemblies colocados en ESE
# MISMO sheet (no todo el proyecto).
#
# IMPORTANTE: este graph debe correrse DESPUES de 06_Tabla de assemblies, porque lee
# un valor que 06 ya tiene que haber calculado y escrito. Si se corre antes de 06 (o
# antes de que 06 haya procesado el sheet correspondiente), el TOTAL de ese tipo
# todavia no existe y la leyenda queda avisada en el log en vez de actualizarse.
# Re-correr este graph siempre actualiza el valor (no es un calculo que se salte si
# ya esta puesto).
#
# Revit 2027 / Dynamo 4 / CPython3
# IN[0] = sheets destino: numeros separados por coma, o un prefijo comun

import clr
clr.AddReference('RevitAPI')
clr.AddReference('RevitServices')
from Autodesk.Revit.DB import (FilteredElementCollector, AssemblyInstance, ViewSheet,
                               Viewport, View, ViewType, BuiltInCategory, ElementId,
                               Element, FamilyInstance, StorageType)
from RevitServices.Persistence import DocumentManager
from RevitServices.Transactions import TransactionManager
from System import Guid

doc = DocumentManager.Instance.CurrentDBDocument

sheets_text = (IN[0] or '').strip()

# GUID del parametro compartido "Status Vendor" - mismo campo que 06_Tabla de
# assemblies usa para la columna TOTAL (precalculada, texto con coma decimal).
GUID_TOTAL_PLACEHOLDER = Guid('8c16c90e-4802-4747-96dc-73e116d7e3ed')
PARAM_CANTIDAD = 'Cantidad_Inserto'
CAT_FRAMING = ElementId(BuiltInCategory.OST_StructuralFraming)
CAT_GENERIC_MODEL = ElementId(BuiltInCategory.OST_GenericModel)
# contrato de nombres de la rutina de ARMADURAS (ver 00): las laminas de esta
# rutina tienen colocadas plantas 'FN-1001 - ARMADURA' y cortes 'FN-1001 -
# ARMADURA - CORTE A/B'.
SUFIJO_ARMADURAS = ' - ARMADURA'
SUFIJO_CORTE = SUFIJO_ARMADURAS + ' - CORTE A'
SUFIJO_CORTE_B = SUFIJO_ARMADURAS + ' - CORTE B'
SUFIJOS_CORTE = (SUFIJO_CORTE, SUFIJO_CORTE_B)

log = []

def elem_name(e):
    try:
        return e.Name
    except Exception:
        return Element.Name.__get__(e)

def sufijo_corte(nombre):
    for s in SUFIJOS_CORTE:
        if nombre.endswith(s):
            return s
    return None

def parse_numero(s):
    # inverso de formatear_numero() de 06 (coma decimal -> float)
    if not s:
        return 0.0
    try:
        return float(s.replace(',', '.'))
    except Exception:
        return 0.0

def formatear_numero(n):
    # misma convencion que formatear_numero() de 06 (coma decimal, enteros sin
    # decimales) - se duplica aca porque cada nodo Python de Dynamo es
    # independiente. Sin esto, un Cantidad_Inserto de tipo String (caso de los
    # pernos, ej.) quedaba como texto crudo de Python ("12.0" en vez de "12").
    if abs(n - round(n)) < 1e-9:
        return str(int(round(n)))
    texto = '{:.3f}'.format(n).rstrip('0').rstrip('.')
    return texto.replace('.', ',')

# --- sheets destino (misma logica que el resto del pipeline) ---
all_sheets = {}
for s in FilteredElementCollector(doc).OfClass(ViewSheet):
    all_sheets[s.SheetNumber] = s

target_sheets = []
seen = set()
for tok in [t.strip() for t in sheets_text.split(',') if t.strip()]:
    if tok in all_sheets:
        matches = [all_sheets[tok]]
    else:
        matches = [s for n, s in all_sheets.items() if n.startswith(tok)]
    for s in matches:
        if s.SheetNumber not in seen:
            seen.add(s.SheetNumber)
            target_sheets.append(s)
target_sheets.sort(key=lambda s: s.SheetNumber)

if not target_sheets:
    log.append('ERROR: ningun sheet coincide con "{}".'.format(sheets_text))
    log.append('Sheets del proyecto: ' + ', '.join(sorted(all_sheets.keys())[:30]))
    OUT = log
else:
    by_type = {}
    for ai in FilteredElementCollector(doc).OfClass(AssemblyInstance):
        by_type.setdefault(ai.AssemblyTypeName, []).append(ai)

    def hojas_recursivas(ai):
        # hojas (FamilyInstance sin sub-componentes propios) a cualquier profundidad
        # de anidamiento - mismo patron que 03/06.
        vistos = set()
        hojas = []
        stack = list(ai.GetMemberIds())
        while stack:
            eid = stack.pop()
            if eid.Value in vistos:
                continue
            vistos.add(eid.Value)
            el = doc.GetElement(eid)
            if el is None or not isinstance(el, FamilyInstance):
                continue
            subs = []
            try:
                subs = list(el.GetSubComponentIds())
            except Exception:
                pass
            if subs:
                stack.extend(subs)
            else:
                hojas.append(el)
        return hojas

    def assemblies_en_sheet(sheet):
        # tipos de assembly colocados en el sheet (mismo criterio que 02: resuelve
        # cada viewport a su vista, quita el sufijo de corte si corresponde).
        tipos = set()
        for vpid in sheet.GetAllViewports():
            vp = doc.GetElement(vpid)
            v = doc.GetElement(vp.ViewId)
            if v is None:
                continue
            nombre = elem_name(v)
            suf = sufijo_corte(nombre)
            base = nombre[:-len(suf)] if suf else nombre
            # la planta de ARMADURAS conserva el sufijo despues del strip de corte
            if base.endswith(SUFIJO_ARMADURAS):
                base = base[:-len(SUFIJO_ARMADURAS)]
            if base in by_type:
                tipos.add(base)
        return tipos

    def leyendas_en_sheet(sheet):
        leyendas = []
        for vpid in sheet.GetAllViewports():
            vp = doc.GetElement(vpid)
            v = doc.GetElement(vp.ViewId)
            if v is not None and not v.IsTemplate and v.ViewType == ViewType.Legend:
                leyendas.append(v)
        return leyendas

    def total_del_tipo_en_assembly(ai, nombre_tipo):
        # TOTAL ya calculado por 06 (Status Vendor) para el tipo <nombre_tipo> DENTRO
        # de este assembly - se lee de la primera hoja que matchee (06 escribe el
        # mismo valor en todas las instancias del grupo, alcanza con una). None si
        # el tipo no aparece en este assembly o 06 nunca lo proceso.
        low = nombre_tipo.lower()
        for el in hojas_recursivas(ai):
            cat_id = el.Category.Id if el.Category is not None else None
            if cat_id == CAT_FRAMING or cat_id == CAT_GENERIC_MODEL:
                continue  # mismo filtro de oficina que 06: nunca entran a la tabla
            try:
                if el.Symbol.Name.lower() != low:
                    continue
            except Exception:
                continue
            p = el.get_Parameter(GUID_TOTAL_PLACEHOLDER)
            if p is not None:
                return parse_numero(p.AsString())
        return None

    total = 0
    TransactionManager.Instance.EnsureInTransaction(doc)
    try:
        for sh in target_sheets:
            tipos_sheet = assemblies_en_sheet(sh)
            leyendas = leyendas_en_sheet(sh)
            if not leyendas:
                continue
            for lv in leyendas:
                nombre_tipo = elem_name(lv)
                # 02 coloca en cada sheet un DUPLICADO propio de la leyenda,
                # nombrado "{tipo} - {sheet}" (una Legend compartida entre sheets
                # tiene UN solo Cantidad_Inserto y las sumas por lamina se pisaban
                # entre si): se quita el sufijo para matchear el tipo real, y la
                # suma de ESTA lamina se escribe en SU duplicado.
                suf_sheet = ' - ' + sh.SheetNumber
                if nombre_tipo.endswith(suf_sheet):
                    nombre_tipo = nombre_tipo[:-len(suf_sheet)]
                suma = 0.0
                encontrado = False
                for tn in tipos_sheet:
                    val = total_del_tipo_en_assembly(by_type[tn][0], nombre_tipo)
                    if val is not None:
                        suma += val
                        encontrado = True
                if not encontrado:
                    log.append('AVISO: la leyenda "{}" (sheet {}) no matcheo ningun tipo ya procesado por 06_Tabla de assemblies; corre ese graph primero.'.format(nombre_tipo, sh.SheetNumber))
                    continue
                p = lv.LookupParameter(PARAM_CANTIDAD)
                if p is None:
                    log.append('AVISO: la leyenda "{}" no tiene el parametro {} (agregarlo como parametro de proyecto en la categoria Views).'.format(nombre_tipo, PARAM_CANTIDAD))
                    continue
                if p.IsReadOnly:
                    log.append('AVISO: {} esta bloqueado (solo lectura) en la leyenda "{}".'.format(PARAM_CANTIDAD, nombre_tipo))
                    continue
                st = p.StorageType
                if st == StorageType.Integer:
                    p.Set(int(round(suma)))
                elif st == StorageType.Double:
                    p.Set(suma)
                else:
                    p.Set(formatear_numero(suma))
                total += 1
                log.append('OK: leyenda "{}" (sheet {}) -> {} = {}.'.format(nombre_tipo, sh.SheetNumber, PARAM_CANTIDAD, formatear_numero(suma)))
    finally:
        TransactionManager.Instance.TransactionTaskDone()

    log.insert(0, 'Leyendas actualizadas: {}'.format(total))
    OUT = log
# ----------------------------------------
log = Watch(py_cantidad_en_leyendas)  # graph output
