# Dynamo graph 99_Crear tabla base ARMADURAS.dyn (Dynamo 4.0.2.3852)
# TEMPORAL: arma la tabla base de despiece para guardarla como view template de schedule. Correr, cargar las 4 formulas a mano, volver a correr.

nombre_de_la_tabla_base_o_del = StringInput("TABLA_ARMADURAS_BASE")  # "Nombre de la tabla base o del view template"; graph input
sin_uso = IntegerSlider(20, range=5..50 step 1)  # graph input
ancho_total_de_la_tabla_mm = IntegerSlider(150, range=0..200 step 5)  # graph input
estilo_de_linea_grid_outline = StringInput("Líneas Tablas Finas")  # graph input
tipo_de_texto_encabezados = StringInput("C_TXT_RomanD2.3mm")  # graph input
tipo_de_texto_cuerpo = StringInput("C_TXT_RomanD2.3mm_Negrita")  # graph input
titulo_de_la_tabla = StringInput("TABLA DE DESPIECE DE ARMADURAS")  # graph input
sin_uso_2 = StringInput("")  # graph input
py_crear_ordenar_tabla_base = Python(IN[0]=nombre_de_la_tabla_base_o_del, IN[1]=sin_uso, IN[2]=ancho_total_de_la_tabla_mm, IN[3]=estilo_de_linea_grid_outline, IN[4]=tipo_de_texto_encabezados, IN[5]=tipo_de_texto_cuerpo, IN[6]=titulo_de_la_tabla, IN[7]=sin_uso_2)  # PythonNet3
# ---------- py_crear_ordenar_tabla_base.python (554 lines) ----------
# 99_Crear tabla base ARMADURAS (TEMPORAL) - arma la tabla de despiece que despues se
# guarda como VIEW TEMPLATE de schedule, para que las formulas viajen con el template y
# las columnas dejen de ser una foto.
#
# POR QUE ESTE GRAPH ES A MEDIAS: la API de Revit NO permite crear valores calculados
# (formulas) en un schedule. Es una limitacion vieja y sin fecha de arreglo. Entonces
# este graph pone TODO lo que la API si puede (campos nativos, compartidos, orden,
# anchos, unidades, totales, agrupacion, grafismo) y deja 4 huecos que se llenan A MANO
# una sola vez.
#
# COMO SE USA (2 corridas):
#   1) Correr -> crea la tabla base con todos los campos posibles. El log dice que falta.
#   2) A mano en Revit: abrir la tabla, Fields > Calculated Value, y crear las 4 formulas
#      con los NOMBRES EXACTOS y los TIPOS que indica el log.
#   3) Volver a correr -> ordena las columnas, aplica unidades, anchos y totales.
#   4) Guardar como view template y BORRAR esta tabla (el template se queda con todo).
#
# NO borra ni rehace campos: se puede re-correr sin perder las formulas cargadas a mano.
#
# Revit 2027 / Dynamo 4 / CPython3
# IN[0] = nombre de la tabla base
# IN[1] = (sin uso en este graph)
# IN[2] = ancho total disponible para la tabla (mm) - debe coincidir con la reserva del 05
# IN[3] = nombre del estilo de linea para grid/outline (vacio = no tocar)
# IN[4] = nombre del tipo de texto para encabezados (vacio = no tocar)
# IN[5] = nombre del tipo de texto para el cuerpo (vacio = no tocar)
# IN[6] = titulo de la tabla
# IN[7] = (sin uso en este graph)

import clr
clr.AddReference('RevitAPI')
clr.AddReference('RevitServices')
from Autodesk.Revit.DB import (FilteredElementCollector, ViewSchedule, ScheduleSortGroupField,
                               BuiltInCategory, BuiltInParameter, ElementId, Element,
                               TextNoteType, GraphicsStyle, StorageType, SharedParameterElement,
                               ExternalDefinitionCreationOptions, SpecTypeId, GroupTypeId,
                               FormatOptions, UnitTypeId, ForgeTypeId, ScheduleFieldDisplayType,
                               ScheduleFieldId)
from RevitServices.Persistence import DocumentManager
from RevitServices.Transactions import TransactionManager
from System import Guid
from System.Collections.Generic import List
import os
import tempfile

doc = DocumentManager.Instance.CurrentDBDocument

nombre_base = (IN[0] or '').strip() or 'TBL_ARMADURAS_BASE'
ancho_total = float(IN[2]) / 304.8
grid_style_name = (IN[3] or '').strip()
header_text_name = (IN[4] or '').strip()
body_text_name = (IN[5] or '').strip()
titulo_tabla = (IN[6] or '').strip()

# --- GUIDs de compartidos ya existentes en el proyecto (los mismos que usa el 05) ---
GUID_ITEM = Guid('48cfe67b-4544-4f71-bd75-e46767622ddd')      # ITEM_TBL -> MARCA
GUID_A = Guid('834200b7-07e9-4677-a81a-44dc862ff50b')
GUID_B = Guid('e0d9703a-2ca6-44f8-8ca6-ce70571458d7')
GUID_C = Guid('4aad6aab-b0e9-4528-bfa3-eeb96adaead0')
GUID_D = Guid('e70a9408-6d69-44f5-848d-f5ba4cb037e5')
GUID_E = Guid('74e389d7-fb43-471a-8f8d-830bf717db8e')
GUID_F = Guid('60bd0376-836e-484f-89d4-d8fb8d985f34')

NOMBRE_PARAM_SHEET_ARM = 'SHEET_ARMADURAS'
NOMBRE_CANT_ASSY = 'ARM_CANT_ASSY'
NOMBRES_ARM = ['ARM_L1', 'ARM_L2', NOMBRE_CANT_ASSY]
# ARM_CANT_ASSY es ENTERO, no texto: es el multiplicador de las formulas de TOTAL y PESO
# TOTAL (la cantidad de assemblies del tipo, el mismo numero que el "CANT=X" del
# encabezado ARM_L2, que es texto y por eso no sirve dentro de una formula).
SPECS_ARM = {NOMBRE_CANT_ASSY: SpecTypeId.Int.Integer}

# GUIDs CANONICOS: fijos a proposito. La identidad de un compartido es el GUID, no el
# nombre; con GUIDs al azar el view template no seria transferible a otro proyecto (el
# template apuntaria a parametros que alla no existen). Tienen que ser IDENTICOS a los
# del 05.
GUIDS_CANONICOS = {
    'SHEET_ARMADURAS': Guid('f13e5924-2e85-4b1d-a5ec-ed90ba914a21'),
    'ARM_L1': Guid('c1ac69e4-5005-4849-8952-f14e2101cf20'),
    'ARM_L2': Guid('59d4055b-b7b5-4125-bdf7-52ffd41649c5'),
    'ARM_CANT_ASSY': Guid('8f890889-5f44-43a0-8cbf-83f5d06f2474'),
}
ARCHIVO_COMPARTIDOS = 'bios_params_armaduras_v2.txt'
REBAR_CAT_ID = ElementId(BuiltInCategory.OST_Rebar)

# Las 4 formulas que hay que cargar a mano. (nombre exacto, tipo, formula)
# TOTAL y PESO TOTAL multiplican por los TRES factores: largo unitario x barras del set x
# assemblies del tipo. Las barras del set las suma Revit al colapsar la fila (por eso esos
# dos campos llevan Calculate totals, que aplica este graph en la segunda corrida).
FORMULAS = [
    ('UNIT. (m)', 'Length (Longitud)',
     'A + B + C + D + E + F'),
    ('TOTAL (m)', 'Length (Longitud)',
     '(A + B + C + D + E + F) * Quantity * ARM_CANT_ASSY'),
    ('PESO UNIT. (Kg)', 'Mass (Masa)',
     '(A + B + C + D + E + F) * Bar Mass per Unit Length'),
    ('PESO TOTAL (Kg)', 'Mass (Masa)',
     '(A + B + C + D + E + F) * Bar Mass per Unit Length * Quantity * ARM_CANT_ASSY'),
]

# --- definicion de columnas, en el orden final que tiene que quedar ---
# (clave, referencia, encabezado, ancho_mm, unidad, totalizar, oculto)
#   referencia: Guid                  -> compartido de la barra, por GUID
#               'NOMBRE'              -> compartido que crea este graph, por nombre
#               ('nat', [nombres])    -> campo nativo, primero de la lista que exista
#               ('calc', nombre)      -> valor calculado, cargado A MANO
#   unidad:     None | 'mm' | 'm' | 'kg'
#   totalizar:  True -> DisplayType.Totals (suma al colapsar la fila en vez de partirla)
COLS = [
    ('l1',      'ARM_L1',                          '',                      10.0, None, False, True),
    ('l2',      'ARM_L2',                          '',                      10.0, None, False, True),
    ('marca',   GUID_ITEM,                         'MARCA',                 12.0, None, False, False),
    ('tipo',    ('nat', ['Shape', 'Shape Name']),  'TIPO',                  13.0, None, False, False),
    ('diam',    ('nat', ['Bar Diameter']),         'Diam (mm)',              9.0, 'mm', False, False),
    ('cant',    ('nat', ['Quantity']),             'CANTIDAD TOTAL BARRAS', 14.0, None, True,  False),
    ('a',       GUID_A,                            'A (mm)',                 8.0, 'mm', False, False),
    ('b',       GUID_B,                            'B (mm)',                 8.0, 'mm', False, False),
    ('c',       GUID_C,                            'C (mm)',                 8.0, 'mm', False, False),
    ('d',       GUID_D,                            'D (mm)',                 8.0, 'mm', False, False),
    ('e',       GUID_E,                            'E (mm)',                 8.0, 'mm', False, False),
    ('f',       GUID_F,                            'F (mm)',                 8.0, 'mm', False, False),
    ('unit',    ('calc', 'UNIT. (m)'),             'UNIT. (m)',             10.0, 'm',  False, False),
    ('total',   ('calc', 'TOTAL (m)'),             'TOTAL (m)',             10.0, 'm',  True,  False),
    ('peso_u',  ('calc', 'PESO UNIT. (Kg)'),       'PESO UNIT. (Kg)',       11.0, 'kg', False, False),
    ('peso_t',  ('calc', 'PESO TOTAL (Kg)'),       'PESO TOTAL (Kg)',       11.0, 'kg', True,  False),
    ('obs',     ('nat', ['Comments']),             'OBSERVACION',           12.0, None, False, False),
    # ocultos de apoyo: para que una formula pueda referenciar un parametro, ese parametro
    # tiene que estar como CAMPO del schedule (aunque sea oculto).
    #   'Bar Mass per Unit Length' -> lo usan las dos formulas de peso
    #   ARM_CANT_ASSY              -> multiplicador de assemblies en TOTAL y PESO TOTAL
    #   SHEET_ARMADURAS            -> el filtro por lamina que pone el 05
    ('masa_ml',   ('nat', ['Bar Mass per Unit Length']), '',                10.0, None, False, True),
    ('cant_assy', NOMBRE_CANT_ASSY,                '',                      10.0, None, False, True),
    ('filtro',    NOMBRE_PARAM_SHEET_ARM,          '',                      10.0, None, False, True),
]

log = []


def elem_name(e):
    try:
        return e.Name
    except Exception:
        return Element.Name.__get__(e)


def fid_key(fid):
    # ScheduleFieldId.IntegerValue quedo deprecado en las versiones nuevas a favor de Value
    try:
        return fid.IntegerValue
    except Exception:
        return fid.Value


def nombre_de_campo(f):
    try:
        return f.GetName()
    except Exception:
        try:
            return f.ColumnHeading
        except Exception:
            return ''


def set_param_by_name(el, nombre, valor):
    try:
        p = None
        for q in el.Parameters:
            try:
                if q.Definition.Name.lower().strip() == nombre.lower().strip():
                    p = q
                    break
            except Exception:
                continue
        if p is None or p.IsReadOnly:
            return False
        if p.StorageType == StorageType.ElementId:
            p.Set(valor.Id if hasattr(valor, 'Id') else valor)
        elif p.StorageType == StorageType.Integer:
            p.Set(int(valor))
        elif p.StorageType == StorageType.String:
            p.Set(str(valor))
        else:
            return False
        return True
    except Exception:
        return False


# --- bootstrap de compartidos (mismo patron que el 05) ---
guids_arm = {}
guid_sheet_arm = [None]


def cat_rebar():
    try:
        return doc.Settings.Categories.get_Item(BuiltInCategory.OST_Rebar)
    except Exception:
        return None


def asegurar_binding_rebar(definition):
    app = doc.Application
    rebar_c = cat_rebar()
    if rebar_c is None:
        return
    bmap = doc.ParameterBindings
    it = bmap.ForwardIterator()
    it.Reset()
    binding_existente = None
    while it.MoveNext():
        d = it.Key
        if d is not None and d.Name == definition.Name:
            binding_existente = it.Current
            break
    cats = app.Create.NewCategorySet()
    ya = False
    if binding_existente is not None:
        for c in binding_existente.Categories:
            cats.Insert(c)
            if c.Id.Value == rebar_c.Id.Value:
                ya = True
    if ya:
        return
    cats.Insert(rebar_c)
    binding = app.Create.NewInstanceBinding(cats)
    if binding_existente is not None:
        bmap.ReInsert(definition, binding, GroupTypeId.Data)
    else:
        bmap.Insert(definition, binding, GroupTypeId.Data)


def asegurar_params():
    app = doc.Application
    old_file = app.SharedParametersFilename
    tmp = os.path.join(tempfile.gettempdir(), ARCHIVO_COMPARTIDOS)
    if not os.path.exists(tmp):
        f = open(tmp, 'w')
        f.close()
    app.SharedParametersFilename = tmp
    try:
        deffile = app.OpenSharedParameterFile()
        grupo = None
        for g in deffile.Groups:
            if g.Name == 'ARMADURAS':
                grupo = g
                break
        if grupo is None:
            grupo = deffile.Groups.Create('ARMADURAS')

        spe_por_nombre = {}
        for spe in FilteredElementCollector(doc).OfClass(SharedParameterElement):
            spe_por_nombre[elem_name(spe)] = spe

        for nombre in [NOMBRE_PARAM_SHEET_ARM] + NOMBRES_ARM:
            spe = spe_por_nombre.get(nombre)
            if spe is None:
                definicion = grupo.Definitions.get_Item(nombre)
                if definicion is None:
                    spec = SPECS_ARM.get(nombre, SpecTypeId.String.Text)
                    opts = ExternalDefinitionCreationOptions(nombre, spec)
                    g = GUIDS_CANONICOS.get(nombre)
                    if g is not None:
                        opts.GUID = g
                    definicion = grupo.Definitions.Create(opts)
                rebar_c = cat_rebar()
                cats = app.Create.NewCategorySet()
                if rebar_c is not None:
                    cats.Insert(rebar_c)
                binding = app.Create.NewInstanceBinding(cats)
                doc.ParameterBindings.Insert(definicion, binding, GroupTypeId.Data)
            else:
                idef = None
                try:
                    idef = spe.GetDefinition()
                except Exception:
                    idef = None
                if idef is not None:
                    asegurar_binding_rebar(idef)
    finally:
        app.SharedParametersFilename = old_file
    doc.Regenerate()

    for spe in FilteredElementCollector(doc).OfClass(SharedParameterElement):
        nombre = elem_name(spe)
        if nombre == NOMBRE_PARAM_SHEET_ARM:
            guid_sheet_arm[0] = spe.GuidValue
        elif nombre in NOMBRES_ARM:
            guids_arm[nombre] = spe.GuidValue

    for nombre, g in GUIDS_CANONICOS.items():
        actual = guid_sheet_arm[0] if nombre == NOMBRE_PARAM_SHEET_ARM else guids_arm.get(nombre)
        if actual is not None and str(actual).lower() != str(g).lower():
            log.append('AVISO: {} existe con GUID {} en vez del canonico {}.'.format(nombre, actual, g))
            log.append('El template que salga de aca NO sera transferible a otro proyecto. Para')
            log.append('normalizarlo: borrar ese parametro del proyecto y volver a correr este graph.')


def guid_de_ref(ref):
    if isinstance(ref, Guid):
        return ref
    if ref == NOMBRE_PARAM_SHEET_ARM:
        return guid_sheet_arm[0]
    return guids_arm.get(ref)


def id_param_de_ref(ref):
    g = guid_de_ref(ref)
    if g is None:
        return None
    spe = SharedParameterElement.Lookup(doc, g)
    return spe.Id if spe is not None else None


def aplicar_unidad(field, unidad, etiqueta):
    if not unidad:
        return
    try:
        if unidad == 'mm':
            fo = FormatOptions(UnitTypeId.Millimeters)
            fo.Accuracy = 1.0
        elif unidad == 'm':
            fo = FormatOptions(UnitTypeId.Meters)
            fo.Accuracy = 0.01
        else:
            fo = FormatOptions(UnitTypeId.Kilograms)
            fo.Accuracy = 0.01
        try:
            fo.SetSymbolTypeId(ForgeTypeId())
        except Exception:
            pass
        field.SetFormatOptions(fo)
    except Exception as e:
        log.append('AVISO: no se pudo poner la unidad {} en la columna {}: {}'.format(
            unidad, etiqueta, e))


estilos_linea = list(FilteredElementCollector(doc).OfClass(GraphicsStyle))
tipos_texto = list(FilteredElementCollector(doc).OfClass(TextNoteType))


def buscar_por_nombre(coleccion, nombre, etiqueta):
    if not nombre:
        return None
    low = nombre.lower()
    for e in coleccion:
        if elem_name(e).lower() == low:
            return e
    log.append('AVISO: no se encontro {} "{}"; se deja el default.'.format(etiqueta, nombre))
    return None


TransactionManager.Instance.EnsureInTransaction(doc)
try:
    asegurar_params()
    if guid_sheet_arm[0] is None or any(n not in guids_arm for n in NOMBRES_ARM):
        log.append('ERROR: no se pudieron crear/enlazar los compartidos de apoyo. No se creo nada.')
    else:
        estilo_grid = buscar_por_nombre(estilos_linea, grid_style_name, 'el estilo de linea')
        tipo_header = buscar_por_nombre(tipos_texto, header_text_name, 'el tipo de texto de encabezados')
        tipo_body = buscar_por_nombre(tipos_texto, body_text_name, 'el tipo de texto de cuerpo')

        # El objetivo puede ser una TABLA normal (la base, antes de guardar el template) o
        # directamente el VIEW TEMPLATE ya guardado. Se prioriza la tabla; si no existe, se
        # busca entre los templates. Asi este graph sigue sirviendo despues de haber
        # borrado la tabla base, que es el caso normal una vez montado el pipeline.
        todos = list(FilteredElementCollector(doc).OfClass(ViewSchedule))
        sched = next((v for v in todos if not v.IsTemplate and elem_name(v) == nombre_base), None)
        es_template = False
        if sched is None:
            sched = next((v for v in todos if v.IsTemplate and elem_name(v) == nombre_base), None)
            es_template = sched is not None
        if sched is None:
            sched = ViewSchedule.CreateSchedule(doc, REBAR_CAT_ID)
            sched.Name = nombre_base
            log.append('Tabla base "{}" CREADA.'.format(nombre_base))
        elif es_template:
            log.append('Trabajando sobre el VIEW TEMPLATE "{}" (la tabla base ya no existe).'.format(nombre_base))
            log.append('Los cambios se propagan solos a todas las tablas que usan el template.')
        else:
            log.append('Tabla base "{}" ya existia; no se toca ningun campo, solo se ordena.'.format(nombre_base))

        definition = sched.Definition
        definition.IsItemized = False
        doc.Regenerate()

        # --- inventario de lo que ya tiene la tabla ---
        def campos_actuales():
            res = []
            for fid in definition.GetFieldOrder():
                res.append((fid, definition.GetField(fid)))
            return res

        def buscar_campo(ref):
            actuales = campos_actuales()
            if isinstance(ref, tuple) and ref[0] == 'calc':
                for fid, f in actuales:
                    if nombre_de_campo(f).strip() == ref[1]:
                        return fid, f
                return None, None
            if isinstance(ref, tuple) and ref[0] == 'nat':
                for n in ref[1]:
                    for fid, f in actuales:
                        if nombre_de_campo(f).strip() == n:
                            return fid, f
                return None, None
            pid = id_param_de_ref(ref)
            if pid is None:
                return None, None
            for fid, f in actuales:
                if f.ParameterId == pid:
                    return fid, f
            return None, None

        def agregar_campo(ref):
            # solo para lo que la API si puede agregar (nativos y compartidos)
            schedulable = list(definition.GetSchedulableFields())
            if isinstance(ref, tuple) and ref[0] == 'nat':
                for n in ref[1]:
                    for sf in schedulable:
                        try:
                            if sf.GetName(doc) == n:
                                return definition.AddField(sf)
                        except Exception:
                            continue
                return None
            pid = id_param_de_ref(ref)
            if pid is None:
                return None
            for sf in schedulable:
                if sf.ParameterId == pid:
                    return definition.AddField(sf)
            return None

        # --- agregar lo que falte (menos los valores calculados) ---
        faltan_formulas = []
        no_disponibles = []
        for clave, ref, hdr, ancho, unidad, totalizar, oculto in COLS:
            fid, f = buscar_campo(ref)
            if f is not None:
                continue
            if isinstance(ref, tuple) and ref[0] == 'calc':
                faltan_formulas.append(ref[1])
                continue
            nuevo = agregar_campo(ref)
            if nuevo is None:
                etiqueta = ref[1][0] if isinstance(ref, tuple) else str(ref)
                no_disponibles.append('{} ({})'.format(clave, etiqueta))
        doc.Regenerate()

        # --- orden final, encabezados, anchos, unidades, totales ---
        visibles = [c for c in COLS if not c[6]]
        suma = sum(c[3] for c in visibles)
        escala = (ancho_total / (suma / 304.8)) if suma > 0 else 1.0

        orden = []
        vistos = set()
        for clave, ref, hdr, ancho, unidad, totalizar, oculto in COLS:
            fid, f = buscar_campo(ref)
            if f is None:
                continue
            f.IsHidden = oculto
            if hdr:
                f.ColumnHeading = hdr
            aplicar_unidad(f, unidad, hdr or clave)
            try:
                f.DisplayType = ScheduleFieldDisplayType.Totals if totalizar else ScheduleFieldDisplayType.Standard
            except Exception as e:
                log.append('AVISO: no se pudo poner el modo de la columna {}: {}'.format(hdr or clave, e))
            if not oculto:
                try:
                    f.Width = (ancho / 304.8) * escala
                except Exception as e:
                    log.append('AVISO: no se pudo poner el ancho de {}: {}'.format(hdr or clave, e))
            if fid_key(fid) not in vistos:
                vistos.add(fid_key(fid))
                orden.append(fid)

        for fid in definition.GetFieldOrder():
            if fid_key(fid) not in vistos:
                vistos.add(fid_key(fid))
                orden.append(fid)
        try:
            definition.SetFieldOrder(List[ScheduleFieldId](orden))
        except Exception as e:
            log.append('AVISO: no se pudo reordenar las columnas: {}'.format(e))
        doc.Regenerate()

        # --- agrupacion: ARM_L1 -> ARM_L2 -> MARCA (colapsa una fila por variante) ---
        while definition.GetSortGroupFieldCount() > 0:
            definition.RemoveSortGroupField(0)
        for ref, con_encabezado in [('ARM_L1', True), ('ARM_L2', True), (GUID_ITEM, False)]:
            fid, f = buscar_campo(ref)
            if f is None:
                continue
            sg = ScheduleSortGroupField(fid)
            sg.ShowHeader = con_encabezado
            definition.AddSortGroupField(sg)

        # --- grafismo (lo mismo que aplica el 05 hoy) ---
        if estilo_grid is not None:
            set_param_by_name(sched, 'Grid lines', estilo_grid)
            set_param_by_name(sched, 'Outline', estilo_grid)
        if tipo_header is not None:
            set_param_by_name(sched, 'Header text', tipo_header)
        if tipo_body is not None:
            set_param_by_name(sched, 'Body text', tipo_body)
        set_param_by_name(sched, 'Show Title', 1)
        set_param_by_name(sched, 'Show Headers', 1)
        p_titulo = sched.get_Parameter(BuiltInParameter.VIEW_DESCRIPTION)
        if p_titulo is not None and not p_titulo.IsReadOnly and p_titulo.AsString() != titulo_tabla:
            p_titulo.Set(titulo_tabla)

        # --- informe ---
        conocidos = set()
        for clave, ref, hdr, ancho, unidad, totalizar, oculto in COLS:
            fid, f = buscar_campo(ref)
            if fid is not None:
                conocidos.add(fid_key(fid))
        colados = []
        for fid in definition.GetFieldOrder():
            if fid_key(fid) not in conocidos:
                f = definition.GetField(fid)
                if not f.IsHidden:
                    colados.append(nombre_de_campo(f))
        if colados:
            log.append('')
            log.append('AVISO: la tabla trae columnas visibles que no son de este despiece: ' +
                       ', '.join(colados) + '. Borralas a mano antes de guardar el template.')
        if no_disponibles:
            log.append('')
            log.append('ERROR: este Revit no expone estos campos con ese nombre: ' + ', '.join(no_disponibles))
            nombres = sorted(set(sf.GetName(doc) for sf in definition.GetSchedulableFields()))
            log.append('Campos disponibles: ' + ', '.join(nombres))
        if faltan_formulas:
            log.append('')
            log.append('FALTAN LAS 4 FORMULAS (la API de Revit no las puede crear).')
            log.append('Abre la tabla "{}" > Fields > Calculated Value, y crea:'.format(nombre_base))
            for nombre, tipo, formula in FORMULAS:
                if nombre in faltan_formulas:
                    log.append('   Name: {}   |   Type: {}   |   Formula: {}'.format(nombre, tipo, formula))
            log.append('Despues vuelve a correr este graph para que las ordene y formatee.')
        else:
            log.append('')
            log.append('Las 4 formulas estan cargadas, ordenadas, con sus unidades y con')
            log.append('Calculate totals en TOTAL (m) y PESO TOTAL (Kg).')
            if es_template:
                log.append('Como se trabajo sobre el template, las tablas ya creadas se actualizan solas.')
            else:
                log.append('Ahora: click derecho sobre la tabla en el navegador > Create View Template From View.')
finally:
    TransactionManager.Instance.TransactionTaskDone()

log.insert(0, '--- Tabla base de armaduras ---')
OUT = log
# ----------------------------------------
log = Watch(py_crear_ordenar_tabla_base)  # graph output
